# Dynamo graph Accent Panel Selection.dyn (Dynamo 2.12.0.5650)
# packages: Clockwork for Dynamo 2.x 2.3.0

select_accent_panel_locations = DSModelElementsByCategorySelection("e09d95c8-826d-493e-b591-e297d45b4a08-002b9f52,e09d95c8-826d-493e-b591-e297d45b4a08-002b9f53,e09d95c8-826d-493e-b591-e297d45b4a08-002b9f54,e09d95c8-826d-493e-b591-e297d45b4a08-002b9f5a,e09d95c8-826d-493e-b591-e297d45b4a08-002b9f5b,e09d95c8-826d-493e-b591-e297d45b4a08-002b9f5c,e09d95c8-826d-493e-b591-e297d45b4a08-002b9f6e,e09d95c8-826d-493e-b591-e297d45b4a08-002b9f6f,e09d95c8-826d-493e-b591-e297d45b4a08-002b9f70,e09d95c8-826d-493e-b591-e297d45b4a08-002b9f76,e09d95c8-826d-493e-b591-e297d45b4a08-002b9f77,e09d95c8-826d-493e-b591-e297d45b4a08-002b9f78,e09d95c8-826d-493e-b591-e297d45b4a08-002ba2af,e09d95c8-826d-493e-b591-e297d45b4a08-002ba2b0,e09d95c8-826d-493e-b591-e297d45b4a08-002ba2b1,e09d95c8-826d-493e-b591-e297d45b4a08-002ba2b7,e09d95c8-826d-493e-b591-e297d45b4a08-002ba2b8,e09d95c8-826d-493e-b591-e297d45b4a08-002ba2b9,e09d95c8-826d-493e-b591-e297d45b4a08-002ba2cb,e09d95c8-826d-493e-b591-e297d45b4a08-002ba2cc,e09d95c8-826d-493e-b591-e297d45b4a08-002ba2cd,e09d95c8-826d-493e-b591-e297d45b4a08-002ba2d3,e09d95c8-826d-493e-b591-e297d45b4a08-002ba2d4,e09d95c8-826d-493e-b591-e297d45b4a08-002ba2d5,e09d95c8-826d-493e-b591-e297d45b4a08-002ba541,e09d95c8-826d-493e-b591-e297d45b4a08-002ba542,e09d95c8-826d-493e-b591-e297d45b4a08-002ba543,e09d95c8-826d-493e-b591-e297d45b4a08-002ba555,e09d95c8-826d-493e-b591-e297d45b4a08-002ba556,e09d95c8-826d-493e-b591-e297d45b4a08-002ba557,e09d95c8-826d-493e-b591-e297d45b4a08-002ba55d,e09d95c8-826d-493e-b591-e297d45b4a08-002ba55e,e09d95c8-826d-493e-b591-e297d45b4a08-002ba55f,e09d95c8-826d-493e-b591-e297d45b4a08-002ba571,e09d95c8-826d-493e-b591-e297d45b4a08-002ba572,e09d95c8-826d-493e-b591-e297d45b4a08-002ba573,e09d95c8-826d-493e-b591-e297d45b4a08-002ba7a7,e09d95c8-826d-493e-b591-e297d45b4a08-002ba7a8,e09d95c8-826d-493e-b591-e297d45b4a08-002ba7a9,e09d95c8-826d-493e-b591-e297d45b4a08-002ba7bb,e09d95c8-826d-493e-b591-e297d45b4a08-002ba7bd,e09d95c8-826d-493e-b591-e297d45b4a08-002ba7c9,e09d95c8-826d-493e-b591-e297d45b4a08-002ba7ca,e09d95c8-826d-493e-b591-e297d45b4a08-002ba7cb,e09d95c8-826d-493e-b591-e297d45b4a08-002ba7d7,e09d95c8-826d-493e-b591-e297d45b4a08-002ba7d8,e09d95c8-826d-493e-b591-e297d45b4a08-002ba7d9,e09d95c8-826d-493e-b591-e297d45b4a08-002ba91e,e09d95c8-826d-493e-b591-e297d45b4a08-002ba91f,e09d95c8-826d-493e-b591-e297d45b4a08-002ba920,e09d95c8-826d-493e-b591-e297d45b4a08-002ba926,e09d95c8-826d-493e-b591-e297d45b4a08-002ba927,e09d95c8-826d-493e-b591-e297d45b4a08-002ba928,e09d95c8-826d-493e-b591-e297d45b4a08-002ba934,e09d95c8-826d-493e-b591-e297d45b4a08-002ba935,e09d95c8-826d-493e-b591-e297d45b4a08-002ba936,e09d95c8-826d-493e-b591-e297d45b4a08-002ba948,e09d95c8-826d-493e-b591-e297d45b4a08-002ba949,e09d95c8-826d-493e-b591-e297d45b4a08-002ba94a,e09d95c8-826d-493e-b591-e297d45b4a08-002babe0,e09d95c8-826d-493e-b591-e297d45b4a08-002babe1,e09d95c8-826d-493e-b591-e297d45b4a08-002babe2,e09d95c8-826d-493e-b591-e297d45b4a08-002babee,e09d95c8-826d-493e-b591-e297d45b4a08-002babef,e09d95c8-826d-493e-b591-e297d45b4a08-002babf0,e09d95c8-826d-493e-b591-e297d45b4a08-002babf6,e09d95c8-826d-493e-b591-e297d45b4a08-002babf7,e09d95c8-826d-493e-b591-e297d45b4a08-002babf8,e09d95c8-826d-493e-b591-e297d45b4a08-002bac04,e09d95c8-826d-493e-b591-e297d45b4a08-002bac05,e09d95c8-826d-493e-b591-e297d45b4a08-002bac06")  # 71 picked in the model; graph input
asFamilyInstance = CurtainPanel.AsFamilyInstance(curtainPanel=select_accent_panel_locations)
accent_panel_family = FamilyTypes("System Panel:Cp_Perf_Mtl")  # graph input
setType = Custom[FamilyInstance.SetType](familyInstance=asFamilyInstance, familyType=accent_panel_family)  # package Clockwork for Dynamo 2.x; Changes the family type of a given family instance to the specified type
