# Dynamo graph Center_Areas.dyn (Dynamo 2.13.1.3887)

categories = Categories("OST_AreaTags")
current = Document.Current()
activeView = Document.ActiveView(document=current)
all_elements_of_category_in_view = ElementsOfCategoryInView(Category=categories, View=activeView)
getLocation = Element.GetLocation(element=all_elements_of_category_in_view)
categories_2 = Categories("OST_Areas")
current_2 = Document.Current()
activeView_2 = Document.ActiveView(document=current_2)
all_elements_of_category_in_view_2 = ElementsOfCategoryInView(Category=categories_2, View=activeView_2)
boundaries = Area.Boundaries(area=all_elements_of_category_in_view_2)
startPoint = Curve.StartPoint(curve=boundaries)
byPoints = Polygon.ByPoints(points=startPoint)
center = Polygon.Center(polygon=byPoints)
byTwoPoints = Vector.ByTwoPoints(start=getLocation, end=center)
moveByVector = Element.MoveByVector(element=all_elements_of_category_in_view, vector=byTwoPoints)
