# Dynamo graph CropRegionLW.dyn (Dynamo 2.3.0.5885)
# packages: Rhythm 2021.4.2

# note: ^^^DOWNLOAD 'RHYTHM' FROM PACKAGE MANAGER TAB ABOVE^^^
# CLICK 'RUN' AT BOTTOM LEFT AFTER SHEET SELECTION
sheet_selection = Sheets("A502 : INTERIOR ELEVATIONS")
views = Sheet.Views(sheet=sheet_selection)
view_list = Watch(views)
LINEWEIGHT = CodeBlock { 5; }
ʳʰʸᵗʰᵐ_viewsection = Rhythm.Revit.Views.ViewSection.OverrideCropVersion2(viewSection=view_list, lineWeight=LINEWEIGHT)
