# Dynamo graph DynamicGrid.dyn (Dynamo 2.10.1.3976)
# packages: Rhythm 2021.7.3, Clockwork for Dynamo 2.x 2.3.0

curtain_wall_to_panelize = DSModelElementByCategorySelection(index=686)  # 1 picked in the model
ʳʰʸᵗʰᵐ_curtaingrid_bywallelement = Rhythm.Revit.Elements.CurtainGrid.ByWallElement(curtainWall=curtain_wall_to_panelize)
ʳʰʸᵗʰᵐ_curtaingridline = Rhythm.Revit.Elements.CurtainGridLine.AllSegmentCurves(curtainGridLine=ʳʰʸᵗʰᵐ_curtaingrid_bywallelement.vGrids)
curves = PolyCurve.Curves(polyCurve=ʳʰʸᵗʰᵐ_curtaingridline)
code_block = CodeBlock { 1; }
flatten = List.Flatten(list=curves, amt=code_block)
code_block_2 = CodeBlock { 0; }
count = List.Count(list=flatten)
code_block_3 = CodeBlock(x=count) { x - 1; }
count_2 = List.Count(list=curves)
integer_slider = IntegerSlider(100, range=0..100 step 1)
asIntegers = Custom[RandomList.AsIntegers](min=code_block_2, max=code_block_3, amount=count_2, seed=integer_slider)  # package Clockwork for Dynamo 2.x; Creates a list of random integers between 0 and a given maximum value
getItemAtIndex = List.GetItemAtIndex(list=flatten, index=asIntegers)
ʳʰʸᵗʰᵐ_curtaingridline_2 = Rhythm.Revit.Elements.CurtainGridLine.RemoveSegment(curtainGridLine=ʳʰʸᵗʰᵐ_curtaingrid_bywallelement.vGrids, curves=getItemAtIndex)
integer_slider_2 = IntegerSlider(72, range=0..100 step 1)
