# Dynamo graph Dynamic_Kase_02.dyn (Dynamo 1.3.2.2480)

code_block = CodeBlock {  }

# group: SEARCH FOR CURTAIN PANELS CONTAINING THE TEXT "MASTER"
# note: WORKING!!!
element_types = ElementTypes("PanelType")
all_elements_of_type = ElementsOfType(element_types)
name = FamilyType.Name(all_elements_of_type)
watch = Watch(name)
string_from_object = FromObject(watch)
code_block_2 = CodeBlock { "MASTER"; }
indexOf = String.IndexOf(string=string_from_object, searchFor=code_block_2)
watch_2 = Watch(indexOf)
code_block_3 = CodeBlock { -1; }
ne = watch_2 != code_block_3
filterByBoolMask = List.FilterByBoolMask(list=watch, mask=ne)
watch_3 = Watch(filterByBoolMask.in)
watch_4 = Watch(filterByBoolMask.out)

# group: Select all Model Groups in Active View
categories = Categories("IOSModelGroups")
# note: CLADDING PANELS IN SELECTED BUILDING CONFIGURATION
current = Document.Current()
activeView = Document.ActiveView(current)
watch_5 = Watch(activeView)
byCategoryAndView = archilab.Revit.Selection.Select.ByCategoryAndView(categories, watch_5)

# group: SELECTS ALL ELEMENTS WITHIN THE BOUNDS OF THE BUILDING SCOPE BOX
# note: SUPER IMPORTANT!!!
select_scope_box = DSModelElementSelection()  # 1 picked in the model
geometry = Element.Geometry(select_scope_box)
integer_slider = IntegerSlider(5, range=0..12 step 1)
getItemAtIndex = List.GetItemAtIndex(list=geometry, index=integer_slider)
endPoint = Curve.EndPoint(getItemAtIndex)
integer_slider_2 = IntegerSlider(0, range=0..12 step 1)
getItemAtIndex_2 = List.GetItemAtIndex(list=geometry, index=integer_slider_2)
endPoint_2 = Curve.EndPoint(getItemAtIndex_2)
byCorners = BoundingBox.ByCorners(min=endPoint, max=endPoint_2)
getElementsInside = Revit.BoundingBox.GetElementsInside(byCorners, byCategoryAndView)
name_2 = FamilyType.Name(getElementsInside)
code_block_4 = CodeBlock { {3,4,6,8}; }

# group: FILTERING TO GET ALL EXTERIOR CLADDING WALL PANELS
# note: EC = Exterior Cladding
code_block_5 = CodeBlock { "K4_EC"; }
contains = String.Contains(str=name_2, searchFor=code_block_5)
filterByBoolMask_2 = List.FilterByBoolMask(list=getElementsInside, mask=contains)
cladding_wall_panels = Object.Identity(filterByBoolMask_2.in)

# group: FILTERING OUT LARGE FACE OF UNIT PANEL GROUPS
name_3 = FamilyType.Name(cladding_wall_panels)
code_block_6 = CodeBlock { "Unit"; }
contains_2 = String.Contains(str=name_3, searchFor=code_block_6)
filterByBoolMask_3 = List.FilterByBoolMask(list=cladding_wall_panels, mask=contains_2)
individual_cladding_panels = Object.Identity(filterByBoolMask_3.out)

# group: SELECTED PANEL
integer_slider_3 = IntegerSlider(42, range=0..137 step 1)
getItemAtIndex_3 = List.GetItemAtIndex(list=individual_cladding_panels, index=integer_slider_3)  # frozen
members = Custom[Group.Members](group=getItemAtIndex_3)  # Retrieves the members of a group
string_from_object_2 = FromObject(members)
code_block_7 = CodeBlock { "Curtain Panel"; }
eq = string_from_object_2 == code_block_7
filterByBoolMask_4 = List.FilterByBoolMask(list=members, mask=eq)
geometry_2 = Element.Geometry(filterByBoolMask_4.in)
code_block_8 = CodeBlock { t1 = 255; t2 = 255; t3 = 153; t4 = 0; color1 = DSCore.Color.ByARGB(t1, t2, t3, t4); }
byGeometryColor = Display.Display.ByGeometryColor(geometry_2, code_block_8.color1)

# group: TRANSIENT PANELS
removeItemAtIndex = List.RemoveItemAtIndex(list=individual_cladding_panels, indices=integer_slider_3)  # frozen
members_2 = Custom[Group.Members](group=removeItemAtIndex)
string_from_object_3 = FromObject(members_2)
code_block_9 = CodeBlock { "Curtain Panel"; }
eq_2 = string_from_object_3 == code_block_9
filterByBoolMask_5 = List.FilterByBoolMask(list=members_2, mask=eq_2)
geometry_3 = Element.Geometry(filterByBoolMask_5.in)
code_block_10 = CodeBlock { t1 = 50; t2 = 128; t3 = 128; t4 = 128; color1 = DSCore.Color.ByARGB(t1, t2, t3, t4); }
byGeometryColor_2 = Display.Display.ByGeometryColor(geometry_3, code_block_10.color1)

# group: SELECT ALL INDIVIDUAL EXTERIOR CLADDING PANELS
element_types_2 = ElementTypes("GroupType")
all_elements_of_type_2 = ElementsOfType(element_types_2)
search_criteria = CodeBlock { "K4_EC"; }
search_by_family_type_name = CodeBlock(t2=all_elements_of_type_2, t4=search_criteria)
# ---------- search_by_family_type_name.designscript (6 lines) ----------
t1 = t2.Name;
t3 = String.Contains(t1, t4, false);
t5 = List.FilterByBoolMask(t2, t3);
t6 = __TryGetValueFromNestedDictionaries(t5, "in");
t7 = __TryGetValueFromNestedDictionaries(t5, "out");
t8 = DSCore.Object.Identity(t6);
# ----------------------------------------
exterior_cladding_panels = Object.Identity(search_by_family_type_name.t8)
search_criteria_2 = CodeBlock { "Unit"; }
search_by_family_type_name_2 = CodeBlock(t2=exterior_cladding_panels, t4=search_criteria_2)  # same code as search_by_family_type_name
single_cladding_panels = Object.Identity(search_by_family_type_name_2.t7)

name_4 = FamilyType.Name(single_cladding_panels)
watch_6 = Watch(name_4)

# group: 10'-0" PANELS
search_criteria_3 = CodeBlock { "K4_EC10"; }
search_by_family_type_name_3 = CodeBlock(t2=single_cladding_panels, t4=search_criteria_3)  # same code as search_by_family_type_name
n10_0_panels = Object.Identity(search_by_family_type_name_3.t8)  # "10'-0" PANELS"

# group: 14'-0"PANELS
search_criteria_4 = CodeBlock { "K4_EC14"; }
search_by_family_type_name_4 = CodeBlock(t2=single_cladding_panels, t4=search_criteria_4)  # same code as search_by_family_type_name
n14_0_panels = Object.Identity(search_by_family_type_name_4.t8)  # "14'-0" PANELS"

# group: 13'-0" PANELS
search_criteria_5 = CodeBlock { "K4_EC13"; }
search_by_family_type_name_5 = CodeBlock(t2=single_cladding_panels, t4=search_criteria_5)  # same code as search_by_family_type_name
n13_0_panels = Object.Identity(search_by_family_type_name_5.t8)  # "13'-0" PANELS"

# group: 15'-0" PANELS
search_criteria_6 = CodeBlock { "K4_EC15"; }
search_by_family_type_name_6 = CodeBlock(t2=single_cladding_panels, t4=search_criteria_6)  # same code as search_by_family_type_name
n15_0_panels = Object.Identity(search_by_family_type_name_6.t8)  # "15'-0" PANELS"

# group: PARAPET PANELS
search_criteria_7 = CodeBlock { "K4_EC-P"; }
search_by_family_type_name_7 = CodeBlock(t2=single_cladding_panels, t4=search_criteria_7)  # same code as search_by_family_type_name
parapet_panels = Object.Identity(search_by_family_type_name_7.t8)

# group: COUNT VALIDATION
count = List.Count(n10_0_panels)
count_2 = List.Count(n14_0_panels)
count_3 = List.Count(n13_0_panels)
count_4 = List.Count(n15_0_panels)
count_5 = List.Count(parapet_panels)
create = List.Create(count, count_2, count_3, count_4, count_5)
sum = Math.Sum(create)

# group: LIBRARY OF CLADDING PANELS
sub = CodeBlock {  }

# group: CLADDING PANELS IN SELECTED BUILDING CONFIGURATION
sub_2 = CodeBlock {  }

# group: INDIVIDUAL CLADDING PANELS SELECTION PREVIEW
sub_3 = CodeBlock {  }

# group: 10'-0" PANELS
search_criteria_8 = CodeBlock { "K4_EC10"; }
search_by_family_type_name_8 = CodeBlock(t2=individual_cladding_panels, t4=search_criteria_8)  # same code as search_by_family_type_name
n10_0_panels_2 = Object.Identity(search_by_family_type_name_8.t8)  # "10'-0" PANELS"

# group: 13'-0" PANELS
search_criteria_9 = CodeBlock { "K4_EC13"; }
search_by_family_type_name_9 = CodeBlock(t2=individual_cladding_panels, t4=search_criteria_9)  # same code as search_by_family_type_name
n13_0_panels_2 = Object.Identity(search_by_family_type_name_9.t8)  # "13'-0" PANELS"

# group: 14'-0"PANELS
search_criteria_10 = CodeBlock { "K4_EC14"; }
search_by_family_type_name_10 = CodeBlock(t2=individual_cladding_panels, t4=search_criteria_10)  # same code as search_by_family_type_name
n14_0_panels_2 = Object.Identity(search_by_family_type_name_10.t8)  # "14'-0" PANELS"

# group: 15'-0" PANELS
search_criteria_11 = CodeBlock { "K4_EC15"; }
search_by_family_type_name_11 = CodeBlock(t2=individual_cladding_panels, t4=search_criteria_11)  # same code as search_by_family_type_name
n15_0_panels_2 = Object.Identity(search_by_family_type_name_11.t8)  # "15'-0" PANELS"

# group: PARAPET PANELS
search_criteria_12 = CodeBlock { "K4_EC-P"; }
search_by_family_type_name_12 = CodeBlock(t2=individual_cladding_panels, t4=search_criteria_12)  # same code as search_by_family_type_name
parapet_panels_2 = Object.Identity(search_by_family_type_name_12.t8)

create_2 = List.Create(n10_0_panels_2, n13_0_panels_2, n14_0_panels_2, n15_0_panels_2, parapet_panels_2)

# group: PANEL GROUP DISPLAY
integer_slider_4 = IntegerSlider(0, range=0..4 step 1)
getItemAtIndex_4 = List.GetItemAtIndex(list=create_2, index=integer_slider_4)
members_3 = Custom[Group.Members](group=getItemAtIndex_4)
string_from_object_4 = FromObject(members_3)
code_block_11 = CodeBlock { "Curtain Panel"; }
eq_3 = string_from_object_4 == code_block_11
filterByBoolMask_6 = List.FilterByBoolMask(list=members_3, mask=eq_3)
geometry_4 = Element.Geometry(filterByBoolMask_6.in)
code_block_12 = CodeBlock { t1 = 50; t2 = 255; t3 = 153; t4 = 0; color1 = DSCore.Color.ByARGB(t1, t2, t3, t4); }
byGeometryColor_3 = Display.Display.ByGeometryColor(geometry_4, code_block_12.color1)

# group: TRANSIENT PANELS
removeItemAtIndex_2 = List.RemoveItemAtIndex(list=create_2, indices=integer_slider_4)
members_4 = Custom[Group.Members](group=removeItemAtIndex_2)
string_from_object_5 = FromObject(members_4)
code_block_13 = CodeBlock { "Curtain Panel"; }
eq_4 = string_from_object_5 == code_block_13
filterByBoolMask_7 = List.FilterByBoolMask(list=members_4, mask=eq_4)
geometry_5 = Element.Geometry(filterByBoolMask_7.in)
code_block_14 = CodeBlock { t1 = 50; t2 = 128; t3 = 128; t4 = 128; color1 = DSCore.Color.ByARGB(t1, t2, t3, t4); }
byGeometryColor_4 = Display.Display.ByGeometryColor(geometry_5, code_block_14.color1)

# group: CLADDING PANELS GROUP SELECTION PREVIEW
sub_4 = CodeBlock {  }

# group: INDIVIDUAL PANEL DISPLAY
integer_slider_5 = IntegerSlider(19, range=0..71 step 1)
getItemAtIndex_5 = List.GetItemAtIndex(list=getItemAtIndex_4, index=integer_slider_5)
members_5 = Custom[Group.Members](group=getItemAtIndex_5)
string_from_object_6 = FromObject(members_5)
code_block_15 = CodeBlock { "Curtain Panel"; }
eq_5 = string_from_object_6 == code_block_15
filterByBoolMask_8 = List.FilterByBoolMask(list=members_5, mask=eq_5)
geometry_6 = Element.Geometry(filterByBoolMask_8.in)
code_block_16 = CodeBlock { t1 = 255; t2 = 255; t3 = 153; t4 = 0; color1 = DSCore.Color.ByARGB(t1, t2, t3, t4); }
byGeometryColor_5 = Display.Display.ByGeometryColor(geometry_6, code_block_16.color1)

# group: COUNT VALIDATION
count_6 = List.Count(n10_0_panels_2)
count_7 = List.Count(n13_0_panels_2)
count_8 = List.Count(n14_0_panels_2)
count_9 = List.Count(n15_0_panels_2)
count_10 = List.Count(parapet_panels_2)
create_3 = List.Create(count_6, count_7, count_8, count_9, count_10)
sum_2 = Math.Sum(create_3)

watch_7 = Watch(getItemAtIndex_5)
name_5 = FamilyType.Name(watch_7)
groups = Custom[GroupType.Groups](groupType=n10_0_panels)  # Returns all group instances of a given group type
groups_2 = Custom[GroupType.Groups](groupType=n14_0_panels)
groups_3 = Custom[GroupType.Groups](groupType=n13_0_panels)
groups_4 = Custom[GroupType.Groups](groupType=n15_0_panels)
groups_5 = Custom[GroupType.Groups](groupType=parapet_panels)
create_4 = List.Create(groups, groups_2, groups_3, groups_4, groups_5)
getItemAtIndex_6 = List.GetItemAtIndex(list=create_4, index=integer_slider_4)
integer_slider_6 = IntegerSlider(6, range=0..71 step 1)
getItemAtIndex_7 = List.GetItemAtIndex(list=getItemAtIndex_6, index=integer_slider_6)
replaceItemAtIndex = List.ReplaceItemAtIndex(list=getItemAtIndex_4, index=integer_slider_5, item=getItemAtIndex_7)
getItemAtIndex_8 = List.GetItemAtIndex(list=replaceItemAtIndex, index=integer_slider_5)
name_6 = FamilyType.Name(getItemAtIndex_8)
identity = Object.Identity()  # unwired: arg0
watch_8 = Watch(getItemAtIndex_8)
code_block_17 = CodeBlock { 0; }
getItemAtIndex_9 = List.GetItemAtIndex(list=watch_8, index=code_block_17)
name_7 = FamilyType.Name(getItemAtIndex_9)
watch_9 = Watch(name_7)
python_script = Python()  # unwired: IN[0], IN[1]; starter script, not edited (OUT = 0)
members_6 = Custom[Group.Members](group=watch_7)
members_7 = Custom[Group.Members](group=getItemAtIndex_9)
watch_10 = Watch(n10_0_panels)
integer_slider_7 = IntegerSlider(1, range=0..11 step 1)
getItemAtIndex_10 = List.GetItemAtIndex(list=watch_10, index=integer_slider_7)
watch_11 = Watch(getItemAtIndex_9)
typeName = Custom[Element.TypeName](Element=watch_8)  # Get Type Name as string
setType = Custom[FamilyInstance.SetType](familyInstance=watch_7, familyType=typeName)  # Changes the family type of a given family instance to the specified type
watch_12 = Watch(setType.familyInstance)
boolean = BoolSelector(false)
dropDown = Custom[Springs.List.DropDown](reset=boolean)  # Selects one list item by a drop-down combo box. The optional names input will override the object representation.; unwired: list
