# Dynamo graph Dynamic_Kase_05.dyn (Dynamo 1.3.2.2480)

code_block = CodeBlock {  }

# group: SELECT ALL INDIVIDUAL EXTERIOR CLADDING PANELS
element_types = ElementTypes("GroupType")
all_elements_of_type = ElementsOfType(element_types)
search_criteria = CodeBlock { "K4_EC"; }
search_by_family_type_name = CodeBlock(t2=all_elements_of_type, t4=search_criteria)
# ---------- search_by_family_type_name.designscript (6 lines) ----------
t1 = t2.Name;
t3 = String.Contains(t1, t4, false);
t5 = List.FilterByBoolMask(t2, t3);
t6 = __TryGetValueFromNestedDictionaries(t5, "in");
t7 = __TryGetValueFromNestedDictionaries(t5, "out");
t8 = DSCore.Object.Identity(t6);
# ----------------------------------------
exterior_cladding_panels = Object.Identity(search_by_family_type_name.t8)
search_criteria_2 = CodeBlock { "Unit"; }
search_by_family_type_name_2 = CodeBlock(t2=exterior_cladding_panels, t4=search_criteria_2)  # same code as search_by_family_type_name
single_cladding_panels = Object.Identity(search_by_family_type_name_2.t7)

name = FamilyType.Name(single_cladding_panels)
watch = Watch(name)

# group: 10'-0" PANELS
search_criteria_3 = CodeBlock { "K4_EC10"; }
search_by_family_type_name_3 = CodeBlock(t2=single_cladding_panels, t4=search_criteria_3)  # same code as search_by_family_type_name
n10_0_panels = Object.Identity(search_by_family_type_name_3.t8)  # "10'-0" PANELS"

# group: 14'-0"PANELS
search_criteria_4 = CodeBlock { "K4_EC14"; }
search_by_family_type_name_4 = CodeBlock(t2=single_cladding_panels, t4=search_criteria_4)  # same code as search_by_family_type_name
n14_0_panels = Object.Identity(search_by_family_type_name_4.t8)  # "14'-0" PANELS"

# group: 13'-0" PANELS
search_criteria_5 = CodeBlock { "K4_EC13"; }
search_by_family_type_name_5 = CodeBlock(t2=single_cladding_panels, t4=search_criteria_5)  # same code as search_by_family_type_name
n13_0_panels = Object.Identity(search_by_family_type_name_5.t8)  # "13'-0" PANELS"

# group: 15'-0" PANELS
search_criteria_6 = CodeBlock { "K4_EC15"; }
search_by_family_type_name_6 = CodeBlock(t2=single_cladding_panels, t4=search_criteria_6)  # same code as search_by_family_type_name
n15_0_panels = Object.Identity(search_by_family_type_name_6.t8)  # "15'-0" PANELS"

# group: PARAPET PANELS
search_criteria_7 = CodeBlock { "K4_EC-P"; }
search_by_family_type_name_7 = CodeBlock(t2=single_cladding_panels, t4=search_criteria_7)  # same code as search_by_family_type_name
parapet_panels = Object.Identity(search_by_family_type_name_7.t8)

# group: COUNT VALIDATION
count = List.Count(n10_0_panels)
count_2 = List.Count(n14_0_panels)
count_3 = List.Count(n13_0_panels)
count_4 = List.Count(n15_0_panels)
count_5 = List.Count(parapet_panels)
create = List.Create(count, count_2, count_3, count_4, count_5)
sum = Math.Sum(create)

# group: LIBRARY OF CLADDING PANELS
sub = CodeBlock {  }

# group: CLADDING PANELS IN SELECTED BUILDING CONFIGURATION
sub_2 = CodeBlock {  }

# group: SELECT SPECIFIC VIEW
element_types_2 = ElementTypes("View")
all_elements_of_type_2 = ElementsOfType(element_types_2)
view_name = CodeBlock { "Cladding_Design"; }
code_block_2 = CodeBlock(t9=all_elements_of_type_2, t10=view_name)
# ---------- code_block_2.designscript (8 lines) ----------
t2 = t9;
t4 = t10;
t1 = t2.Name;
t3 = t1 == t4;
t5 = List.FilterByBoolMask(t2, t3);
t6 = __TryGetValueFromNestedDictionaries(t5, "in");
t7 = __TryGetValueFromNestedDictionaries(t5, "out");
t11 = List.GetItemAtIndex(t6, 0);
# ----------------------------------------
watch_2 = Watch(code_block_2.t11)

# group: SELECT ALL MODEL GROUPS IN ACTIVE VIEW
# note: CLADDING PANELS IN SELECTED BUILDING CONFIGURATION
current = Document.Current()
activeView = Document.ActiveView(current)
watch_3 = Watch(activeView)
categories = Categories("IOSModelGroups")
byCategoryAndView = archilab.Revit.Selection.Select.ByCategoryAndView(categories, watch_2)

# group: SELECTS ALL ELEMENTS WITHIN THE BOUNDS OF THE BUILDING SCOPE BOX
code_block_3 = CodeBlock { {3,4,6,8}; }
# note: SUPER IMPORTANT!!!
select_scope_box = DSModelElementSelection()  # 1 picked in the model
geometry = Element.Geometry(select_scope_box)
integer_slider = IntegerSlider(5, range=0..12 step 1)
getItemAtIndex = List.GetItemAtIndex(list=geometry, index=integer_slider)
endPoint = Curve.EndPoint(getItemAtIndex)
integer_slider_2 = IntegerSlider(0, range=0..12 step 1)
getItemAtIndex_2 = List.GetItemAtIndex(list=geometry, index=integer_slider_2)
endPoint_2 = Curve.EndPoint(getItemAtIndex_2)
byCorners = BoundingBox.ByCorners(min=endPoint, max=endPoint_2)
getElementsInside = Revit.BoundingBox.GetElementsInside(byCorners, byCategoryAndView)
name_2 = FamilyType.Name(getElementsInside)

# group: FILTERING TO GET ALL EXTERIOR CLADDING WALL PANELS
# note: EC = Exterior Cladding
code_block_4 = CodeBlock { "K4_EC"; }
contains = String.Contains(str=name_2, searchFor=code_block_4)
filterByBoolMask = List.FilterByBoolMask(list=getElementsInside, mask=contains)
cladding_wall_panels = Object.Identity(filterByBoolMask.in)

# group: FILTERING OUT LARGE FACE OF UNIT PANEL GROUPS
name_3 = FamilyType.Name(cladding_wall_panels)
code_block_5 = CodeBlock { "Unit"; }
contains_2 = String.Contains(str=name_3, searchFor=code_block_5)
filterByBoolMask_2 = List.FilterByBoolMask(list=cladding_wall_panels, mask=contains_2)
individual_cladding_panels = Object.Identity(filterByBoolMask_2.out)

# group: 10'-0" PANELS
search_criteria_8 = CodeBlock { "K4_EC10"; }
search_by_family_type_name_8 = CodeBlock(t2=individual_cladding_panels, t4=search_criteria_8)  # same code as search_by_family_type_name
n10_0_panels_2 = Object.Identity(search_by_family_type_name_8.t8)  # "10'-0" PANELS"

# group: 13'-0" PANELS
search_criteria_9 = CodeBlock { "K4_EC13"; }
search_by_family_type_name_9 = CodeBlock(t2=individual_cladding_panels, t4=search_criteria_9)  # same code as search_by_family_type_name
n13_0_panels_2 = Object.Identity(search_by_family_type_name_9.t8)  # "13'-0" PANELS"

# group: 14'-0"PANELS
search_criteria_10 = CodeBlock { "K4_EC14"; }
search_by_family_type_name_10 = CodeBlock(t2=individual_cladding_panels, t4=search_criteria_10)  # same code as search_by_family_type_name
n14_0_panels_2 = Object.Identity(search_by_family_type_name_10.t8)  # "14'-0" PANELS"

# group: 15'-0" PANELS
search_criteria_11 = CodeBlock { "K4_EC15"; }
search_by_family_type_name_11 = CodeBlock(t2=individual_cladding_panels, t4=search_criteria_11)  # same code as search_by_family_type_name
n15_0_panels_2 = Object.Identity(search_by_family_type_name_11.t8)  # "15'-0" PANELS"

# group: PARAPET PANELS
search_criteria_12 = CodeBlock { "K4_EC-P"; }
search_by_family_type_name_12 = CodeBlock(t2=individual_cladding_panels, t4=search_criteria_12)  # same code as search_by_family_type_name
parapet_panels_2 = Object.Identity(search_by_family_type_name_12.t8)

create_2 = List.Create(n10_0_panels_2, n13_0_panels_2, n14_0_panels_2, n15_0_panels_2, parapet_panels_2)

# group: PANEL GROUP DISPLAY
integer_slider_3 = IntegerSlider(0, range=0..4 step 1)
getItemAtIndex_3 = List.GetItemAtIndex(list=create_2, index=integer_slider_3)
members = Custom[Group.Members](group=getItemAtIndex_3)  # Retrieves the members of a group
string_from_object = FromObject(members)
code_block_6 = CodeBlock { "Curtain Panel"; }
eq = string_from_object == code_block_6
filterByBoolMask_3 = List.FilterByBoolMask(list=members, mask=eq)
master_panel_filter = CodeBlock(t3=filterByBoolMask_3.in)
# ---------- master_panel_filter.designscript (5 lines) ----------
t2 = t3.Name;
t4 = String.Contains(t2, "MASTER", false);
t5 = List.FilterByBoolMask(t3, t4);
t6 = __TryGetValueFromNestedDictionaries(t5, "in");
t7 = __TryGetValueFromNestedDictionaries(t5, "out");
# ----------------------------------------
geometry_2 = Element.Geometry(master_panel_filter.t6)
code_block_7 = CodeBlock { t1 = 50; t2 = 255; t3 = 153; t4 = 0; color1 = DSCore.Color.ByARGB(t1, t2, t3, t4); }
byGeometryColor = Display.Display.ByGeometryColor(geometry_2, code_block_7.color1)

# group: TRANSIENT PANELS
removeItemAtIndex = List.RemoveItemAtIndex(list=create_2, indices=integer_slider_3)
members_2 = Custom[Group.Members](group=removeItemAtIndex)
string_from_object_2 = FromObject(members_2)
code_block_8 = CodeBlock { "Curtain Panel"; }
eq_2 = string_from_object_2 == code_block_8
filterByBoolMask_4 = List.FilterByBoolMask(list=members_2, mask=eq_2)
master_panel_filter_2 = CodeBlock(t3=filterByBoolMask_4.in)  # same code as master_panel_filter
geometry_3 = Element.Geometry(master_panel_filter_2.t6)
code_block_9 = CodeBlock { t1 = 50; t2 = 128; t3 = 128; t4 = 128; color1 = DSCore.Color.ByARGB(t1, t2, t3, t4); }
byGeometryColor_2 = Display.Display.ByGeometryColor(geometry_3, code_block_9.color1)

# group: CLADDING PANELS GROUP SELECTION PREVIEW
sub_3 = CodeBlock { x; }  # unwired: x

# group: INDIVIDUAL PANEL DISPLAY
panel_number = IntegerSlider(1, range=0..71 step 1)
code_block_10 = CodeBlock { "Curtain Panel"; }
code_block_11 = CodeBlock { t1 = 255; t2 = 255; t3 = 153; t4 = 0; color1 = DSCore.Color.ByARGB(t1, t2, t3, t4); }

code_block_12 = CodeBlock(X=panel_number) { X-1; }

# group (continued): INDIVIDUAL PANEL DISPLAY
getItemAtIndex_4 = List.GetItemAtIndex(list=getItemAtIndex_3, index=code_block_12)
members_3 = Custom[Group.Members](group=getItemAtIndex_4)
string_from_object_3 = FromObject(members_3)
eq_3 = string_from_object_3 == code_block_10
filterByBoolMask_5 = List.FilterByBoolMask(list=members_3, mask=eq_3)
geometry_4 = Element.Geometry(filterByBoolMask_5.in)
byGeometryColor_3 = Display.Display.ByGeometryColor(geometry_4, code_block_11.color1)

# group: COUNT VALIDATION
count_6 = List.Count(n10_0_panels_2)
count_7 = List.Count(n13_0_panels_2)
count_8 = List.Count(n14_0_panels_2)
count_9 = List.Count(n15_0_panels_2)
count_10 = List.Count(parapet_panels_2)
create_3 = List.Create(count_6, count_7, count_8, count_9, count_10)
sum_2 = Math.Sum(create_3)

create_4 = List.Create(n10_0_panels, n13_0_panels, n14_0_panels, n15_0_panels, parapet_panels)
getItemAtIndex_5 = List.GetItemAtIndex(list=create_4, index=integer_slider_3)
available_panel_library = FamilyType.Name(getItemAtIndex_5)

# group: GROUP SWAP
code_block_13 = CodeBlock { "Type"; }
code_block_14 = CodeBlock { "Which wall type you want fam?"; }
run = BoolSelector(true)
dropDown = Custom[Springs.List.DropDown](list=getItemAtIndex_5, names=available_panel_library, customMsg=code_block_14, reset=run)  # frozen; Selects one list item by a drop-down combo box. The optional names input will override the object representation.
setParameterByName = Element.SetParameterByName(element=getItemAtIndex_4, parameterName=code_block_13, value=dropDown)
watch_4 = Watch(dropDown)
run_2 = BoolSelector(false)
runMe = Custom[Tool.RunMe](Boolean=run_2, ThingToDo=available_panel_library)  # Use Boolean to perform an action
name_4 = FamilyType.Name(getItemAtIndex_4)
code_block_15 = CodeBlock { 0; }
boolean = BoolSelector(true)
ui_dropdown_data = Custom[UI.DropDown Data](InputName=code_block_14, Keys=available_panel_library, Values=getItemAtIndex_5, DefaultValueIndex=code_block_15, Sorted_optional=boolean)  # frozen; Create data for DropDown input in UI.MultiInputForm ++ . Check out www.data-shapes.net for more infos.
allIndicesOf = List.AllIndicesOf()  # unwired: list, item

ungroup = Custom[Group.Ungroup](group=filterByBoolMask_2.in)  # Ungroups a group and returns the ungrouped elements.

# group: Preview Panel Labels
list_enumeration = CodeBlock(t4=getItemAtIndex_3)
# ---------- list_enumeration.designscript (7 lines) ----------
t3 = List.Count(t4);
t5 = (1..t3..1);
t6 = {t5};
t7 = Manage.RemoveNulls(t6);
t8 = __TryGetValueFromNestedDictionaries(t7, "Cleaned");
t9 = __TryGetValueFromNestedDictionaries(t7, "Indices");
t10 = List.Flatten(t8, 1);
# ----------------------------------------
string_from_object_4 = FromObject(list_enumeration.t10)
panel_prefix = CodeBlock { "P - "; }
concat = String.Concat(panel_prefix)  # unwired: arg1
map = List.Map(list=string_from_object_4, f_x=concat)
accent_panel_filter = CodeBlock(t3=master_panel_filter.t6)
# ---------- accent_panel_filter.designscript (5 lines) ----------
t2 = t3.Name;
t4 = String.Contains(t2, "ACCENT", false);
t5 = List.FilterByBoolMask(t3, t4);
t6 = __TryGetValueFromNestedDictionaries(t5, "in");
t7 = __TryGetValueFromNestedDictionaries(t5, "out");
# ----------------------------------------
flatten = Flatten(accent_panel_filter.t7)
geometry_5 = Element.Geometry(flatten)
faces = Topology.Faces(geometry_5)
code_block_16 = CodeBlock { 1; }
flatten_2 = List.Flatten(list=faces, amt=code_block_16)
code_block_17 = CodeBlock { 0; }
getItemAtIndex_6 = List.GetItemAtIndex(index=code_block_17)  # unwired: list
map_2 = List.Map(list=flatten_2, f_x=getItemAtIndex_6)
surfaceGeometry = Face.SurfaceGeometry(map_2)
code_block_18 = CodeBlock { 0.5; }
pointAtParameter = Surface.PointAtParameter(surface=surfaceGeometry, u=code_block_18, v=code_block_18)
code_block_19 = CodeBlock { 2; }
panel_tags = DynamoText.Text.FromStringOriginAndScale(map, pointAtParameter, code_block_19)
