# Dynamo graph K4_Dynamic_Kase_Tool_v1.4.dyn (Dynamo 1.3.2.2480)

# group: SELECT ALL INDIVIDUAL EXTERIOR CLADDING PANELS
element_types = ElementTypes("GroupType")
all_elements_of_type = ElementsOfType(element_types)
search_criteria = CodeBlock { "K4_EC"; }
search_by_family_type_name = CodeBlock(t2=all_elements_of_type, t4=search_criteria)
# ---------- search_by_family_type_name.designscript (6 lines) ----------
t1 = t2.Name;
t3 = String.Contains(t1, t4, false);
t5 = List.FilterByBoolMask(t2, t3);
t6 = __TryGetValueFromNestedDictionaries(t5, "in");
t7 = __TryGetValueFromNestedDictionaries(t5, "out");
t8 = DSCore.Object.Identity(t6);
# ----------------------------------------
exterior_cladding_panels = Object.Identity(search_by_family_type_name.t8)
search_criteria_2 = CodeBlock { "Unit"; }
search_by_family_type_name_2 = CodeBlock(t2=exterior_cladding_panels, t4=search_criteria_2)  # same code as search_by_family_type_name
single_cladding_panels = Object.Identity(search_by_family_type_name_2.t7)

name = FamilyType.Name(single_cladding_panels)
watch = Watch(name)

# group: 10'-0" PANELS
search_criteria_3 = CodeBlock { "K4_EC10"; }
search_by_family_type_name_3 = CodeBlock(t2=single_cladding_panels, t4=search_criteria_3)  # same code as search_by_family_type_name
n10_0_panels = Object.Identity(search_by_family_type_name_3.t8)  # "10'-0" PANELS"

# group: 14'-0"PANELS
search_criteria_4 = CodeBlock { "K4_EC14"; }
search_by_family_type_name_4 = CodeBlock(t2=single_cladding_panels, t4=search_criteria_4)  # same code as search_by_family_type_name
n14_0_panels = Object.Identity(search_by_family_type_name_4.t8)  # "14'-0" PANELS"

# group: 13'-0" PANELS
search_criteria_5 = CodeBlock { "K4_EC13"; }
search_by_family_type_name_5 = CodeBlock(t2=single_cladding_panels, t4=search_criteria_5)  # same code as search_by_family_type_name
n13_0_panels = Object.Identity(search_by_family_type_name_5.t8)  # "13'-0" PANELS"

# group: 15'-0" PANELS
search_criteria_6 = CodeBlock { "K4_EC15"; }
search_by_family_type_name_6 = CodeBlock(t2=single_cladding_panels, t4=search_criteria_6)  # same code as search_by_family_type_name
n15_0_panels = Object.Identity(search_by_family_type_name_6.t8)  # "15'-0" PANELS"

# group: PARAPET PANELS
search_criteria_7 = CodeBlock { "K4_EC-P"; }
search_by_family_type_name_7 = CodeBlock(t2=single_cladding_panels, t4=search_criteria_7)  # same code as search_by_family_type_name
parapet_panels = Object.Identity(search_by_family_type_name_7.t8)

# group: LIBRARY PANEL COUNT VALIDATION
count = List.Count(n10_0_panels)
count_2 = List.Count(n14_0_panels)
count_3 = List.Count(n13_0_panels)
count_4 = List.Count(n15_0_panels)
count_5 = List.Count(parapet_panels)
create = List.Create(count, count_2, count_3, count_4, count_5)
sum = Math.Sum(create)

# group: K4 DYNAMIC KASE FILE
# note: STEP 1: GO TO VIEW "Cladding_Design"
# STEP 2: SET SCOPE BOX AROUND BUILDING.
# STEP 3: TOGGLE "PANEL GROUP SELECTION" TO TRUE & SET INPUT IN POP-UP WINDOW
# STEP 4: TOGGLE "INDIVIDUAL PANEL SELECTION" TO TRUE & SET INPUT IN POP-UP WINDOW
# STEP 5: TOGGLE "PANEL GROUP REPLACEMENT SELECTION" TO TRUE & SET INPUT IN POP-UP WINDOW
# STEP 6: TOGGLE "INDIVIDUAL PANEL REPLACEMENT SELECTION" TO TRUE & SET INPUT IN POP-UP WINDOW
# STEP 7: WHEN SATISFIED, TOGGLE ALL TO FALSE AND ABORT ALL REMAINING WINDOWS
select_scope_box = DSModelElementSelection()  # 1 picked in the model
panel_group_selection = BoolSelector(true)
individual_panel_selection = BoolSelector(false)
panel_group_replacement = BoolSelector(false)  # "PANEL GROUP REPLACEMENT SELECTION"
individual_panel_replacement = BoolSelector(false)  # "INDIVIDUAL PANEL REPLACEMENT SELECTION"

# group: SELECT SPECIFIC VIEW
element_types_2 = ElementTypes("View")
all_elements_of_type_2 = ElementsOfType(element_types_2)
view_name = CodeBlock { "Cladding_Design"; }
code_block = CodeBlock(t9=all_elements_of_type_2, t10=view_name)
# ---------- code_block.designscript (8 lines) ----------
t2 = t9;
t4 = t10;
t1 = t2.Name;
t3 = t1 == t4;
t5 = List.FilterByBoolMask(t2, t3);
t6 = __TryGetValueFromNestedDictionaries(t5, "in");
t7 = __TryGetValueFromNestedDictionaries(t5, "out");
t11 = List.GetItemAtIndex(t6, 0);
# ----------------------------------------
watch_2 = Watch(code_block.t11)

# group: SELECT ALL MODEL GROUPS IN ACTIVE VIEW
current = Document.Current()
activeView = Document.ActiveView(current)
plug_this_in_if_you_want_to_use = Watch(activeView)  # "PLUG THIS IN IF YOU WANT TO USE ACTIVE VIEW"
categories = Categories("IOSModelGroups")
byCategoryAndView = archilab.Revit.Selection.Select.ByCategoryAndView(categories, watch_2)

# group: SELECTS ALL ELEMENTS WITHIN THE BOUNDS OF THE BUILDING SCOPE BOX
# note: SUPER IMPORTANT!!!
code_block_2 = CodeBlock { {3,4,6,8}; }
geometry = Element.Geometry(select_scope_box)
integer_slider = IntegerSlider(5, range=0..12 step 1)
getItemAtIndex = List.GetItemAtIndex(list=geometry, index=integer_slider)
endPoint = Curve.EndPoint(getItemAtIndex)
integer_slider_2 = IntegerSlider(0, range=0..12 step 1)
getItemAtIndex_2 = List.GetItemAtIndex(list=geometry, index=integer_slider_2)
endPoint_2 = Curve.EndPoint(getItemAtIndex_2)
byCorners = BoundingBox.ByCorners(min=endPoint, max=endPoint_2)
getElementsInside = Revit.BoundingBox.GetElementsInside(byCorners, byCategoryAndView)
name_2 = FamilyType.Name(getElementsInside)

# group: FILTERING TO GET ALL EXTERIOR CLADDING WALL PANELS
# note: EC = Exterior Cladding
code_block_3 = CodeBlock { "K4_EC"; }
contains = String.Contains(str=name_2, searchFor=code_block_3)
filterByBoolMask = List.FilterByBoolMask(list=getElementsInside, mask=contains)
cladding_wall_panels = Object.Identity(filterByBoolMask.in)

# group: FILTERING OUT LARGE FACE OF UNIT PANEL GROUPS
name_3 = FamilyType.Name(cladding_wall_panels)
code_block_4 = CodeBlock { "Unit"; }
contains_2 = String.Contains(str=name_3, searchFor=code_block_4)
filterByBoolMask_2 = List.FilterByBoolMask(list=cladding_wall_panels, mask=contains_2)
individual_cladding_panels = Object.Identity(filterByBoolMask_2.out)
ungroup = Custom[UNGROUPING ANY "UNIT" GROUPS](group=filterByBoolMask_2.in)  # "Group.Ungroup"; Ungroups a group and returns the ungrouped elements.

# group: 10'-0" PANELS
search_criteria_8 = CodeBlock { "K4_EC10"; }
search_by_family_type_name_8 = CodeBlock(t2=individual_cladding_panels, t4=search_criteria_8)  # same code as search_by_family_type_name
n10_0_panels_2 = Object.Identity(search_by_family_type_name_8.t8)  # "10'-0" PANELS"

# group: 13'-0" PANELS
search_criteria_9 = CodeBlock { "K4_EC13"; }
search_by_family_type_name_9 = CodeBlock(t2=individual_cladding_panels, t4=search_criteria_9)  # same code as search_by_family_type_name
n13_0_panels_2 = Object.Identity(search_by_family_type_name_9.t8)  # "13'-0" PANELS"

# group: 14'-0"PANELS
search_criteria_10 = CodeBlock { "K4_EC14"; }
search_by_family_type_name_10 = CodeBlock(t2=individual_cladding_panels, t4=search_criteria_10)  # same code as search_by_family_type_name
n14_0_panels_2 = Object.Identity(search_by_family_type_name_10.t8)  # "14'-0" PANELS"

# group: 15'-0" PANELS
search_criteria_11 = CodeBlock { "K4_EC15"; }
search_by_family_type_name_11 = CodeBlock(t2=individual_cladding_panels, t4=search_criteria_11)  # same code as search_by_family_type_name
n15_0_panels_2 = Object.Identity(search_by_family_type_name_11.t8)  # "15'-0" PANELS"

# group: PARAPET PANELS
search_criteria_12 = CodeBlock { "K4_EC-P"; }
search_by_family_type_name_12 = CodeBlock(t2=individual_cladding_panels, t4=search_criteria_12)  # same code as search_by_family_type_name
parapet_panels_2 = Object.Identity(search_by_family_type_name_12.t8)

panel_group_names = List.Create(search_criteria_8, search_criteria_9, search_criteria_10, search_criteria_11, search_criteria_12)
panel_groups = List.Create(n10_0_panels_2, n13_0_panels_2, n14_0_panels_2, n15_0_panels_2, parapet_panels_2)

# group: SELECT PANEL GROUP TO CHANGE
code_block_5 = CodeBlock { "KATERRA K4 DYNAMIC CLADDING TOOL"; }
file_path = Filename("..\..\..\..\Office\04 Software\Revit\Dynamo Scripts\K4 Dynamic Kase Tool\LOGO\Katerra_Icon_B.jpg")
code_block_6 = CodeBlock { "CONTINUE"; }
code_block_7 = CodeBlock { "WHICH PANEL GROUP DO YOU WANT TO WANT TO CHANGE?"; }
ui_dropdown_data = Custom[UI.DropDown Data](InputName=code_block_7, Keys=panel_group_names, Values=panel_groups)  # Create data for DropDown input in UI.MultiInputForm ++ . Check out www.data-shapes.net for more infos.
code_block_8 = CodeBlock { "ABORT"; }
code_block_9 = CodeBlock { 500; }
ui_multipleinputform = Custom[UI.MultipleInputForm ++](Description_optional=code_block_5, Logo_optional=file_path, ButtonText_optional=code_block_6, Inputs=ui_dropdown_data, Toggle=panel_group_selection, CancelButtonText_optional=code_block_8, Width_optional=code_block_9)  # Create a form with multiple inputs. see www.data-shapes.net for tutorials and infos!

# group: SELECT PANEL SUBGROUP TO CHANGE
watch_3 = Watch(ui_multipleinputform.User_Inputs)
individual_cladding_panels_2 = Object.Identity(watch_3)
code_block_10 = CodeBlock { "WHICH PANELS DO YOU WANT TO CHANGE?"; }
watch_4 = Watch(individual_cladding_panels_2)
code_block_11 = CodeBlock { 1; }
flatten = List.Flatten(list=watch_4, amt=code_block_11)
PANELS = Watch(flatten)
boolean = BoolSelector(false)
boolean_2 = BoolSelector(false)

# group: PANEL GROUP DISPLAY
identity = Object.Identity(individual_cladding_panels_2)
members = Custom[Group.Members](group=identity)  # Retrieves the members of a group
string_from_object = FromObject(members)
code_block_12 = CodeBlock { "Curtain Panel"; }
eq = string_from_object == code_block_12
filterByBoolMask_3 = List.FilterByBoolMask(list=members, mask=eq)
master_panel_filter = CodeBlock(t3=filterByBoolMask_3.in)
# ---------- master_panel_filter.designscript (5 lines) ----------
t2 = t3.Name;
t4 = String.Contains(t2, "MASTER", false);
t5 = List.FilterByBoolMask(t3, t4);
t6 = __TryGetValueFromNestedDictionaries(t5, "in");
t7 = __TryGetValueFromNestedDictionaries(t5, "out");
# ----------------------------------------
geometry_2 = Element.Geometry(master_panel_filter.t6)
code_block_13 = CodeBlock { t1 = 50; t2 = 255; t3 = 153; t4 = 0; color1 = DSCore.Color.ByARGB(t1, t2, t3, t4); }
byGeometryColor = Display.Display.ByGeometryColor(geometry_2, code_block_13.color1)

# group: TRANSIENT PANELS
watch_5 = Watch(panel_groups)
code_block_14 = CodeBlock { 1; }
flatten_2 = List.Flatten(list=watch_5, amt=code_block_14)
watch_6 = Watch(identity)
code_block_15 = CodeBlock { 1; }
flatten_3 = List.Flatten(list=watch_6, amt=code_block_15)
allIndicesOf = List.AllIndicesOf(list=flatten_2, item=flatten_3)
code_block_16 = CodeBlock { 2; }
flatten_4 = List.Flatten(list=allIndicesOf, amt=code_block_16)
removeItemAtIndex = List.RemoveItemAtIndex(list=flatten_2, indices=flatten_4)
members_2 = Custom[Group.Members](group=removeItemAtIndex)
string_from_object_2 = FromObject(members_2)
code_block_17 = CodeBlock { "Curtain Panel"; }
eq_2 = string_from_object_2 == code_block_17
filterByBoolMask_4 = List.FilterByBoolMask(list=members_2, mask=eq_2)
master_panel_filter_2 = CodeBlock(t3=filterByBoolMask_4.in)  # same code as master_panel_filter
geometry_3 = Element.Geometry(master_panel_filter_2.t6)
code_block_18 = CodeBlock { t1 = 50; t2 = 128; t3 = 128; t4 = 128; color1 = DSCore.Color.ByARGB(t1, t2, t3, t4); }
byGeometryColor_2 = Display.Display.ByGeometryColor(geometry_3, code_block_18.color1)

# group: Preview Individual Panel Labels
code_block_19 = CodeBlock { 1; }
flatten_5 = List.Flatten(list=identity, amt=code_block_19)
list_enumeration = CodeBlock(t4=flatten_5)
# ---------- list_enumeration.designscript (7 lines) ----------
t3 = List.Count(t4);
t5 = (1..t3..1);
t6 = {t5};
t7 = Manage.RemoveNulls(t6);
t8 = __TryGetValueFromNestedDictionaries(t7, "Cleaned");
t9 = __TryGetValueFromNestedDictionaries(t7, "Indices");
t10 = List.Flatten(t8, 1);
# ----------------------------------------
string_from_object_3 = FromObject(list_enumeration.t10)
panel_prefix = CodeBlock { "P-"; }
concat = String.Concat(panel_prefix)  # unwired: arg1
map = List.Map(list=string_from_object_3, f_x=concat)
accent_panel_filter = CodeBlock(t3=master_panel_filter.t6)
# ---------- accent_panel_filter.designscript (5 lines) ----------
t2 = t3.Name;
t4 = String.Contains(t2, "ACCENT", false);
t5 = List.FilterByBoolMask(t3, t4);
t6 = __TryGetValueFromNestedDictionaries(t5, "in");
t7 = __TryGetValueFromNestedDictionaries(t5, "out");
# ----------------------------------------
flatten_6 = Flatten(accent_panel_filter.t7)
geometry_4 = Element.Geometry(flatten_6)
faces = Topology.Faces(geometry_4)
code_block_20 = CodeBlock { 1; }
flatten_7 = List.Flatten(list=faces, amt=code_block_20)
surfaceGeometry = Face.SurfaceGeometry(flatten_7)
area = Surface.Area(surfaceGeometry)
maximumItem = List.MaximumItem(area)
eq_3 = area == maximumItem
filterByBoolMask_5 = List.FilterByBoolMask(list=flatten_7, mask=eq_3)
code_block_21 = CodeBlock { 0; }
getItemAtIndex_3 = List.GetItemAtIndex(index=code_block_21)  # unwired: list
map_2 = List.Map(list=filterByBoolMask_5.in, f_x=getItemAtIndex_3)
surfaceGeometry_2 = Face.SurfaceGeometry(map_2)
code_block_22 = CodeBlock { 0.5; }
pointAtParameter = Surface.PointAtParameter(surface=surfaceGeometry_2, u=code_block_22, v=code_block_22)
code_block_23 = CodeBlock { 1; }
panel_tags = DynamoText.Text.FromStringOriginAndScale(map, pointAtParameter, code_block_23)

# group: WHICH INDIVIDUAL PANELS YOU WANT TO CHANGE
code_block_24 = CodeBlock { "WHICH PANELS DO YOU WANT TO CHANGE?"; }
panel_tags_2 = Watch(map)
watch_7 = Watch(ui_multipleinputform.User_Inputs)
individual_cladding_panels_3 = Object.Identity(watch_7)
watch_8 = Watch(individual_cladding_panels_3)
code_block_25 = CodeBlock { 1; }
flatten_8 = List.Flatten(list=watch_8, amt=code_block_25)
PANELS_2 = Watch(flatten_8)
boolean_3 = BoolSelector(false)
boolean_4 = BoolSelector(false)
ui_listview_data = Custom[UI.Listview Data](InputName=code_block_24, Keys=panel_tags_2, Values=PANELS_2, SortItems_optionnal=boolean_3, ShowId_optionnal=boolean_4)  # Create data for ListView input in UI.MultiInputForm ++ . Check out www.data-shapes.net for more infos.
ui_multipleinputform_2 = Custom[UI.MultipleInputForm ++](Description_optional=code_block_5, Logo_optional=file_path, ButtonText_optional=code_block_6, Inputs=ui_listview_data, Toggle=individual_panel_selection, CancelButtonText_optional=code_block_8, Width_optional=code_block_9)

# group: INDIVIDUAL PANEL DISPLAY
selected_panels_to_change = Watch(ui_multipleinputform_2.User_Inputs)
code_block_26 = CodeBlock { 1; }
flatten_9 = List.Flatten(list=selected_panels_to_change, amt=code_block_26)
members_3 = Custom[Group.Members](group=flatten_9)
string_from_object_4 = FromObject(members_3)
code_block_27 = CodeBlock { "Curtain Panel"; }
eq_4 = string_from_object_4 == code_block_27
filterByBoolMask_6 = List.FilterByBoolMask(list=members_3, mask=eq_4)
geometry_5 = Element.Geometry(filterByBoolMask_6.in)
code_block_28 = CodeBlock { t1 = 255; t2 = 255; t3 = 153; t4 = 0; color1 = DSCore.Color.ByARGB(t1, t2, t3, t4); }
byGeometryColor_3 = Display.Display.ByGeometryColor(geometry_5, code_block_28.color1)

# group: BUILDING PANEL COUNT VALIDATION
count_6 = List.Count(n10_0_panels_2)
count_7 = List.Count(n13_0_panels_2)
count_8 = List.Count(n14_0_panels_2)
count_9 = List.Count(n15_0_panels_2)
count_10 = List.Count(parapet_panels_2)
create_2 = List.Create(count_6, count_7, count_8, count_9, count_10)
sum_2 = Math.Sum(create_2)

# group: WHICH GROUP IN THE LIBRARY DO YOU WANT TO PULL FROM
code_block_29 = CodeBlock { "WHICH PANEL GROUP TO REPLACE WITH?"; }
create_3 = List.Create(search_criteria_3, search_criteria_5, search_criteria_4, search_criteria_6, search_criteria_7)
watch_9 = Watch(create_3)
create_4 = List.Create(n10_0_panels, n13_0_panels, n14_0_panels, n15_0_panels, parapet_panels)
ui_dropdown_data_2 = Custom[UI.DropDown Data](InputName=code_block_29, Keys=watch_9, Values=create_4)
ui_multipleinputform_3 = Custom[UI.MultipleInputForm ++](Description_optional=code_block_5, Logo_optional=file_path, ButtonText_optional=code_block_6, Inputs=ui_dropdown_data_2, Toggle=panel_group_replacement, CancelButtonText_optional=code_block_8, Width_optional=code_block_9)

# group: SELECTION OF REPLACEMENT PANEL
code_block_30 = CodeBlock { "WHICH PANEL TO REPLACE WITH?"; }
watch_10 = Watch(ui_multipleinputform_3.User_Inputs)
name_4 = FamilyType.Name(watch_10)
watch_11 = Watch(name_4)
code_block_31 = CodeBlock { 1; }
flatten_10 = List.Flatten(list=watch_11, amt=code_block_31)
watch_12 = Watch(flatten_10)
flatten_11 = List.Flatten(list=watch_10, amt=code_block_31)
watch_13 = Watch(flatten_11)
ui_dropdown_data_3 = Custom[UI.DropDown Data](InputName=code_block_30, Keys=watch_12, Values=watch_13)
ui_multipleinputform_4 = Custom[UI.MultipleInputForm ++](Description_optional=code_block_5, Logo_optional=file_path, ButtonText_optional=code_block_6, Inputs=ui_dropdown_data_3, Toggle=individual_panel_replacement, CancelButtonText_optional=code_block_8, Width_optional=code_block_9)

# group: REPLACE PANELS
watch_14 = Watch(ui_multipleinputform_4.User_Inputs)
create_5 = List.Create(selected_panels_to_change, watch_14)
code_block_32 = CodeBlock(X=create_5) { X[0]; X[1]; }
code_block_33 = CodeBlock { "Type"; }
setParameterByName = Element.SetParameterByName(element=code_block_32.out0, parameterName=code_block_33, value=code_block_32.out1)
watch_15 = Watch(setParameterByName)

# group: WIP PANEL NAMING
name_5 = FamilyType.Name(identity)
watch_16 = Watch(name_5)
code_block_34 = CodeBlock { 1; }
flatten_12 = List.Flatten(list=watch_16, amt=code_block_34)
concat_2 = String.Concat(map)  # unwired: arg1
map_3 = List.Map(f_x=concat_2)  # unwired: list
watch_17 = Watch(map_3)

watch_18 = Watch(panel_group_names)
watch_19 = Watch(panel_groups)
name_6 = FamilyType.Name(ui_multipleinputform.User_Inputs)
watch_20 = Watch(name_6)
code_block_35 = CodeBlock { 0; 09; }
substring = String.Substring(str=watch_20, startIndex=code_block_35.out0, length=code_block_35.out1)
watch_21 = Watch(ui_multipleinputform.User_Inputs)

# group (continued): SELECT PANEL SUBGROUP TO CHANGE
panel_tags_3 = Watch(map)
ui_listview_data_2 = Custom[UI.Listview Data](InputName=code_block_10, Keys=panel_tags_3, Values=PANELS, SortItems_optionnal=boolean, ShowId_optionnal=boolean_2)
ui_multipleinputform_5 = Custom[UI.MultipleInputForm ++](Description_optional=code_block_5, Logo_optional=file_path, ButtonText_optional=code_block_6, Inputs=ui_listview_data_2, Toggle=individual_panel_selection, CancelButtonText_optional=code_block_8, Width_optional=code_block_9)

# group: PANEL SUBGROUP DISPLAY
selected_panels_to_change_2 = Watch(ui_multipleinputform_5.User_Inputs)
code_block_36 = CodeBlock { 1; }
flatten_13 = List.Flatten(list=selected_panels_to_change_2, amt=code_block_36)
members_4 = Custom[Group.Members](group=flatten_13)
string_from_object_5 = FromObject(members_4)
code_block_37 = CodeBlock { "Curtain Panel"; }
eq_5 = string_from_object_5 == code_block_37
filterByBoolMask_7 = List.FilterByBoolMask(list=members_4, mask=eq_5)
geometry_6 = Element.Geometry(filterByBoolMask_7.in)
code_block_38 = CodeBlock { t1 = 255; t2 = 255; t3 = 153; t4 = 0; color1 = DSCore.Color.ByARGB(t1, t2, t3, t4); }
byGeometryColor_4 = Display.Display.ByGeometryColor(geometry_6, code_block_38.color1)

deleteElements = Custom[Springs.Doc.DeleteElements]()  # Attempts to delete the input list of elements from the active Revit document.The node returns the number of successfully deleted elements and their Ids as a string. Carefully observe the deleted elements count. It may be greater than the input list because hosted elements or tags will be deleted as well. If an element in the list can not be deleted (for example last revision or last view), the whole list will fail to be deleted.; unwired: element, confirm

# group: Preview Individual Panel Labels
code_block_39 = CodeBlock { 1; }
flatten_14 = List.Flatten(list=identity, amt=code_block_39)
list_enumeration_2 = CodeBlock(t4=flatten_14)  # same code as list_enumeration
string_from_object_6 = FromObject(list_enumeration_2.t10)
panel_prefix_2 = CodeBlock { "P-"; }
concat_3 = String.Concat(panel_prefix_2)  # unwired: arg1
map_4 = List.Map(list=string_from_object_6, f_x=concat_3)
accent_panel_filter_2 = CodeBlock(t3=master_panel_filter.t6)  # same code as accent_panel_filter
flatten_15 = Flatten(accent_panel_filter_2.t7)
geometry_7 = Element.Geometry(flatten_15)
faces_2 = Topology.Faces(geometry_7)
code_block_40 = CodeBlock { 1; }
flatten_16 = List.Flatten(list=faces_2, amt=code_block_40)
surfaceGeometry_3 = Face.SurfaceGeometry(flatten_16)
area_2 = Surface.Area(surfaceGeometry_3)
maximumItem_2 = List.MaximumItem(area_2)
eq_6 = area_2 == maximumItem_2
filterByBoolMask_8 = List.FilterByBoolMask(list=flatten_16, mask=eq_6)
code_block_41 = CodeBlock { 0; }
getItemAtIndex_4 = List.GetItemAtIndex(index=code_block_41)  # unwired: list
map_5 = List.Map(list=filterByBoolMask_8.in, f_x=getItemAtIndex_4)
surfaceGeometry_4 = Face.SurfaceGeometry(map_5)
code_block_42 = CodeBlock { 0.5; }
pointAtParameter_2 = Surface.PointAtParameter(surface=surfaceGeometry_4, u=code_block_42, v=code_block_42)
code_block_43 = CodeBlock { 1; }
panel_tags_4 = DynamoText.Text.FromStringOriginAndScale(map_4, pointAtParameter_2, code_block_43)

# group: Preview Individual Panel Labels
code_block_44 = CodeBlock { 1; }
flatten_17 = List.Flatten(list=identity, amt=code_block_44)
list_enumeration_3 = CodeBlock(t4=flatten_17)  # same code as list_enumeration
string_from_object_7 = FromObject(list_enumeration_3.t10)
panel_prefix_3 = CodeBlock { "P-"; }
concat_4 = String.Concat(panel_prefix_3)  # unwired: arg1
map_6 = List.Map(list=string_from_object_7, f_x=concat_4)
accent_panel_filter_3 = CodeBlock(t3=master_panel_filter.t6)  # same code as accent_panel_filter
flatten_18 = Flatten(accent_panel_filter_3.t7)
geometry_8 = Element.Geometry(flatten_18)
faces_3 = Topology.Faces(geometry_8)
code_block_45 = CodeBlock { 1; }
flatten_19 = List.Flatten(list=faces_3, amt=code_block_45)
surfaceGeometry_5 = Face.SurfaceGeometry(flatten_19)
area_3 = Surface.Area(surfaceGeometry_5)
maximumItem_3 = List.MaximumItem(area_3)
eq_7 = area_3 == maximumItem_3
filterByBoolMask_9 = List.FilterByBoolMask(list=flatten_19, mask=eq_7)
code_block_46 = CodeBlock { 0; }
getItemAtIndex_5 = List.GetItemAtIndex(index=code_block_46)  # unwired: list
map_7 = List.Map(list=filterByBoolMask_9.in, f_x=getItemAtIndex_5)
surfaceGeometry_6 = Face.SurfaceGeometry(map_7)
code_block_47 = CodeBlock { 0.5; }
pointAtParameter_3 = Surface.PointAtParameter(surface=surfaceGeometry_6, u=code_block_47, v=code_block_47)
code_block_48 = CodeBlock { 1; }
panel_tags_5 = DynamoText.Text.FromStringOriginAndScale(map_6, pointAtParameter_3, code_block_48)
