# Dynamo graph K4_Dynamic_Kase_Tool_v1.7.dyn (Dynamo 1.3.2.2480)

code_block = CodeBlock { 0; 5; }

# group: K4 DYNAMIC KASE FILE
# note: STEP 1: GO TO VIEW "Cladding_Design"
# STEP 2: SET SCOPE BOX AROUND BUILDING.
# STEP 3: TOGGLE "PANEL GROUP SELECTION" TO TRUE & SET INPUT IN POP-UP WINDOW
# STEP 4: TOGGLE "INDIVIDUAL PANEL SELECTION" TO TRUE & SET INPUT IN POP-UP WINDOW
# STEP 5: TOGGLE "PANEL GROUP REPLACEMENT SELECTION" TO TRUE & SET INPUT IN POP-UP WINDOW
# STEP 6: TOGGLE "INDIVIDUAL PANEL REPLACEMENT SELECTION" TO TRUE & SET INPUT IN POP-UP WINDOW
# STEP 7: WHEN SATISFIED, TOGGLE ALL TO FALSE AND ABORT ALL REMAINING WINDOWS
select_scope_box = DSModelElementSelection()  # 1 picked in the model
panel_group_selection = BoolSelector(false)
individual_panel_selection = BoolSelector(false)
individual_panel_replacement = BoolSelector(false)  # "INDIVIDUAL PANEL REPLACEMENT SELECTION"

# group: SELECT SPECIFIC VIEW
element_types = ElementTypes("View")
all_elements_of_type = ElementsOfType(element_types)
view_name = CodeBlock { "Cladding_Design"; }
code_block_2 = CodeBlock(t9=all_elements_of_type, t10=view_name)
# ---------- code_block_2.designscript (8 lines) ----------
t2 = t9;
t4 = t10;
t1 = t2.Name;
t3 = t1 == t4;
t5 = List.FilterByBoolMask(t2, t3);
t6 = __TryGetValueFromNestedDictionaries(t5, "in");
t7 = __TryGetValueFromNestedDictionaries(t5, "out");
t11 = List.GetItemAtIndex(t6, 0);
# ----------------------------------------
watch = Watch(code_block_2.t11)

# group: SELECT ALL MODEL GROUPS IN ACTIVE VIEW
current = Document.Current()
activeView = Document.ActiveView(current)
plug_this_in_if_you_want_to_use = Watch(activeView)  # "PLUG THIS IN IF YOU WANT TO USE ACTIVE VIEW"
categories = Categories("IOSModelGroups")
byCategoryAndView = archilab.Revit.Selection.Select.ByCategoryAndView(categories, watch)

# group: SELECTS ALL ELEMENTS WITHIN THE BOUNDS OF THE BUILDING SCOPE BOX
# note: SUPER IMPORTANT!!!
code_block_3 = CodeBlock { {3,4,6,8}; }
geometry = Element.Geometry(select_scope_box)
integer_slider = IntegerSlider(5, range=0..12 step 1)
getItemAtIndex = List.GetItemAtIndex(list=geometry, index=integer_slider)
endPoint = Curve.EndPoint(getItemAtIndex)
integer_slider_2 = IntegerSlider(0, range=0..12 step 1)
getItemAtIndex_2 = List.GetItemAtIndex(list=geometry, index=integer_slider_2)
endPoint_2 = Curve.EndPoint(getItemAtIndex_2)
byCorners = BoundingBox.ByCorners(min=endPoint, max=endPoint_2)
getElementsInside = Revit.BoundingBox.GetElementsInside(byCorners, byCategoryAndView)
name = FamilyType.Name(getElementsInside)

# group: FILTERING TO GET ALL EXTERIOR CLADDING WALL PANELS
# note: EC = Exterior Cladding
code_block_4 = CodeBlock { "K4_EC"; }
contains = String.Contains(str=name, searchFor=code_block_4)
filterByBoolMask = List.FilterByBoolMask(list=getElementsInside, mask=contains)
cladding_wall_panels = Object.Identity(filterByBoolMask.in)

# group: FILTERING OUT LARGE FACE OF UNIT PANEL GROUPS
name_2 = FamilyType.Name(cladding_wall_panels)
code_block_5 = CodeBlock { "Unit"; }
contains_2 = String.Contains(str=name_2, searchFor=code_block_5)
filterByBoolMask_2 = List.FilterByBoolMask(list=cladding_wall_panels, mask=contains_2)
individual_cladding_panels = Object.Identity(filterByBoolMask_2.out)
ungroup = Custom[UNGROUPING ANY "UNIT" GROUPS](group=filterByBoolMask_2.in)  # "Group.Ungroup"; Ungroups a group and returns the ungrouped elements.

# group: 10'-0" PANELS
search_criteria = CodeBlock { "K4_EC10"; }
search_by_family_type_name = CodeBlock(t2=individual_cladding_panels, t4=search_criteria)
# ---------- search_by_family_type_name.designscript (6 lines) ----------
t1 = t2.Name;
t3 = String.Contains(t1, t4, false);
t5 = List.FilterByBoolMask(t2, t3);
t6 = __TryGetValueFromNestedDictionaries(t5, "in");
t7 = __TryGetValueFromNestedDictionaries(t5, "out");
t8 = DSCore.Object.Identity(t6);
# ----------------------------------------
n10_0_panels = Object.Identity(search_by_family_type_name.t8)  # "10'-0" PANELS"

# group: 13'-0" PANELS
search_criteria_2 = CodeBlock { "K4_EC13"; }
search_by_family_type_name_2 = CodeBlock(t2=individual_cladding_panels, t4=search_criteria_2)  # same code as search_by_family_type_name
n13_0_panels = Object.Identity(search_by_family_type_name_2.t8)  # "13'-0" PANELS"

# group: 14'-0"PANELS
search_criteria_3 = CodeBlock { "K4_EC14"; }
search_by_family_type_name_3 = CodeBlock(t2=individual_cladding_panels, t4=search_criteria_3)  # same code as search_by_family_type_name
n14_0_panels = Object.Identity(search_by_family_type_name_3.t8)  # "14'-0" PANELS"

# group: 15'-0" PANELS
search_criteria_4 = CodeBlock { "K4_EC15"; }
search_by_family_type_name_4 = CodeBlock(t2=individual_cladding_panels, t4=search_criteria_4)  # same code as search_by_family_type_name
n15_0_panels = Object.Identity(search_by_family_type_name_4.t8)  # "15'-0" PANELS"

# group: PARAPET PANELS
search_criteria_5 = CodeBlock { "K4_EC-P"; }
search_by_family_type_name_5 = CodeBlock(t2=individual_cladding_panels, t4=search_criteria_5)  # same code as search_by_family_type_name
parapet_panels = Object.Identity(search_by_family_type_name_5.t8)

panel_group_names = List.Create(search_criteria, search_criteria_2, search_criteria_3, search_criteria_4, search_criteria_5)
watch_2 = Watch(panel_group_names)
remove = String.Remove(str=watch_2, startIndex=code_block.out0, count=code_block.out1)
panel_groups = List.Create(n10_0_panels, n13_0_panels, n14_0_panels, n15_0_panels, parapet_panels)

# group: SELECT PANEL GROUP TO CHANGE
code_block_6 = CodeBlock { "KATERRA K4 DYNAMIC CLADDING TOOL"; }
file_path = Filename("..\..\..\..\Office\04 Software\Revit\Dynamo Scripts\K4 Dynamic Kase Tool\LOGO\Katerra_Icon_B.jpg")
code_block_7 = CodeBlock { "CONTINUE"; }
code_block_8 = CodeBlock { "WHICH PANEL GROUP DO YOU WANT TO WANT TO CHANGE?"; }
ui_dropdown_data = Custom[UI.DropDown Data](InputName=code_block_8, Keys=remove, Values=panel_groups)  # Create data for DropDown input in UI.MultiInputForm ++ . Check out www.data-shapes.net for more infos.
code_block_9 = CodeBlock { "ABORT"; }
code_block_10 = CodeBlock { 500; }
ui_multipleinputform = Custom[UI.MultipleInputForm ++](Description_optional=code_block_6, Logo_optional=file_path, ButtonText_optional=code_block_7, Inputs=ui_dropdown_data, Toggle=panel_group_selection, CancelButtonText_optional=code_block_9, Width_optional=code_block_10)  # Create a form with multiple inputs. see www.data-shapes.net for tutorials and infos!

name_3 = FamilyType.Name(ui_multipleinputform.User_Inputs)
code_block_11 = CodeBlock { -1; -6; }
remove_2 = String.Remove(str=name_3, startIndex=code_block_11.out0, count=code_block_11.out1)
watch_3 = Watch(remove_2)
code_block_12 = CodeBlock { 1; }
flatten = List.Flatten(list=watch_3, amt=code_block_12)
uniqueItems = List.UniqueItems(flatten)
watch_4 = Watch(uniqueItems)
panel_subgroup_selection = BoolSelector(false)

# group: SELECT PANEL SUBGROUP TO CHANGE
watch_5 = Watch(ui_multipleinputform.User_Inputs)
individual_cladding_panels_2 = Object.Identity(watch_5)
code_block_13 = CodeBlock { "WHICH PANEL SUBGROUP?"; }
boolean = BoolSelector(false)
boolean_2 = BoolSelector(false)
ui_listview_data = Custom[UI.Listview Data](InputName=code_block_13, Keys=watch_4, Values=watch_4, SortItems_optionnal=boolean, ShowId_optionnal=boolean_2)  # Create data for ListView input in UI.MultiInputForm ++ . Check out www.data-shapes.net for more infos.
ui_multipleinputform_2 = Custom[UI.MultipleInputForm ++](Description_optional=code_block_6, Logo_optional=file_path, ButtonText_optional=code_block_7, Inputs=ui_listview_data, Toggle=panel_subgroup_selection, CancelButtonText_optional=code_block_9, Width_optional=code_block_10)
watch_6 = Watch(individual_cladding_panels_2)
code_block_14 = CodeBlock { 1; }
flatten_2 = List.Flatten(list=watch_6, amt=code_block_14)
PANELS = Watch(flatten_2)

watch_7 = Watch(individual_cladding_panels)
code_block_15 = CodeBlock { 1; }
flatten_3 = List.Flatten(list=ui_multipleinputform_2.User_Inputs, amt=code_block_15)
startsWith = String.StartsWith(str=name_3, searchFor=flatten_3)
filterByBoolMask_3 = List.FilterByBoolMask(list=ui_multipleinputform.User_Inputs, mask=startsWith)

# group: PANEL SUBGROUP DISPLAY
identity = Object.Identity(filterByBoolMask_3.in)
members = Custom[Group.Members](group=identity)  # Retrieves the members of a group
string_from_object = FromObject(members)
code_block_16 = CodeBlock { "Curtain Panel"; }
eq = string_from_object == code_block_16
filterByBoolMask_4 = List.FilterByBoolMask(list=members, mask=eq)
master_panel_filter = CodeBlock(t3=filterByBoolMask_4.in)
# ---------- master_panel_filter.designscript (5 lines) ----------
t2 = t3.Name;
t4 = String.Contains(t2, "MASTER", false);
t5 = List.FilterByBoolMask(t3, t4);
t6 = __TryGetValueFromNestedDictionaries(t5, "in");
t7 = __TryGetValueFromNestedDictionaries(t5, "out");
# ----------------------------------------
geometry_2 = Element.Geometry(master_panel_filter.t6)
code_block_17 = CodeBlock { t1 = 50; t2 = 255; t3 = 153; t4 = 0; color1 = DSCore.Color.ByARGB(t1, t2, t3, t4); }
byGeometryColor = Display.Display.ByGeometryColor(geometry_2, code_block_17.color1)

# group: Preview Individual Panel Labels
code_block_18 = CodeBlock { 1; }
flatten_4 = List.Flatten(list=identity, amt=code_block_18)
list_enumeration = CodeBlock(t4=flatten_4)
# ---------- list_enumeration.designscript (7 lines) ----------
t3 = List.Count(t4);
t5 = (1..t3..1);
t6 = {t5};
t7 = Manage.RemoveNulls(t6);
t8 = __TryGetValueFromNestedDictionaries(t7, "Cleaned");
t9 = __TryGetValueFromNestedDictionaries(t7, "Indices");
t10 = List.Flatten(t8, 1);
# ----------------------------------------
string_from_object_2 = FromObject(list_enumeration.t10)
panel_prefix = CodeBlock { "P-"; }
concat = String.Concat(panel_prefix)  # unwired: arg1
map = List.Map(list=string_from_object_2, f_x=concat)
accent_panel_filter = CodeBlock(t3=master_panel_filter.t6)
# ---------- accent_panel_filter.designscript (5 lines) ----------
t2 = t3.Name;
t4 = String.Contains(t2, "ACCENT", false);
t5 = List.FilterByBoolMask(t3, t4);
t6 = __TryGetValueFromNestedDictionaries(t5, "in");
t7 = __TryGetValueFromNestedDictionaries(t5, "out");
# ----------------------------------------
flatten_5 = Flatten(accent_panel_filter.t7)
geometry_3 = Element.Geometry(flatten_5)
faces = Topology.Faces(geometry_3)
code_block_19 = CodeBlock { 1; }
flatten_6 = List.Flatten(list=faces, amt=code_block_19)
surfaceGeometry = Face.SurfaceGeometry(flatten_6)
area = Surface.Area(surfaceGeometry)
maximumItem = List.MaximumItem(area)
eq_2 = area == maximumItem
filterByBoolMask_5 = List.FilterByBoolMask(list=flatten_6, mask=eq_2)
code_block_20 = CodeBlock { 0; }
getItemAtIndex_3 = List.GetItemAtIndex(index=code_block_20)  # unwired: list
map_2 = List.Map(list=filterByBoolMask_5.in, f_x=getItemAtIndex_3)
surfaceGeometry_2 = Face.SurfaceGeometry(map_2)
code_block_21 = CodeBlock { 0.5; }
pointAtParameter = Surface.PointAtParameter(surface=surfaceGeometry_2, u=code_block_21, v=code_block_21)
code_block_22 = CodeBlock { 1; }
panel_tags = DynamoText.Text.FromStringOriginAndScale(map, pointAtParameter, code_block_22)

# group: WHICH INDIVIDUAL PANELS YOU WANT TO CHANGE
code_block_23 = CodeBlock { "WHICH PANELS DO YOU WANT TO CHANGE?"; }
panel_tags_2 = Watch(map)
individual_cladding_panels_3 = Object.Identity(filterByBoolMask_3.in)
watch_8 = Watch(individual_cladding_panels_3)
code_block_24 = CodeBlock { 1; }
flatten_7 = List.Flatten(list=watch_8, amt=code_block_24)
PANELS_2 = Watch(flatten_7)
boolean_3 = BoolSelector(false)
boolean_4 = BoolSelector(false)
ui_listview_data_2 = Custom[UI.Listview Data](InputName=code_block_23, Keys=panel_tags_2, Values=PANELS_2, SortItems_optionnal=boolean_3, ShowId_optionnal=boolean_4)
ui_multipleinputform_3 = Custom[UI.MultipleInputForm ++](Description_optional=code_block_6, Logo_optional=file_path, ButtonText_optional=code_block_7, Inputs=ui_listview_data_2, Toggle=individual_panel_selection, CancelButtonText_optional=code_block_9, Width_optional=code_block_10)

# group: INDIVIDUAL PANEL DISPLAY
selected_panels_to_change = Watch(ui_multipleinputform_3.User_Inputs)
code_block_25 = CodeBlock { 1; }
flatten_8 = List.Flatten(list=selected_panels_to_change, amt=code_block_25)
members_2 = Custom[Group.Members](group=flatten_8)
string_from_object_3 = FromObject(members_2)
code_block_26 = CodeBlock { "Curtain Panel"; }
eq_3 = string_from_object_3 == code_block_26
filterByBoolMask_6 = List.FilterByBoolMask(list=members_2, mask=eq_3)
geometry_4 = Element.Geometry(filterByBoolMask_6.in)
code_block_27 = CodeBlock { t1 = 255; t2 = 255; t3 = 153; t4 = 0; color1 = DSCore.Color.ByARGB(t1, t2, t3, t4); }
byGeometryColor_2 = Display.Display.ByGeometryColor(geometry_4, code_block_27.color1)

# group (continued): SELECT PANEL SUBGROUP TO CHANGE
panel_tags_3 = Watch(map)

# group: SELECT ALL INDIVIDUAL EXTERIOR CLADDING PANELS
element_types_2 = ElementTypes("GroupType")
all_elements_of_type_2 = ElementsOfType(element_types_2)
search_criteria_6 = CodeBlock { "K4_EC"; }
search_by_family_type_name_6 = CodeBlock(t2=all_elements_of_type_2, t4=search_criteria_6)  # same code as search_by_family_type_name
exterior_cladding_panels = Object.Identity(search_by_family_type_name_6.t8)
search_criteria_7 = CodeBlock { "Unit"; }
search_by_family_type_name_7 = CodeBlock(t2=exterior_cladding_panels, t4=search_criteria_7)  # same code as search_by_family_type_name
single_cladding_panels = Object.Identity(search_by_family_type_name_7.t7)

identity_2 = Object.Identity(single_cladding_panels)
name_4 = FamilyType.Name(identity_2)
startsWith_2 = String.StartsWith(str=name_4, searchFor=flatten_3, lacing=Longest)
filterByBoolMask_7 = List.FilterByBoolMask(list=identity_2, mask=startsWith_2)

# group: SELECTION OF REPLACEMENT PANEL
code_block_28 = CodeBlock { "WHICH PANEL TO REPLACE WITH?"; }
watch_9 = Watch(filterByBoolMask_7.in)
name_5 = FamilyType.Name(watch_9)
watch_10 = Watch(name_5)
code_block_29 = CodeBlock { 1; }
flatten_9 = List.Flatten(list=watch_10, amt=code_block_29)
watch_11 = Watch(flatten_9)
flatten_10 = List.Flatten(list=watch_9, amt=code_block_29)
watch_12 = Watch(flatten_10)
ui_dropdown_data_2 = Custom[UI.DropDown Data](InputName=code_block_28, Keys=watch_11, Values=watch_12)
ui_multipleinputform_4 = Custom[UI.MultipleInputForm ++](Description_optional=code_block_6, Logo_optional=file_path, ButtonText_optional=code_block_7, Inputs=ui_dropdown_data_2, Toggle=individual_panel_replacement, CancelButtonText_optional=code_block_9, Width_optional=code_block_10)

# group: REPLACE PANELS
watch_13 = Watch(ui_multipleinputform_4.User_Inputs)
create = List.Create(selected_panels_to_change, watch_13)  # frozen
code_block_30 = CodeBlock(X=create) { X[0]; X[1]; }
code_block_31 = CodeBlock { "Type"; }
setParameterByName = Element.SetParameterByName(element=code_block_30.out0, parameterName=code_block_31, value=code_block_30.out1)
watch_14 = Watch(setParameterByName)

watch_15 = Watch(panel_groups)
code_block_32 = CodeBlock { 0; 11; }
substring = String.Substring(str=name_3, startIndex=code_block_32.out0, length=code_block_32.out1)
code_block_33 = CodeBlock { 0; 5; }
remove_3 = String.Remove(str=watch_3, startIndex=code_block_33.out0, count=code_block_33.out1)
code_block_34 = CodeBlock { 1; }
flatten_11 = List.Flatten(list=remove_3, amt=code_block_34)

# group: Preview Subgroup Panel Labels
code_block_35 = CodeBlock { t2 = false; t1 =  true; }
if_ = If(test=ui_multipleinputform_2.Was_Run, true=code_block_35.t2, false=code_block_35.t1)
boolean_gate = Custom[Boolean Gate](list=flatten_11, boolean=if_, lacing=Longest)  # A simple Gate to pass objects through if true
code_block_36 = CodeBlock { 1; }
code_block_37 = CodeBlock { 0; }
getItemAtIndex_4 = List.GetItemAtIndex(index=code_block_37)  # unwired: list
code_block_38 = CodeBlock { 0.5; }
code_block_39 = CodeBlock { 1; }
panel_prefix_2 = CodeBlock { "P-"; }
concat_2 = String.Concat(panel_prefix_2)  # unwired: arg1

boolean_gate_2 = Custom[Boolean Gate](list=individual_cladding_panels_2, boolean=if_, lacing=Longest)

# group: PANEL GROUP DISPLAY
identity_3 = Object.Identity(boolean_gate_2)
members_3 = Custom[Group.Members](group=identity_3)
string_from_object_4 = FromObject(members_3)
code_block_40 = CodeBlock { "Curtain Panel"; }
eq_4 = string_from_object_4 == code_block_40
filterByBoolMask_8 = List.FilterByBoolMask(list=members_3, mask=eq_4)
master_panel_filter_2 = CodeBlock(t3=filterByBoolMask_8.in)  # same code as master_panel_filter
geometry_5 = Element.Geometry(master_panel_filter_2.t6)
code_block_41 = CodeBlock { t1 = 50; t2 = 255; t3 = 153; t4 = 0; color1 = DSCore.Color.ByARGB(t1, t2, t3, t4); }
byGeometryColor_3 = Display.Display.ByGeometryColor(geometry_5, code_block_41.color1)

boolean_gate_3 = Custom[Boolean Gate](list=watch_7, boolean=if_)

# group: TRANSIENT PANELS
watch_16 = Watch(boolean_gate_3)
code_block_42 = CodeBlock { 1; }
flatten_12 = List.Flatten(list=watch_16, amt=code_block_42)
watch_17 = Watch(identity_3)
code_block_43 = CodeBlock { 1; }
flatten_13 = List.Flatten(list=watch_17, amt=code_block_43)
allIndicesOf = List.AllIndicesOf(list=flatten_12, item=flatten_13)
code_block_44 = CodeBlock { 2; }
flatten_14 = List.Flatten(list=allIndicesOf, amt=code_block_44)
removeItemAtIndex = List.RemoveItemAtIndex(list=flatten_12, indices=flatten_14)
members_4 = Custom[Group.Members](group=removeItemAtIndex)
string_from_object_5 = FromObject(members_4)
code_block_45 = CodeBlock { "Curtain Panel"; }
eq_5 = string_from_object_5 == code_block_45
filterByBoolMask_9 = List.FilterByBoolMask(list=members_4, mask=eq_5)
master_panel_filter_3 = CodeBlock(t3=filterByBoolMask_9.in)  # same code as master_panel_filter
geometry_6 = Element.Geometry(master_panel_filter_3.t6)
code_block_46 = CodeBlock { t1 = 50; t2 = 128; t3 = 128; t4 = 128; color1 = DSCore.Color.ByARGB(t1, t2, t3, t4); }
byGeometryColor_4 = Display.Display.ByGeometryColor(geometry_6, code_block_46.color1)

# group (continued): Preview Subgroup Panel Labels
accent_panel_filter_2 = CodeBlock(t3=master_panel_filter_2.t6)  # same code as accent_panel_filter
flatten_15 = Flatten(accent_panel_filter_2.t7)
geometry_7 = Element.Geometry(flatten_15)
faces_2 = Topology.Faces(geometry_7)
flatten_16 = List.Flatten(list=faces_2, amt=code_block_36)
surfaceGeometry_3 = Face.SurfaceGeometry(flatten_16)
area_2 = Surface.Area(surfaceGeometry_3)
maximumItem_2 = List.MaximumItem(area_2)
eq_6 = area_2 == maximumItem_2
filterByBoolMask_10 = List.FilterByBoolMask(list=flatten_16, mask=eq_6)
map_3 = List.Map(list=filterByBoolMask_10.in, f_x=getItemAtIndex_4)
surfaceGeometry_4 = Face.SurfaceGeometry(map_3)
pointAtParameter_2 = Surface.PointAtParameter(surface=surfaceGeometry_4, u=code_block_38, v=code_block_38)
panel_tags_4 = DynamoText.Text.FromStringOriginAndScale(boolean_gate, pointAtParameter_2, code_block_39)

watch_18 = Watch(flatten_3)
watch_19 = Watch(startsWith_2)
name_6 = FamilyType.Name(filterByBoolMask_7.in)
name_7 = FamilyType.Name(watch_7)
code_block_47 = CodeBlock { 5; 2; }
substring_2 = String.Substring(str=name_7, startIndex=code_block_47.out0, length=code_block_47.out1)
clear_list = Custom[Clear List](Input=master_panel_filter_3.t6)  # This node will remove all Null and Empty Lists from any list.

# group: Preview Base Panel Labels
code_block_48 = CodeBlock { t2 = false; t1 =  true; }
if_2 = If(test=ui_multipleinputform.Was_Run, true=code_block_48.t2, false=code_block_48.t1)
boolean_gate_4 = Custom[Boolean Gate](list=substring_2, boolean=if_2)
accent_panel_filter_3 = CodeBlock(t3=clear_list)  # same code as accent_panel_filter
flatten_17 = Flatten(accent_panel_filter_3.t7)
geometry_8 = Element.Geometry(flatten_17)
faces_3 = Topology.Faces(geometry_8)
code_block_49 = CodeBlock { 1; }
flatten_18 = List.Flatten(list=faces_3, amt=code_block_49)
surfaceGeometry_5 = Face.SurfaceGeometry(flatten_18)
area_3 = Surface.Area(surfaceGeometry_5)
maximumItem_3 = List.MaximumItem(area_3)
eq_7 = area_3 == maximumItem_3
filterByBoolMask_11 = List.FilterByBoolMask(list=flatten_18, mask=eq_7)
code_block_50 = CodeBlock { 0; }
getItemAtIndex_5 = List.GetItemAtIndex(index=code_block_50)  # unwired: list
map_4 = List.Map(list=filterByBoolMask_11.in, f_x=getItemAtIndex_5)
surfaceGeometry_6 = Face.SurfaceGeometry(map_4)
code_block_51 = CodeBlock { 0.5; }
pointAtParameter_3 = Surface.PointAtParameter(surface=surfaceGeometry_6, u=code_block_51, v=code_block_51)
code_block_52 = CodeBlock { 1; }
panel_tags_5 = DynamoText.Text.FromStringOriginAndScale(boolean_gate_4, pointAtParameter_3, code_block_52)

watch_20 = Watch(if_)
watch_21 = Watch(name_7)
code_block_53 = CodeBlock { 0; 5; }
remove_4 = String.Remove(str=name_7, startIndex=code_block_53.out0, count=code_block_53.out1)
watch_22 = Watch(remove_4)
remove_5 = String.Remove()  # unwired: str, startIndex, count
watch_23 = Watch(remove)
code_block_54 = CodeBlock { 2; }
flatten_19 = List.Flatten(list=identity, amt=code_block_54)
name_8 = Family.Name(identity)
boolean_gate_5 = Custom[Boolean Gate](list=watch_7, boolean=ui_multipleinputform_2.Was_Run)
allIndicesOf_2 = List.AllIndicesOf(list=boolean_gate_5, item=identity)
code_block_55 = CodeBlock { 3; }
flatten_20 = List.Flatten(list=allIndicesOf_2, amt=code_block_55)

# group: TRANSIENT PANELS
watch_24 = Watch(boolean_gate_5)
code_block_56 = CodeBlock { 1; }
flatten_21 = List.Flatten(list=watch_24, amt=code_block_56)
removeItemAtIndex_2 = List.RemoveItemAtIndex(list=flatten_21, indices=flatten_20)
members_5 = Custom[Group.Members](group=removeItemAtIndex_2)
string_from_object_6 = FromObject(members_5)
code_block_57 = CodeBlock { "Curtain Panel"; }
eq_8 = string_from_object_6 == code_block_57
filterByBoolMask_12 = List.FilterByBoolMask(list=members_5, mask=eq_8)
master_panel_filter_4 = CodeBlock(t3=filterByBoolMask_12.in)  # same code as master_panel_filter
geometry_9 = Element.Geometry(master_panel_filter_4.t6)
code_block_58 = CodeBlock { t1 = 50; t2 = 128; t3 = 128; t4 = 128; color1 = DSCore.Color.ByARGB(t1, t2, t3, t4); }
byGeometryColor_5 = Display.Display.ByGeometryColor(geometry_9, code_block_58.color1)
watch_25 = Watch(identity_3)
code_block_59 = CodeBlock { 2; }
flatten_22 = List.Flatten(amt=code_block_59)  # unwired: list

watch_26 = Watch(accent_panel_filter_3.t7)
name_9 = FamilyType.Name(watch_26)
removeNulls = Lists.Manage.RemoveNulls()  # unwired: arg0
