# Dynamo graph MarkBySpline.dyn (Dynamo 2.12.0.5650)

# group: Starting Inputs
parking_stall_selection = DSModelElementsByCategorySelection("42b66073-185b-4760-809b-e5b8a8ad4bc2-00472a0f,42b66073-185b-4760-809b-e5b8a8ad4bc2-0047329b,cf3da076-c72d-48cd-8142-4253cc37bcf8-00480423,cf3da076-c72d-48cd-8142-4253cc37bcf8-00480424,533ba316-2040-4f51-82ab-543fde6ddbe4-004b690c,533ba316-2040-4f51-82ab-543fde6ddbe4-004b6914,533ba316-2040-4f51-82ab-543fde6ddbe4-004b691c,533ba316-2040-4f51-82ab-543fde6ddbe4-004b6924,a6832fa1-d31c-498b-ac0c-74dfca66e31d-00621398,d41f8887-ca41-4086-af67-809b5f995668-00639a7c,d41f8887-ca41-4086-af67-809b5f995668-00639aa1,d41f8887-ca41-4086-af67-809b5f995668-00639aa9,d41f8887-ca41-4086-af67-809b5f995668-00639ab3,c25c8b39-b938-4bf0-8666-127c7395777e-006ab46c,c25c8b39-b938-4bf0-8666-127c7395777e-006ab4a9,c25c8b39-b938-4bf0-8666-127c7395777e-006ab5d8,c25c8b39-b938-4bf0-8666-127c7395777e-006ab624,c25c8b39-b938-4bf0-8666-127c7395777e-006ab62e,c25c8b39-b938-4bf0-8666-127c7395777e-006ab636,c25c8b39-b938-4bf0-8666-127c7395777e-006ab6f1,c25c8b39-b938-4bf0-8666-127c7395777e-006ab742,c25c8b39-b938-4bf0-8666-127c7395777e-006ab851,c25c8b39-b938-4bf0-8666-127c7395777e-006ab8ba,c25c8b39-b938-4bf0-8666-127c7395777e-006ab90f,c25c8b39-b938-4bf0-8666-127c7395777e-006ab964,c25c8b39-b938-4bf0-8666-127c7395777e-006aba50,286dd17d-f0d4-4202-9e0b-ff0d58235fd0-006c6cb1,286dd17d-f0d4-4202-9e0b-ff0d58235fd0-006c6d0d,ea4812cc-4121-41a2-b5e8-24077e7bef43-006f22b4,ea4812cc-4121-41a2-b5e8-24077e7bef43-006f22b5,ea4812cc-4121-41a2-b5e8-24077e7bef43-006f22b6,ea4812cc-4121-41a2-b5e8-24077e7bef43-006f22b7,ea4812cc-4121-41a2-b5e8-24077e7bef43-006f22b8,ea4812cc-4121-41a2-b5e8-24077e7bef43-006f22b9,ea4812cc-4121-41a2-b5e8-24077e7bef43-006f22ba,ea4812cc-4121-41a2-b5e8-24077e7bef43-006f22bb,ea4812cc-4121-41a2-b5e8-24077e7bef43-006f22bc,ea4812cc-4121-41a2-b5e8-24077e7bef43-006f22bd,a47a1594-83c1-4263-8a55-225c1e33ac59-006f5038,a47a1594-83c1-4263-8a55-225c1e33ac59-006f5039,a47a1594-83c1-4263-8a55-225c1e33ac59-006f503a,a47a1594-83c1-4263-8a55-225c1e33ac59-006f503b,a47a1594-83c1-4263-8a55-225c1e33ac59-006f503c,a47a1594-83c1-4263-8a55-225c1e33ac59-006f503d,a2aa17e4-b40f-483b-a1ba-ae44fde6fd36-006f515f,a2aa17e4-b40f-483b-a1ba-ae44fde6fd36-006f5160,a2aa17e4-b40f-483b-a1ba-ae44fde6fd36-006f5161,a2aa17e4-b40f-483b-a1ba-ae44fde6fd36-006f5162,a2aa17e4-b40f-483b-a1ba-ae44fde6fd36-006f516e,a2aa17e4-b40f-483b-a1ba-ae44fde6fd36-006f516f,a2aa17e4-b40f-483b-a1ba-ae44fde6fd36-006f5170,a2aa17e4-b40f-483b-a1ba-ae44fde6fd36-006f5171,a2aa17e4-b40f-483b-a1ba-ae44fde6fd36-006f52d4,a2aa17e4-b40f-483b-a1ba-ae44fde6fd36-006f52d5,a2aa17e4-b40f-483b-a1ba-ae44fde6fd36-006f52d6,a2aa17e4-b40f-483b-a1ba-ae44fde6fd36-006f52d7,a2aa17e4-b40f-483b-a1ba-ae44fde6fd36-006f52d8,a2aa17e4-b40f-483b-a1ba-ae44fde6fd36-006f52d9,a2aa17e4-b40f-483b-a1ba-ae44fde6fd36-006f52da,a2aa17e4-b40f-483b-a1ba-ae44fde6fd36-006f52dc,a2aa17e4-b40f-483b-a1ba-ae44fde6fd36-006f52f7,a2aa17e4-b40f-483b-a1ba-ae44fde6fd36-006f52f8,a2aa17e4-b40f-483b-a1ba-ae44fde6fd36-006f52f9,a2aa17e4-b40f-483b-a1ba-ae44fde6fd36-006f52fa,a2aa17e4-b40f-483b-a1ba-ae44fde6fd36-006f52fb,a2aa17e4-b40f-483b-a1ba-ae44fde6fd36-006f52fc,a2aa17e4-b40f-483b-a1ba-ae44fde6fd36-006f5425,a2aa17e4-b40f-483b-a1ba-ae44fde6fd36-006f5426,a2aa17e4-b40f-483b-a1ba-ae44fde6fd36-006f5427,a2aa17e4-b40f-483b-a1ba-ae44fde6fd36-006f5428,a2aa17e4-b40f-483b-a1ba-ae44fde6fd36-006f5429,a2aa17e4-b40f-483b-a1ba-ae44fde6fd36-006f542a,e359cbf2-e455-421b-933b-50a168f160a2-00760278,e359cbf2-e455-421b-933b-50a168f160a2-00760279,e359cbf2-e455-421b-933b-50a168f160a2-0076027a,e359cbf2-e455-421b-933b-50a168f160a2-0076027b,e359cbf2-e455-421b-933b-50a168f160a2-0076027c,e359cbf2-e455-421b-933b-50a168f160a2-00760297,e359cbf2-e455-421b-933b-50a168f160a2-00760298,e359cbf2-e455-421b-933b-50a168f160a2-00760299,e359cbf2-e455-421b-933b-50a168f160a2-0076029a,e359cbf2-e455-421b-933b-50a168f160a2-0076029b,e359cbf2-e455-421b-933b-50a168f160a2-0076029c,e359cbf2-e455-421b-933b-50a168f160a2-0076029d,e359cbf2-e455-421b-933b-50a168f160a2-0076029e,e359cbf2-e455-421b-933b-50a168f160a2-0076029f,e359cbf2-e455-421b-933b-50a168f160a2-007602a0,e359cbf2-e455-421b-933b-50a168f160a2-007602a1,e359cbf2-e455-421b-933b-50a168f160a2-007602a2,e359cbf2-e455-421b-933b-50a168f160a2-007602a3,e359cbf2-e455-421b-933b-50a168f160a2-007602a4,e359cbf2-e455-421b-933b-50a168f160a2-007602a5,e359cbf2-e455-421b-933b-50a168f160a2-007602fc,e359cbf2-e455-421b-933b-50a168f160a2-007602fd,e359cbf2-e455-421b-933b-50a168f160a2-007602fe,e359cbf2-e455-421b-933b-50a168f160a2-007602ff,e359cbf2-e455-421b-933b-50a168f160a2-00760300,e359cbf2-e455-421b-933b-50a168f160a2-0076031f,e359cbf2-e455-421b-933b-50a168f160a2-00760320,e359cbf2-e455-421b-933b-50a168f160a2-00760321,e359cbf2-e455-421b-933b-50a168f160a2-00760322,e359cbf2-e455-421b-933b-50a168f160a2-00760323")  # 102 picked in the model; graph input
spline = DSModelElementSelection()  # 1 picked in the model; graph input
starting_number = IntegerSlider(1, range=0..1000 step 1)  # graph input

# group: Parking Tags
current = Document.Current()
activeView = Document.ActiveView(document=current)
code_block = CodeBlock { true; false; "Left"; "Bottom"; }
code_block_2 = CodeBlock { 3; 6; }
byCoordinates = Vector.ByCoordinates(x=code_block_2.out0, y=code_block_2.out1)
byElement = Tag.ByElement(view=activeView, element=parking_stall_selection, horizontal=code_block.out0, addLeader=code_block.out1, horizontalAlignment=code_block.out2, verticalAlignment=code_block.out3, offset=byCoordinates)

# group: Reference Geometry
geometry = Element.Geometry(element=spline)
XY = Plane.XY()
pullOntoPlane = Curve.PullOntoPlane(curve=geometry, plane=XY)
getLocation = Element.GetLocation(element=parking_stall_selection)
# note: Ensuring that the parking stall location points and the spline are on the same plane (XY)
code_block_3 = CodeBlock(loc=getLocation) { Point.X(loc); Point.Y(loc); }
byCoordinates_2 = Point.ByCoordinates(x=code_block_3.out0, y=code_block_3.out1)

# group: Creating a range of numbers to update the mark values of the selected parking stalls
closestPointTo = Geometry.ClosestPointTo(geometry=pullOntoPlane, other=byCoordinates_2, lacing=Longest)
parameterAtPoint = Curve.ParameterAtPoint(curve=pullOntoPlane, point=closestPointTo, lacing=Longest)
sortByKey = List.SortByKey(list=parking_stall_selection, keys=parameterAtPoint)
count = List.Count(list=sortByKey.sortedList)
code_block_4 = CodeBlock(n=starting_number, c=count) { n..n+(c-1)..1; }
string_from_object = FromObject(object=code_block_4)
code_block_5 = CodeBlock { "."; }
split = String.Split(string=string_from_object, separator0=code_block_5)
code_block_6 = CodeBlock { 0; }
getItemAtIndex = List.GetItemAtIndex(list=split@L2, index=code_block_6)

# group: Trailing Zeroes for Stall Numbers
length = String.Length(string=getItemAtIndex)
code_block_7 = CodeBlock { 1; }
gt = length > code_block_7
prefix = StringInput("0")
add = prefix + getItemAtIndex
prefix_2 = StringInput("00")
add_2 = prefix_2 + getItemAtIndex
if_ = RefactoredIf(test=gt, true=add, false=add_2, lacing=Shortest)
length_2 = String.Length(string=if_)
code_block_8 = CodeBlock { 4; }
ge = length_2 >= code_block_8
code_block_9 = CodeBlock { 0; 1; }
remove = String.Remove(string=if_, startIndex=code_block_9.out0, count=code_block_9.out1)
if_2 = RefactoredIf(test=ge, true=remove, false=if_, lacing=Shortest)

# group: Updating Marks
parameter_to_set = StringInput("Mark")
setParameterByName = Element.SetParameterByName(element=sortByKey.sortedList, parameterName=parameter_to_set, value=if_2, lacing=Longest)
name = Element.Name(element=setParameterByName)

# group: Carport Suffix Add
code_block_10 = CodeBlock { "CARPORT"; }
startsWith = String.StartsWith(string=name, searchFor=code_block_10)
filterByBoolMask = List.FilterByBoolMask(list=setParameterByName, mask=startsWith)
filterByBoolMask_2 = List.FilterByBoolMask(list=if_2, mask=startsWith)
suffix = StringInput("C")
add_3 = filterByBoolMask_2.in + suffix
setParameterByName_2 = Element.SetParameterByName(element=filterByBoolMask.in, parameterName=parameter_to_set, value=add_3)

# group: Garage Suffix Add
code_block_11 = CodeBlock { "GARAGE"; }
startsWith_2 = String.StartsWith(string=name, searchFor=code_block_11)
filterByBoolMask_3 = List.FilterByBoolMask(list=setParameterByName, mask=startsWith_2)
filterByBoolMask_4 = List.FilterByBoolMask(list=if_2, mask=startsWith_2)
suffix_2 = StringInput("G")
add_4 = filterByBoolMask_4.in + suffix_2
setParameterByName_3 = Element.SetParameterByName(element=filterByBoolMask_3.in, parameterName=parameter_to_set, value=add_4)
