# Dynamo graph Mass_Floor_Naming.dyn (Dynamo 2.13.1.3887)

# group: GRABBING ALL MASS FLOORS
categories = Categories("OST_MassFloor")
all_elements_of_category = ElementsOfCategory(Category=categories)

# group: FILTERING BY DESIGN OPTION
parameters = Element.Parameters(element=all_elements_of_category, lacing=Longest)
transpose = List.Transpose(lists=parameters)
code_block = CodeBlock { 4; }
getItemAtIndex = List.GetItemAtIndex(list=transpose, index=code_block)
value = Parameter.Value(parameter=getItemAtIndex)
additional_descriptor = BoolSelector(false)  # graph input
code_block_2 = CodeBlock { "Option Set 1 : Option "; }
design_option = IntegerSlider(1, range=1..5 step 1)  # graph input
string_from_object = FromObject(object=design_option)
concat = String.Concat(string0=code_block_2, string1=string_from_object)
SPACE = CodeBlock { " "; }
DESCRIPTOR = StringInput("")  # graph input
concat_2 = String.Concat(string0=concat, string1=SPACE, string2=DESCRIPTOR)
if_ = RefactoredIf(test=additional_descriptor, true=concat_2, false=concat)
code_block_3 = CodeBlock(A=value, B=if_) { A == B; }
filterByBoolMask = List.FilterByBoolMask(list=all_elements_of_category, mask=code_block_3)

# group: LIST OF ALL AVAILABLE PARAMETERS
code_block_4 = CodeBlock(a=filterByBoolMask.in) { a[1]; }
parameters_2 = Element.Parameters(element=code_block_4, lacing=Shortest)
watch = Watch(parameters_2)

# group: GETTING THE MASS TYPE OF THE MASS FLOOR HOSTS
parameters_3 = Element.Parameters(element=filterByBoolMask.in, lacing=Longest)
transpose_2 = List.Transpose(lists=parameters_3)
code_block_5 = CodeBlock { 22; }
getItemAtIndex_2 = List.GetItemAtIndex(list=transpose_2, index=code_block_5)
value_2 = Parameter.Value(parameter=getItemAtIndex_2)

# group: CONVERTING TO UPPERCASE + SPLITTING NAMES TO SINGLE WORD
toUpper = String.ToUpper(string=value_2)
code_block_6 = CodeBlock { " "; }
split = String.Split(string=toUpper, separator0=code_block_6)
transpose_3 = List.Transpose(lists=split)
code_block_7 = CodeBlock(A=transpose_3) { A[0]; }

# group: FILTERING OUT UNITS FOR USES
code_block_8 = CodeBlock { " "; }
split_2 = String.Split(string=value_2, separator0=code_block_8)
transpose_4 = List.Transpose(lists=split_2)
code_block_9 = CodeBlock(A=transpose_4) { A[0]; }
string = StringInput("A1")
string_2 = StringInput("B1")
string_3 = StringInput("C1")
string_4 = StringInput("D1")
string_5 = StringInput("A1C")
code_block_10 = CodeBlock(x=code_block_9, a=string, b=string_2, c=string_3, d=string_4, e=string_5) { x == a || x == b || x ==c || x == d || x == e; }
filterByBoolMask_2 = List.FilterByBoolMask(list=filterByBoolMask.in, mask=code_block_10)

# group: SETTING PARAMETERS
code_block_11 = CodeBlock { "Mark"; "SP - Area - Unit Type"; "SP - Area - Use"; "Comments"; }
set_mark = Element.SetParameterByName(element=filterByBoolMask.in, parameterName=code_block_11.out0, value=code_block_7)
set_sp_area_unit_type = Element.SetParameterByName(element=filterByBoolMask.in, parameterName=code_block_11.out1, value=code_block_7)
code_block_12 = CodeBlock { "UNIT"; }
set_sp_area_use = Element.SetParameterByName(element=filterByBoolMask_2.in, parameterName=code_block_11.out2, value=code_block_12)
code_block_13 = CodeBlock { "PHASE II"; }

# group: GETTING THE MASS COMMENTS OF THE MASS FLOOR HOSTS
parameters_4 = Element.Parameters(element=filterByBoolMask.in, lacing=Longest)
transpose_5 = List.Transpose(lists=parameters_4)
code_block_14 = CodeBlock { 18; }
getItemAtIndex_3 = List.GetItemAtIndex(list=transpose_5, index=code_block_14)
value_3 = Parameter.Value(parameter=getItemAtIndex_3)
code_block_15 = CodeBlock(a=value_3, b=code_block_13) { a == b; }
filterByBoolMask_3 = List.FilterByBoolMask(list=filterByBoolMask.in, mask=code_block_15)

# group (continued): SETTING PARAMETERS
set_comments = Element.SetParameterByName(element=filterByBoolMask_3.in, parameterName=code_block_11.out3, value=code_block_13)
