# Dynamo graph Panelize CW.dyn (Dynamo 2.12.0.5650)
# packages: Clockwork for Dynamo 2.x 2.3.0

curtain_wall_to_panelize = DSModelElementByCategorySelection("83d8d345-c0fe-4b3d-a089-357004694c18-002b2b00")  # 1 picked in the model; graph input
byElement = CurtainPanel.ByElement(hostingElement=curtain_wall_to_panelize)
asFamilyInstance = CurtainPanel.AsFamilyInstance(curtainPanel=byElement)
name = Element.Name(element=asFamilyInstance)
code_block = CodeBlock { "Empty Panel"; }
eq = name == code_block
filterByBoolMask = List.FilterByBoolMask(list=asFamilyInstance, mask=eq)

# group: claddingPanels
family_types = FamilyTypes("BR1:BR1")
family_types_2 = FamilyTypes("BR2:BR2")
family_types_3 = FamilyTypes("BR3:BR3")
family_types_4 = FamilyTypes("BR4:BR4")

list_create = List.Create(item0=family_types, item1=family_types_2, item2=family_types_3, item3=family_types_4, item4=family_types_2, item5=family_types_3, item6=family_types_4)

# group: randomize family types
count = List.Count(list=byElement)
cycle = List.Cycle(list=list_create, amount=count)
random_panel_seed = IntegerSlider(50, range=0..100 step 1)  # graph input
shuffle = List.Shuffle(list=cycle, seed=random_panel_seed)

takeItems = List.TakeItems(list=shuffle, amount=count)
setType = Custom[FamilyInstance.SetType](familyInstance=filterByBoolMask.out, familyType=takeItems)  # package Clockwork for Dynamo 2.x; Changes the family type of a given family instance to the specified type
