# Dynamo graph ParkingDuplicates.dyn (Dynamo 2.12.0.5650)
# packages: Clockwork for Dynamo 2.x 2.3.0

categories = Categories("OST_Parking")
all_elements_of_category = ElementsOfCategory(Category=categories)
python_script = Python(IN[0]=all_elements_of_category)  # IronPython2
# ---------- python_script.python (15 lines) ----------
# Load the Python Standard and DesignScript Libraries
import sys
import clr
clr.AddReference('ProtoGeometry')
from Autodesk.DesignScript.Geometry import *

# The inputs to this node will be stored as a list in the IN variables.
parkingList = IN[0]

# Place your code below this line

splitListParking = parkingList[20:]

# Assign your output to the OUT variable.
OUT = splitListParking
# ----------------------------------------
location = Custom[Element.Location+](element=python_script)  # package Clockwork for Dynamo 2.x; Returns the location of an element as point, curve or curve loop, along with some booleans to help filtering the results. Unlike the OOTB Element.GetLocation node, it also retunrs sketch lines of sketch-based elements like floor slabs as well as the element's rotation property.
uniqueItems = List.UniqueItems(list=location.points)
watch = Watch(uniqueItems)
watch_2 = Watch(all_elements_of_category)
watch_3 = Watch(location.points)
integer_slider = IntegerSlider(0, range=0..100 step 1)
getItemAtIndex = List.GetItemAtIndex(list=all_elements_of_category, index=integer_slider)
pruneDuplicates = Point.PruneDuplicates()  # unwired: points
isMirrored = Custom[FamilyInstance.IsMirrored](familyInstance=python_script)  # package Clockwork for Dynamo 2.x; Checks if a family instance is mirrored
watch_4 = Watch(isMirrored)
filterByBoolMask = List.FilterByBoolMask(list=python_script, mask=isMirrored)
watch_5 = Watch(filterByBoolMask.out)
