# Dynamo graph Project_To_Topo.dyn (Dynamo 2.13.1.3887)

select_model_element = DSModelElementSelection()  # nothing selected; graph input
curves = Element.Curves(element=select_model_element)
TOPOGRAPHY = DSModelElementSelection()  # 1 picked in the model; graph input
mesh = Topography.Mesh(topography=TOPOGRAPHY)

# group: vertices from topography
vertexPositions = Mesh.VertexPositions(mesh=mesh)
faceIndices = Mesh.FaceIndices(mesh=mesh)
A = IndexGroup.A(indexGroup=faceIndices)
getItemAtIndex = List.GetItemAtIndex(list=vertexPositions, index=A)
B = IndexGroup.B(indexGroup=faceIndices)
getItemAtIndex_2 = List.GetItemAtIndex(list=vertexPositions, index=B)
C = IndexGroup.C(indexGroup=faceIndices)
getItemAtIndex_3 = List.GetItemAtIndex(list=vertexPositions, index=C)
code_block = CodeBlock(a=getItemAtIndex, b=getItemAtIndex_2, c=getItemAtIndex_3) { List.Transpose([a,b,c]); }

byPerimeterPoints = Surface.ByPerimeterPoints(points=code_block)
byJoinedSurfaces = PolySurface.ByJoinedSurfaces(surfaces=byPerimeterPoints)
ZAxis = Vector.ZAxis()
project = Curve.Project(curve=curves, baseGeometry=byJoinedSurfaces, projectionDirection=ZAxis)
post_spacing = CodeBlock { 8; }
length = Curve.Length(curve=project)
code_block_2 = CodeBlock(a=post_spacing, b=length) { a/b; }
code_block_3 = CodeBlock(a=code_block_2) { 0..1..a; }
splitByParameter = Curve.SplitByParameter(curve=project, parameters=code_block_3)
flatten = List.Flatten(list=splitByParameter)
startPoint = Curve.StartPoint(curve=flatten)
endPoint = Curve.EndPoint(curve=flatten)
list_create = List.Create(item0=startPoint, item1=endPoint)
transpose = List.Transpose(lists=list_create)
fence_type = FamilyTypes("Magnesium_Fence_Post+Grid:Magnesium_Fence_Post+Grid")  # graph input
byPoints = AdaptiveComponent.ByPoints(points=transpose, familyType=fence_type)
