# Dynamo graph ResetCW.dyn (Dynamo 2.12.0.5650)
# packages: Clockwork for Dynamo 2.x 2.3.0

cw_to_reset = DSModelElementByCategorySelection("83d8d345-c0fe-4b3d-a089-357004694c18-002b2b00")  # 1 picked in the model; graph input
byElement = CurtainPanel.ByElement(hostingElement=cw_to_reset)
asFamilyInstance = CurtainPanel.AsFamilyInstance(curtainPanel=byElement)
default_panel_for_reset = FamilyTypes("System Panel:Cp_Glazing_Vision_1/2\"")  # graph input
setType = Custom[FamilyInstance.SetType](familyInstance=asFamilyInstance, familyType=default_panel_for_reset)  # package Clockwork for Dynamo 2.x; Changes the family type of a given family instance to the specified type
