# Dynamo graph RoomNumBySpline.dyn (Dynamo 2.12.0.5650)

all_elements_in_active_view = ElementsInView()
getCategory = Element.GetCategory(element=all_elements_in_active_view)
string_from_object = FromObject(object=getCategory)
code_block = CodeBlock { "Rooms"; false; }
contains = String.Contains(string=string_from_object, searchFor=code_block.out0, ignoreCase=code_block.out1)
filterByBoolMask = List.FilterByBoolMask(list=all_elements_in_active_view, mask=contains)
spline = DSModelElementSelection()  # 1 picked in the model
geometry = Element.Geometry(element=spline)
XY = Plane.XY()
pullOntoPlane = Curve.PullOntoPlane(curve=geometry, plane=XY)
finishBoundary = Room.FinishBoundary(room=filterByBoolMask.in)
byJoinedCurves = PolyCurve.ByJoinedCurves(curves=finishBoundary)
XY_2 = Plane.XY()
pullOntoPlane_2 = Curve.PullOntoPlane(curve=byJoinedCurves, plane=XY_2)
flatten = List.Flatten(list=pullOntoPlane_2)
intersect = Geometry.Intersect(geometry=pullOntoPlane, other=flatten, lacing=Longest)
isEmpty = List.IsEmpty(list=intersect, lacing=Longest)
filterByBoolMask_2 = List.FilterByBoolMask(list=filterByBoolMask.in, mask=isEmpty)
parameter_to_set = StringInput("Number")
prefix = StringInput("R.")
starting_number = IntegerSlider(1, range=0..100 step 1)
filterByBoolMask_3 = List.FilterByBoolMask(list=intersect, mask=isEmpty)
code_block_2 = CodeBlock { 0; }
getItemAtIndex = List.GetItemAtIndex(list=filterByBoolMask_3.out@L2, index=code_block_2)
parameterAtPoint = Curve.ParameterAtPoint(curve=pullOntoPlane, point=getItemAtIndex, lacing=Longest)
sortByKey = List.SortByKey(list=filterByBoolMask_2.out, keys=parameterAtPoint)
count = List.Count(list=sortByKey.sortedList)
code_block_3 = CodeBlock(n=starting_number, c=count) { n..n+(c-1)..1; }
string_from_object_2 = FromObject(object=code_block_3)
code_block_4 = CodeBlock { "."; }
split = String.Split(string=string_from_object_2, separator0=code_block_4)
code_block_5 = CodeBlock { 0; }
getItemAtIndex_2 = List.GetItemAtIndex(list=split@L2, index=code_block_5)
add = prefix + getItemAtIndex_2
setParameterByName = Element.SetParameterByName(element=filterByBoolMask_2.out, parameterName=parameter_to_set, value=add, lacing=Longest)
