# Dynamo graph Set_All_Family_Parameters.dyn (Dynamo 2.16.1.2727)
# packages: Orchid 216.2.0.8367

current = Orchid.RevitFamily.FamilyDocument.Current()
all = Orchid.RevitFamily.FamilyType.All()
flatten = List.Flatten(list=all)
parameters = FamilyDocument.Parameters(familyDocument=current)
name = FamilyParameter.Name(familyParameter=parameters)
code_block = CodeBlock { "_Material"; }
endsWith = String.EndsWith(string=name, searchFor=code_block)
filterByBoolMask = List.FilterByBoolMask(list=parameters, mask=endsWith)
name_2 = FamilyParameter.Name(familyParameter=filterByBoolMask.in)
flatten_2 = List.Flatten(list=name_2)
all_2 = Orchid.RevitFamily.FamilyType.All()
getValue = Orchid.RevitFamily.FamilyParameter.GetValue(familyDocument=current, familyType=all_2, parameterName=name_2)
transpose = List.Transpose(lists=getValue.valueByParameter)
code_block_2 = CodeBlock(a=transpose) { a[15]; }
flatten_3 = List.Flatten(list=code_block_2)
setValue = Orchid.RevitFamily.FamilyParameter.SetValue(familyDocument=current, familyType=flatten, parameterName=flatten_2, value=flatten_3)
name_3 = Material.Name(material=code_block_2)
