# Dynamo graph Set_Pinned.dyn (Dynamo 2.13.1.3887)

all_elements_in_active_view = ElementsInView()
code_block = CodeBlock { "Category"; }
parameterByName = Parameter.ParameterByName(element=all_elements_in_active_view, name=code_block)
string_from_object = FromObject(object=parameterByName)
code_block_2 = CodeBlock { "<Area Boundary>"; "Area"; }
contains = String.Contains(string=string_from_object, searchFor=code_block_2.out0)
contains_2 = String.Contains(string=string_from_object, searchFor=code_block_2.out1)
or_ = contains || contains_2
filterByBoolMask = List.FilterByBoolMask(list=all_elements_in_active_view, mask=or_)
boolean = BoolSelector(false)
setPinnedStatus = Element.SetPinnedStatus(element=filterByBoolMask.out, pinned=boolean)
