# Dynamo graph Sheet_Index_Update_Issue.dyn "Update_Index_Issue" (Dynamo 2.13.1.3887)

categories = Categories("OST_Sheets")
all_elements_of_category = ElementsOfCategory(Category=categories)
code_block = CodeBlock { "Sheet Issue #"; " (y/n)"; }
issue_schedule_field = StringInput("")  # graph input
concat = String.Concat(string0=code_block.out0, string1=issue_schedule_field, string2=code_block.out1)
is_included_true_false = BoolSelector(false)  # graph input
setParameterByName = Element.SetParameterByName(element=all_elements_of_category, parameterName=concat, value=is_included_true_false)
