# Dynamo graph Topo-Floor.dyn (Dynamo 2.12.0.5650)
# packages: Clockwork for Dynamo 2.x 2.3.0

subregion = DSModelElementSelection()  # 1 picked in the model; frozen
points = Topography.Points(topography=subregion)
number_slider = DoubleSlider(2, range=0..10 step 0.001)
pruneDuplicates = Point.PruneDuplicates(points=points, tolerance=number_slider)
floor = DSModelElementSelection()  # 1 picked in the model; frozen
slabShapeByPoints = Custom[Floor.SlabShapeByPoints](points=pruneDuplicates, floor=floor)  # package Clockwork for Dynamo 2.x; Transform a slab shape based on a list of Points
watch = Watch(slabShapeByPoints.success)
watch_2 = Watch(slabShapeByPoints.floor)
floor_2 = DSModelElementSelection()  # 1 picked in the model; frozen
points_2 = Floor.Points(floor=floor_2)
subregion_2 = DSModelElementSelection()  # 1 picked in the model; frozen
points_3 = Topography.Points(topography=subregion_2)
distanceTo = Geometry.DistanceTo(geometry=points_2, other=points_3, lacing=CrossProduct)
sort = List.Sort(list=distanceTo, lacing=Longest)
firstItem = List.FirstItem(list=sort, lacing=Longest)
code_block = CodeBlock(d=firstItem) { d / 304; }
movePoint = Floor.MovePoint(floor=floor_2, point=points_2, offset=firstItem)
slabShapeByPoints_2 = Custom[Floor.SlabShapeByPoints](points=points_3, floor=floor_2)
byOutlineTypeAndLevel = Floor.ByOutlineTypeAndLevel()  # unwired: outlineCurves, floorType, level
byOutlineTypeAndLevel_2 = Floor.ByOutlineTypeAndLevel()  # unwired: outline, floorType, level
select_model_element = DSModelElementSelection()  # nothing selected; graph input
end = Revit.Transaction.Transaction.End(input=select_model_element)
geometry = Element.Geometry(element=end, lacing=Shortest)
lastItem = List.LastItem(list=geometry)
faceVertices = Custom[Mesh.FaceVertices](mesh=lastItem, lacing=Shortest)  # package Clockwork for Dynamo 2.x; Gets the vertices of each face of a given mesh
byPerimeterPoints = Surface.ByPerimeterPoints(points=faceVertices, lacing=Shortest)
byJoinedSurfaces = PolySurface.ByJoinedSurfaces(surfaces=byPerimeterPoints, lacing=Shortest)
perimeterCurves = Surface.PerimeterCurves(surface=byJoinedSurfaces, lacing=Shortest)
byOriginNormal = Plane.ByOriginNormal()
pullOntoPlane = Curve.PullOntoPlane(curve=perimeterCurves, plane=byOriginNormal)
byJoinedCurves = PolyCurve.ByJoinedCurves(curves=pullOntoPlane)
ZAxis = Vector.ZAxis()
reverse = Vector.Reverse(vector=ZAxis, lacing=Shortest)
code_block_2 = CodeBlock { 5000; }
extrudeAsSolid = Curve.ExtrudeAsSolid(curve=byJoinedCurves, direction=reverse, distance=code_block_2)
byUnion = Solid.ByUnion(solids=extrudeAsSolid)
intersect = Geometry.Intersect(geometry=byUnion, other=byOriginNormal)
flatten = List.Flatten(list=intersect)
code_block_3 = CodeBlock { 0.4; }
translate = Geometry.Translate(geometry=faceVertices, direction=ZAxis, distance=code_block_3)
perimeterCurves_2 = Surface.PerimeterCurves(surface=intersect)
floor_types = FloorTypes("4\" Conc Slab on Grade")
levels = Levels("LEVEL 1")
byOutlineTypeAndLevel_3 = Floor.ByOutlineTypeAndLevel(outlineCurves=perimeterCurves_2, floorType=floor_types, level=levels)
end_2 = Revit.Transaction.Transaction.End(input=byOutlineTypeAndLevel_3)
slabShapeByPoints_3 = Custom[Floor.SlabShapeByPoints](points=translate, floor=end_2, lacing=Longest)
area = Custom[Element.Area](element=slabShapeByPoints_3.floor)  # package Clockwork for Dynamo 2.x; Returns the area property of a given element (if that element has such a property)
byOutlineTypeAndLevel_4 = Floor.ByOutlineTypeAndLevel(outline=perimeterCurves_2, floorType=floor_types, level=levels)  # frozen
byPoints = PolyCurve.ByPoints()  # unwired: points
byJoinedCurves_2 = PolyCurve.ByJoinedCurves(curves=perimeterCurves_2)
