# Dynamo graph View_Override_Comments.dyn (Dynamo 2.13.1.3887)

categories = Categories("OST_Mass")
current = Document.Current()
activeView = Document.ActiveView(document=current)
all_elements_of_category_in_view = ElementsOfCategoryInView(Category=categories, View=activeView)
parameters = Element.Parameters(element=all_elements_of_category_in_view)
code_block = CodeBlock(A=parameters) { A[0][4]; }
name = Parameter.Name(parameter=code_block)
parameterByName = Parameter.ParameterByName(element=all_elements_of_category_in_view, name=name)
value = Parameter.Value(parameter=parameterByName)
comment_filter = StringInput("PHASE II")  # graph input
eq = value == comment_filter
filterByBoolMask = List.FilterByBoolMask(list=all_elements_of_category_in_view, mask=eq)
line_patterns = LinePatterns("Dash")  # graph input
line_weight = IntegerSlider(8, range=0..15 step 1)  # graph input
TRANSPARENCY = IntegerSlider(75, range=0..100 step 1)  # graph input
byProperties = Revit.Filter.OverrideGraphicSettings.ByProperties(cutLinePattern=line_patterns, projectionLinePattern=line_patterns, cutLineWeight=line_weight, projectionLineWeight=line_weight, transparency=TRANSPARENCY)
overrideInView = Element.OverrideInView(element=filterByBoolMask.in, overrides=byProperties)
