# Dynamo graph Window CW Cutouts.dyn (Dynamo 2.12.0.5650)
# packages: Clockwork for Dynamo 2.x 2.3.0

windows_to_cut = DSModelElementsByCategorySelection("2b5a67a5-7e54-444f-915a-716a4cda42f3-002b1c96,2b5a67a5-7e54-444f-915a-716a4cda42f3-002b1d38,2b5a67a5-7e54-444f-915a-716a4cda42f3-002b1d43,2b5a67a5-7e54-444f-915a-716a4cda42f3-002b1d4e,2b5a67a5-7e54-444f-915a-716a4cda42f3-002b1d64,2b5a67a5-7e54-444f-915a-716a4cda42f3-002b1de1,2b5a67a5-7e54-444f-915a-716a4cda42f3-002b1f9c,2b5a67a5-7e54-444f-915a-716a4cda42f3-002b1fa0,2b5a67a5-7e54-444f-915a-716a4cda42f3-002b1fa2,2b5a67a5-7e54-444f-915a-716a4cda42f3-002b1fa4,2b5a67a5-7e54-444f-915a-716a4cda42f3-002b1fa8,2b5a67a5-7e54-444f-915a-716a4cda42f3-002b1faa,2b5a67a5-7e54-444f-915a-716a4cda42f3-002b1fba,2b5a67a5-7e54-444f-915a-716a4cda42f3-002b1fbe,2b5a67a5-7e54-444f-915a-716a4cda42f3-002b1fc0,2b5a67a5-7e54-444f-915a-716a4cda42f3-002b1fc2,2b5a67a5-7e54-444f-915a-716a4cda42f3-002b1fc6,2b5a67a5-7e54-444f-915a-716a4cda42f3-002b1fc8,2b5a67a5-7e54-444f-915a-716a4cda42f3-002b1fd8,2b5a67a5-7e54-444f-915a-716a4cda42f3-002b1fdc,2b5a67a5-7e54-444f-915a-716a4cda42f3-002b1fde,2b5a67a5-7e54-444f-915a-716a4cda42f3-002b1fe0,2b5a67a5-7e54-444f-915a-716a4cda42f3-002b1fe4,2b5a67a5-7e54-444f-915a-716a4cda42f3-002b1fe6,2b5a67a5-7e54-444f-915a-716a4cda42f3-002b20b4,2b5a67a5-7e54-444f-915a-716a4cda42f3-002b20b8,2b5a67a5-7e54-444f-915a-716a4cda42f3-002b20ba,2b5a67a5-7e54-444f-915a-716a4cda42f3-002b20bc,2b5a67a5-7e54-444f-915a-716a4cda42f3-002b20c0,2b5a67a5-7e54-444f-915a-716a4cda42f3-002b20c2")  # 30 picked in the model; graph input
categories = Categories("OST_CurtainWallPanels")
getIntersectingElementsOfCategory = Element.GetIntersectingElementsOfCategory(element=windows_to_cut, category=categories)
asFamilyInstance = CurtainPanel.AsFamilyInstance(curtainPanel=getIntersectingElementsOfCategory)
family_types = FamilyTypes("Empty Panel:Empty Panel")
setType = Custom[FamilyInstance.SetType](familyInstance=asFamilyInstance, familyType=family_types)  # package Clockwork for Dynamo 2.x; Changes the family type of a given family instance to the specified type
