# Dynamo graph DynamicCladding.dyn (Dynamo 2.12.0.5650)
# packages: Clockwork for Dynamo 2.x 2.3.0

# group: freeze/unfreeze to use each tool; one at a time
curtain_wall_to_panelize = DSModelElementByCategorySelection(index=686)  # 1 picked in the model
windows_to_cut_from_cw = DSModelElementsByCategorySelection(index=703)  # 48 picked in the model; frozen
accent_panel_selection = DSModelElementsByCategorySelection(index=168)  # 71 picked in the model; frozen

byElement = CurtainPanel.ByElement(hostingElement=curtain_wall_to_panelize)
asFamilyInstance = CurtainPanel.AsFamilyInstance(curtainPanel=byElement)
name = Element.Name(element=asFamilyInstance)
code_block = CodeBlock { "Empty Panel"; }
eq = name == code_block
filterByBoolMask = List.FilterByBoolMask(list=asFamilyInstance, mask=eq)
empty_panels = Watch(filterByBoolMask.out)

# group: claddingPanels
family_types = FamilyTypes("BR1:BR1")
family_types_2 = FamilyTypes("BR2:BR2")
family_types_3 = FamilyTypes("BR3:BR3")
family_types_4 = FamilyTypes("BR4:BR4")

list_create = List.Create(item0=family_types, item1=family_types_2, item2=family_types_3, item3=family_types_4)

# group: randomize family types
count = List.Count(list=byElement)
cycle = List.Cycle(list=list_create, amount=count)
integer_slider = IntegerSlider(32, range=0..100 step 1)
shuffle = List.Shuffle(list=cycle, seed=integer_slider)

takeItems = List.TakeItems(list=shuffle, amount=count)
setType = Custom[FamilyInstance.SetType](familyInstance=empty_panels, familyType=takeItems)  # package Clockwork for Dynamo 2.x; Changes the family type of a given family instance to the specified type
empty_panels_2 = Watch(filterByBoolMask.in)
categories = Categories("OST_CurtainWallPanels")
getIntersectingElementsOfCategory = Element.GetIntersectingElementsOfCategory(element=windows_to_cut_from_cw, category=categories)
empty_panels_3 = Watch(getIntersectingElementsOfCategory)
asFamilyInstance_2 = CurtainPanel.AsFamilyInstance(curtainPanel=empty_panels_3)
family_types_5 = FamilyTypes("Empty Panel:Empty Panel")
setType_2 = Custom[FamilyInstance.SetType](familyInstance=asFamilyInstance_2, familyType=family_types_5)
asFamilyInstance_3 = CurtainPanel.AsFamilyInstance(curtainPanel=accent_panel_selection)
family_types_6 = FamilyTypes()  # nothing selected
setType_3 = Custom[FamilyInstance.SetType](familyInstance=asFamilyInstance_3, familyType=family_types_6)
