# Dynamo graph 01_Point Lists.dyn "Point Lists" (Dynamo 2.3.0.5885)

code_block = CodeBlock { 0..10; }
byCoordinates = Point.ByCoordinates(x=code_block, y=code_block, lacing=CrossProduct)
watch = Watch(byCoordinates)
code_block_2 = CodeBlock(pointslists=watch) { pointslists[1][1]; }
