# Dynamo graph List_of_points.dyn (Dynamo 2.3.0.5885)

code_block = CodeBlock { 2; }
sequence = Sequence(step=code_block)
byCoordinates = Point.ByCoordinates(x=sequence, y=sequence, lacing=CrossProduct)
