# Dynamo graph Lacing 01.dyn (Dynamo 2.3.0.5885)

code_block = CodeBlock { 0..5; }
byCoordinates = Point.ByCoordinates(x=code_block, lacing=CrossProduct)
code_block_2 = CodeBlock { 0..10; }
code_block_3 = CodeBlock { 10; }
byCoordinates_2 = Point.ByCoordinates(x=code_block_2, y=code_block_3, lacing=CrossProduct)

# group: Lacing: Shortest
byStartPointEndPoint = Line.ByStartPointEndPoint(startPoint=byCoordinates, endPoint=byCoordinates_2, lacing=Shortest)
watch_3d = Watch3D(byStartPointEndPoint)

# group: Lacing: Longest
byStartPointEndPoint_2 = Line.ByStartPointEndPoint(startPoint=byCoordinates, endPoint=byCoordinates_2, lacing=Longest)
watch_3d_2 = Watch3D(byStartPointEndPoint_2)

# group: Lacing: Cross Product
byStartPointEndPoint_3 = Line.ByStartPointEndPoint(startPoint=byCoordinates, endPoint=byCoordinates_2, lacing=CrossProduct)
watch_3d_3 = Watch3D(byStartPointEndPoint_3)
