# Dynamo graph Lacing.dyn (Dynamo 2.3.0.5885)

# group: Cros-Product
sequence = Sequence()
byCoordinates = Point.ByCoordinates(x=sequence)
code_block = CodeBlock { 5; }
sequence_2 = Sequence(amount=code_block)
code_block_2 = CodeBlock { 5; }
byCoordinates_2 = Point.ByCoordinates(x=sequence_2, y=code_block_2)
byStartPointEndPoint = Line.ByStartPointEndPoint(startPoint=byCoordinates, endPoint=byCoordinates_2, lacing=CrossProduct)

# group: Longest
sequence_3 = Sequence()
code_block_3 = CodeBlock { 12; }
byCoordinates_3 = Point.ByCoordinates(x=sequence_3, y=code_block_3)
code_block_4 = CodeBlock { 5; }
sequence_4 = Sequence(amount=code_block_4)
code_block_5 = CodeBlock { 17; }
byCoordinates_4 = Point.ByCoordinates(x=sequence_4, y=code_block_5)
byStartPointEndPoint_2 = Line.ByStartPointEndPoint(startPoint=byCoordinates_3, endPoint=byCoordinates_4, lacing=Longest)

# group: Shortest
sequence_5 = Sequence()
code_block_6 = CodeBlock { 19; }
byCoordinates_5 = Point.ByCoordinates(x=sequence_5, y=code_block_6)
code_block_7 = CodeBlock { 5; }
sequence_6 = Sequence(amount=code_block_7)
code_block_8 = CodeBlock { 24; }
byCoordinates_6 = Point.ByCoordinates(x=sequence_6, y=code_block_8)
byStartPointEndPoint_3 = Line.ByStartPointEndPoint(startPoint=byCoordinates_5, endPoint=byCoordinates_6, lacing=Shortest)
