# Dynamo graph Points Square Lacing.dyn (Dynamo 2.3.0.5885)

sequence = Sequence()
code_block = CodeBlock { 5; }
sequence_2 = Sequence(amount=code_block)
byCoordinates = Point.ByCoordinates(x=sequence, y=sequence_2, lacing=CrossProduct)
