# Dynamo graph Adaptive End.dyn (Dynamo 2.3.0.5885)
# packages: archi-lab.net 2020.23.2

select_edges = SelectEdges()  # 6 picked in the model
group_curves = Custom[Group Curves](curves=select_edges)  # package archi-lab.net; This node will take any input of flat list of curves and group them into sublists containing "joinable" curves that is continous curves. They might form closed curves or open curves. Use PolyCurve.ByJoinedCurves to convert output groups of curves into single PolyCurves
code_block = CodeBlock(a=group_curves) { a[0]; a[1]; }
byJoinedCurves = PolyCurve.ByJoinedCurves(curves=code_block.out0)
integer_slider = IntegerSlider(30, range=3..30 step 1)
code_block_2 = CodeBlock(count=integer_slider) { 0..1..#count; }
pointAtParameter = Curve.PointAtParameter(curve=byJoinedCurves, param=code_block_2)
byJoinedCurves_2 = PolyCurve.ByJoinedCurves(curves=code_block.out1)
reverse = Curve.Reverse(curve=byJoinedCurves_2)
pointAtParameter_2 = Curve.PointAtParameter(curve=reverse, param=code_block_2)
code_block_3 = CodeBlock(count=integer_slider) { 2100..4500..#count; }
translate = Geometry.Translate(geometry=pointAtParameter, zTranslation=code_block_3)
translate_2 = Geometry.Translate(geometry=pointAtParameter_2, zTranslation=code_block_3)
list_create = List.Create(item0=pointAtParameter, item1=pointAtParameter_2, item2=translate, item3=translate_2)
transpose = List.Transpose(lists=list_create)
family_types = FamilyTypes("Adaptive component:Adaptive component")
byPoints = AdaptiveComponent.ByPoints(points=transpose, familyType=family_types)
code_block_4 = CodeBlock { "Number"; }
code_block_5 = CodeBlock(count=integer_slider) { 3..#count..1; }
setParameterByName = Element.SetParameterByName(element=byPoints, parameterName=code_block_4, value=code_block_5)
