# Dynamo graph Adaptive Panels.dyn (Dynamo 2.3.0.5885)
# packages: LunchBox for Dynamo 2018.7.6

code_block = CodeBlock { 10; }
panelTriangleC = Geometry.Panel.PanelTriangleC(u=code_block, v=code_block)  # unwired: srf
panelTriangleB = Geometry.Panel.PanelTriangleB()  # unwired: srf, u, v
panelTriangleA = Geometry.Panel.PanelTriangleA(u=code_block, v=code_block)  # unwired: srf
select_face = DSFaceSelection()  # 1 picked in the model
panelQuad = Geometry.Panel.PanelQuad(srf=select_face, u=code_block, v=code_block)
family_types = FamilyTypes("4pt Adaptive:4pt Adaptive")
byPoints = AdaptiveComponent.ByPoints(points=panelQuad.Points, familyType=family_types)
