# Dynamo graph Adaptive Panels_1.dyn (Dynamo 2.3.0.5885)
# packages: LunchBox for Dynamo 2018.7.6

code_block = CodeBlock { 10; }
panelTriangleC = Geometry.Panel.PanelTriangleC(u=code_block, v=code_block)  # unwired: srf
panelTriangleB = Geometry.Panel.PanelTriangleB()  # unwired: srf, u, v
panelTriangleA = Geometry.Panel.PanelTriangleA(u=code_block, v=code_block)  # unwired: srf
select_face = DSFaceSelection()  # 1 picked in the model
code_block_2 = CodeBlock { 0.01..0.99..#10; }
byIsoCurveOnSurface = Curve.ByIsoCurveOnSurface(baseSurface=select_face, parameter=code_block_2, lacing=Longest)
perimeterCurves = Surface.PerimeterCurves(surface=select_face)
intersect = Geometry.Intersect(geometry=perimeterCurves, other=byIsoCurveOnSurface, lacing=CrossProduct)
parameterAtPoint = Curve.ParameterAtPoint(curve=byIsoCurveOnSurface, point=intersect@L3, lacing=Longest)
code_block_3 = CodeBlock { 0; }
getItemAtIndex = List.GetItemAtIndex(list=parameterAtPoint@L3, index=code_block_3)
code_block_4 = CodeBlock { 1; }
getItemAtIndex_2 = List.GetItemAtIndex(list=parameterAtPoint@L3, index=code_block_4)
trimByParameter = Curve.TrimByParameter(curve=byIsoCurveOnSurface, startParameter=getItemAtIndex, endParameter=getItemAtIndex_2)
flatten = List.Flatten(list=trimByParameter)
byLoft = Surface.ByLoft(crossSections=flatten)
panelQuad = Geometry.Panel.PanelQuad(srf=byLoft, u=code_block, v=code_block)
family_types = FamilyTypes("4pt Adaptive:4pt Adaptive")
byPoints = AdaptiveComponent.ByPoints(points=panelQuad.Points, familyType=family_types)
