# Dynamo graph Arrange views on sheets.dyn (Dynamo 2.3.0.5885)
# packages: Orchid 230.0.0.7288, archi-lab.net 2020.23.2, SteamNodes 1.2.3

sheet_views = SheetView("Sheet")
viewports = archilab.Revit.Views.Sheets.Viewports(sheet=sheet_views)
viewPortBoxCenter = Custom[View.ViewPortBoxCenter](Viewports=viewports)  # package SteamNodes; Get ViewPort Box center point
all = Orchid.RevitProject.Views.Sheet.All()
code_block = CodeBlock { "Sheet Number"; }
getParameterValueByName = Element.GetParameterValueByName(element=all, parameterName=code_block)
getParameterValueByName_2 = Element.GetParameterValueByName(element=sheet_views, parameterName=code_block)
indexOf = List.IndexOf(list=getParameterValueByName, element=getParameterValueByName_2)
removeItemAtIndex = List.RemoveItemAtIndex(list=all, indices=indexOf)
viewports_2 = archilab.Revit.Views.Sheets.Viewports(sheet=removeItemAtIndex)
boolean = BoolSelector(false)
clean = List.Clean(list=viewports_2, preserveIndices=boolean)
setBoxCenter = Custom[Viewport.SetBoxCenter](point=viewPortBoxCenter@L2, viewport=clean@L2, lacing=Longest)  # package SteamNodes; API class
