# Dynamo graph Beam By Curves 02.dyn (Dynamo 2.3.0.5885)

integer_slider = IntegerSlider(57, range=3..100 step 1)
code_block = CodeBlock(amount=integer_slider) { 0..10000..#amount; }
byCoordinates = Point.ByCoordinates(x=code_block, y=code_block, lacing=CrossProduct)
code_block_2 = CodeBlock(amount=integer_slider) { 0..360..#amount; }
integer_slider_2 = IntegerSlider(2, range=1..10 step 1)
code_block_3 = CodeBlock(value=code_block_2, definition=integer_slider_2) { value*definition; }
sin = Math.Sin(angle=code_block_3)
integer_slider_3 = IntegerSlider(1000, range=0..1000 step 1)
code_block_4 = CodeBlock(value=sin, scale=integer_slider_3) { value*scale; }
code_block_5 = CodeBlock(sinvalues=code_block_4, amount=integer_slider) { 0..sinvalues..#amount; }
transpose = List.Transpose(lists=code_block_5)
add = code_block_5 + transpose
translate = Geometry.Translate(geometry=byCoordinates, zTranslation=add)
byPoints = NurbsSurface.ByPoints(points=translate)
code_block_6 = CodeBlock { [0,1]; }
integer_slider_4 = IntegerSlider(9, range=0..100 step 1)
code_block_7 = CodeBlock(count=integer_slider_4) { 0..1..#count; }
getIsoline = Surface.GetIsoline(surface=byPoints, isoDirection=code_block_6, parameter=code_block_7, lacing=CrossProduct)
levels = Levels("Level 0")
structural_framing_types = StructuralFramingTypes("UB305x165x40")
structural_framing_types_2 = StructuralFramingTypes("Top")
list_create = List.Create(item0=structural_framing_types, item1=structural_framing_types_2)
beamByCurve = StructuralFraming.BeamByCurve(curve=getIsoline, level=levels, structuralFramingType=list_create)
code_block_8 = CodeBlock { 0.5; }
