# Dynamo graph Beam by Curve.dyn (Dynamo 2.3.0.5885)

code_block = CodeBlock { 10000; }
byCoordinates = Point.ByCoordinates(z=code_block)
byCoordinates_2 = Point.ByCoordinates()
byCenterPointRadius = Circle.ByCenterPointRadius(centerPoint=byCoordinates_2, radius=code_block)
number_slider = DoubleSlider(30, range=3..50 step 1)
code_block_2 = CodeBlock(b=number_slider) { 0..1..#b; }
pointAtParameter = Curve.PointAtParameter(curve=byCenterPointRadius, param=code_block_2)
byStartPointEndPoint = Line.ByStartPointEndPoint(startPoint=byCoordinates, endPoint=pointAtParameter)
number_slider_2 = DoubleSlider(-3700, range=-5000..0 step 100)
extendStart = Curve.ExtendStart(curve=byStartPointEndPoint, distance=number_slider_2)
levels = Levels("Level 0")
structural_framing_types = StructuralFramingTypes("UB305x165x40")
beamByCurve = StructuralFraming.BeamByCurve(curve=extendStart, level=levels, structuralFramingType=structural_framing_types)
startPoint = Curve.StartPoint(curve=extendStart)
byBestFitThroughPoints = Circle.ByBestFitThroughPoints(points=startPoint)
code_block_3 = CodeBlock { 0.5; }
splitByParameter = Curve.SplitByParameter(curve=byBestFitThroughPoints, parameters=code_block_3)
levels_2 = Levels("Level 1")
structural_framing_types_2 = StructuralFramingTypes("Top")
beamByCurve_2 = StructuralFraming.BeamByCurve(curve=splitByParameter, level=levels_2, structuralFramingType=structural_framing_types_2)
