# Dynamo graph Beam by Curve_start.dyn (Dynamo 2.3.0.5885)

byCoordinates = Point.ByCoordinates()
code_block = CodeBlock { 10000; }
byCenterPointRadius = Circle.ByCenterPointRadius(centerPoint=byCoordinates, radius=code_block)
