# Dynamo graph ChessBoard Geometry.dyn (Dynamo 2.3.0.5885)

integer_slider = IntegerSlider(13, range=0..100 step 1)
integer_slider_2 = IntegerSlider(20, range=0..100 step 1)
sequence = Sequence(amount=integer_slider, step=integer_slider_2)
byCoordinates = Point.ByCoordinates(x=sequence, y=sequence, lacing=CrossProduct)
byOriginNormal = Plane.ByOriginNormal(origin=byCoordinates)
byWidthLength = Rectangle.ByWidthLength(plane=byOriginNormal, width=integer_slider_2, length=integer_slider_2)
byPatch = Surface.ByPatch(closedCurve=byWidthLength)
code_block = CodeBlock { 2; }
takeEveryNthItem = List.TakeEveryNthItem(list=byPatch, n=code_block)
takeEveryNthItem_2 = List.TakeEveryNthItem(list=takeEveryNthItem@L2, n=code_block)
code_block_2 = CodeBlock { -1; }
takeEveryNthItem_3 = List.TakeEveryNthItem(list=byPatch, n=code_block, offset=code_block_2)
takeEveryNthItem_4 = List.TakeEveryNthItem(list=takeEveryNthItem_3@L2, n=code_block, offset=code_block_2)
list_create = List.Create(item0=takeEveryNthItem_2, item1=takeEveryNthItem_4)
color_palette = ColorPalette({R: 255, G: 218, B: 185, A: 255})
byGeometryColor = Modifiers.GeometryColor.ByGeometryColor(geometry=list_create, color=color_palette)
takeEveryNthItem_5 = List.TakeEveryNthItem(list=takeEveryNthItem_3@L2, n=code_block)
takeEveryNthItem_6 = List.TakeEveryNthItem(list=takeEveryNthItem@L2, n=code_block, offset=code_block_2)
list_create_2 = List.Create(item0=takeEveryNthItem_5, item1=takeEveryNthItem_6)
color_palette_2 = ColorPalette({R: 165, G: 42, B: 42, A: 255})
byGeometryColor_2 = Modifiers.GeometryColor.ByGeometryColor(geometry=list_create_2, color=color_palette_2)
code_block_3 = CodeBlock { 7; }
code_block_4 = CodeBlock { 10; }
byCenterPointRadius = Circle.ByCenterPointRadius(radius=code_block_4)
byCoordinates_2 = Point.ByCoordinates(z=code_block_4)
number_slider = DoubleSlider(2, range=1..10 step 0.1)
byCenterPointRadius_2 = Circle.ByCenterPointRadius(centerPoint=byCoordinates_2, radius=number_slider)
code_block_5 = CodeBlock { 15; }
byCoordinates_3 = Point.ByCoordinates(z=code_block_5)
code_block_6 = CodeBlock { 8; }
byCenterPointRadius_3 = Circle.ByCenterPointRadius(centerPoint=byCoordinates_3, radius=code_block_6)
list_create_3 = List.Create(item0=byCenterPointRadius, item1=byCenterPointRadius_2, item2=byCenterPointRadius_3)

# group: Loft And FIllet
byLoft = Solid.ByLoft(crossSections=list_create_3)
edges = Topology.Edges(topology=byLoft)
number_slider_2 = DoubleSlider(2.6, range=1..10 step 0.1)
fillet = Solid.Fillet(solid=byLoft, edges=edges, radius=number_slider_2)

byOrigin = CoordinateSystem.ByOrigin()
code_block_7 = CodeBlock { 1; }
getItemAtIndex = List.GetItemAtIndex(list=byCoordinates@L2, index=code_block_7)
byOrigin_2 = CoordinateSystem.ByOrigin(origin=getItemAtIndex)
transform = Geometry.Transform(geometry=fillet, fromCoordinateSystem=byOrigin, contextCoordinateSystem=byOrigin_2)
byOrigin_3 = CoordinateSystem.ByOrigin()
code_block_8 = CodeBlock(count=integer_slider) { count -2; }
code_block_9 = CodeBlock { 1; }
list_create_4 = List.Create(item0=code_block_8, item1=code_block_9)
getItemAtIndex_2 = List.GetItemAtIndex(list=byCoordinates@L2, index=list_create_4)
byOrigin_4 = CoordinateSystem.ByOrigin(origin=getItemAtIndex_2)
transform_2 = Geometry.Transform(geometry=fillet, fromCoordinateSystem=byOrigin_3, contextCoordinateSystem=byOrigin_4)
transpose = List.Transpose(lists=transform_2)
