# Dynamo graph ChessBoard03.dyn (Dynamo 2.3.0.5885)

integer_slider = IntegerSlider(8, range=0..100 step 1)
integer_slider_2 = IntegerSlider(20, range=0..100 step 1)
sequence = Sequence(amount=integer_slider, step=integer_slider_2)
byCoordinates = Point.ByCoordinates(x=sequence, y=sequence, lacing=CrossProduct)
byOriginNormal = Plane.ByOriginNormal(origin=byCoordinates)
byWidthLength = Rectangle.ByWidthLength(plane=byOriginNormal, width=integer_slider_2, length=integer_slider_2)
byPatch = Surface.ByPatch(closedCurve=byWidthLength)
code_block = CodeBlock { 2; }
takeEveryNthItem = List.TakeEveryNthItem(list=byPatch, n=code_block)
takeEveryNthItem_2 = List.TakeEveryNthItem(list=takeEveryNthItem@L2, n=code_block)
code_block_2 = CodeBlock { -1; }
takeEveryNthItem_3 = List.TakeEveryNthItem(list=byPatch, n=code_block, offset=code_block_2)
takeEveryNthItem_4 = List.TakeEveryNthItem(list=takeEveryNthItem_3@L2, n=code_block, offset=code_block_2)
list_create = List.Create(item0=takeEveryNthItem_2, item1=takeEveryNthItem_4)
color_palette = ColorPalette({R: 255, G: 218, B: 185, A: 255})
byGeometryColor = Modifiers.GeometryColor.ByGeometryColor(geometry=list_create, color=color_palette)
takeEveryNthItem_5 = List.TakeEveryNthItem(list=takeEveryNthItem_3@L2, n=code_block)
takeEveryNthItem_6 = List.TakeEveryNthItem(list=takeEveryNthItem@L2, n=code_block, offset=code_block_2)
list_create_2 = List.Create(item0=takeEveryNthItem_5, item1=takeEveryNthItem_6)
color_palette_2 = ColorPalette({R: 165, G: 42, B: 42, A: 255})
byGeometryColor_2 = Modifiers.GeometryColor.ByGeometryColor(geometry=list_create_2, color=color_palette_2)
