# Dynamo graph ChessBoard02.dyn (Dynamo 2.3.0.5885)

integer_slider = IntegerSlider(8, range=0..100 step 1)
integer_slider_2 = IntegerSlider(20, range=0..100 step 1)
sequence = Sequence(amount=integer_slider, step=integer_slider_2)
byCoordinates = Point.ByCoordinates(x=sequence, y=sequence, lacing=CrossProduct)
byOriginNormal = Plane.ByOriginNormal(origin=byCoordinates)
byWidthLength = Rectangle.ByWidthLength(plane=byOriginNormal, width=integer_slider_2, length=integer_slider_2)
byPatch = Surface.ByPatch(closedCurve=byWidthLength)
code_block = CodeBlock { 2; }
takeEveryNthItem = List.TakeEveryNthItem(list=byPatch, n=code_block)
takeEveryNthItem_2 = List.TakeEveryNthItem(list=takeEveryNthItem@L2, n=code_block)
code_block_2 = CodeBlock { -1; }
takeEveryNthItem_3 = List.TakeEveryNthItem(list=byPatch, n=code_block, offset=code_block_2)
takeEveryNthItem_4 = List.TakeEveryNthItem(list=takeEveryNthItem_3@L2, n=code_block, offset=code_block_2)
list_create = List.Create(item0=takeEveryNthItem_2, item1=takeEveryNthItem_4)
color_palette = ColorPalette({R: 255, G: 218, B: 185, A: 255})
byGeometryColor = Modifiers.GeometryColor.ByGeometryColor(geometry=list_create, color=color_palette)
takeEveryNthItem_5 = List.TakeEveryNthItem(list=takeEveryNthItem_3@L2, n=code_block)
takeEveryNthItem_6 = List.TakeEveryNthItem(list=takeEveryNthItem@L2, n=code_block, offset=code_block_2)
list_create_2 = List.Create(item0=takeEveryNthItem_5, item1=takeEveryNthItem_6)
color_palette_2 = ColorPalette({R: 165, G: 42, B: 42, A: 255})
byGeometryColor_2 = Modifiers.GeometryColor.ByGeometryColor(geometry=list_create_2, color=color_palette_2)
integer_slider_3 = IntegerSlider(8, range=0..100 step 1)
integer_slider_4 = IntegerSlider(20, range=0..100 step 1)
sequence_2 = Sequence(amount=integer_slider_3, step=integer_slider_4)
code_block_3 = CodeBlock(c=sequence_2, x=integer_slider_3, y=integer_slider_4) { c +(x*y + 50); }
byCoordinates_2 = Point.ByCoordinates(x=sequence_2, y=code_block_3, lacing=CrossProduct)
byOriginNormal_2 = Plane.ByOriginNormal(origin=byCoordinates_2)
byWidthLength_2 = Rectangle.ByWidthLength(plane=byOriginNormal_2, width=integer_slider_4, length=integer_slider_4)
byPatch_2 = Surface.ByPatch(closedCurve=byWidthLength_2)
code_block_4 = CodeBlock { 2; }
takeEveryNthItem_7 = List.TakeEveryNthItem(list=byPatch_2, n=code_block_4)
color_palette_3 = ColorPalette({R: 255, G: 218, B: 185, A: 255})
byGeometryColor_3 = Modifiers.GeometryColor.ByGeometryColor(geometry=takeEveryNthItem_7, color=color_palette_3)
code_block_5 = CodeBlock { -1; }
takeEveryNthItem_8 = List.TakeEveryNthItem(list=byPatch_2, n=code_block_4, offset=code_block_5)
color_palette_4 = ColorPalette({R: 165, G: 42, B: 42, A: 255})
byGeometryColor_4 = Modifiers.GeometryColor.ByGeometryColor(geometry=takeEveryNthItem_8, color=color_palette_4)
integer_slider_5 = IntegerSlider(8, range=0..100 step 1)
integer_slider_6 = IntegerSlider(20, range=0..100 step 1)
sequence_3 = Sequence(amount=integer_slider_5, step=integer_slider_6)
code_block_6 = CodeBlock(c=sequence_3, x=integer_slider_5, y=integer_slider_6) { c +2*(x*y + 50); }
byCoordinates_3 = Point.ByCoordinates(x=sequence_3, y=code_block_6, lacing=CrossProduct)
byOriginNormal_3 = Plane.ByOriginNormal(origin=byCoordinates_3)
byWidthLength_3 = Rectangle.ByWidthLength(plane=byOriginNormal_3, width=integer_slider_6, length=integer_slider_6)
byPatch_3 = Surface.ByPatch(closedCurve=byWidthLength_3)
code_block_7 = CodeBlock { 2; }
takeEveryNthItem_9 = List.TakeEveryNthItem(list=byPatch_3, n=code_block_7)
takeEveryNthItem_10 = List.TakeEveryNthItem(list=takeEveryNthItem_9@L2, n=code_block_7)
color_palette_5 = ColorPalette({R: 255, G: 218, B: 185, A: 255})
byGeometryColor_5 = Modifiers.GeometryColor.ByGeometryColor(geometry=takeEveryNthItem_10, color=color_palette_5)
code_block_8 = CodeBlock { -1; }
takeEveryNthItem_11 = List.TakeEveryNthItem(list=byPatch_3, n=code_block_7, offset=code_block_8)
takeEveryNthItem_12 = List.TakeEveryNthItem(list=takeEveryNthItem_11@L2, n=code_block_7)
color_palette_6 = ColorPalette({R: 160, G: 82, B: 45, A: 255})
byGeometryColor_6 = Modifiers.GeometryColor.ByGeometryColor(geometry=takeEveryNthItem_12, color=color_palette_6)
takeEveryNthItem_13 = List.TakeEveryNthItem(list=takeEveryNthItem_11@L2, n=code_block_7, offset=code_block_8)
color_palette_7 = ColorPalette({R: 233, G: 150, B: 122, A: 255})
byGeometryColor_7 = Modifiers.GeometryColor.ByGeometryColor(geometry=takeEveryNthItem_13, color=color_palette_7)
takeEveryNthItem_14 = List.TakeEveryNthItem(list=takeEveryNthItem_9@L2, n=code_block_7, offset=code_block_8)
color_palette_8 = ColorPalette({R: 165, G: 42, B: 42, A: 255})
byGeometryColor_8 = Modifiers.GeometryColor.ByGeometryColor(geometry=takeEveryNthItem_14, color=color_palette_8)
