# Dynamo graph FamilyInstanceByPoint.dyn (Dynamo 2.3.0.5885)

byPoint = FamilyInstance.ByPoint()  # unwired: familyType, point
byCoordinates = FamilyInstance.ByCoordinates()  # unwired: familyType
integer_slider = IntegerSlider(4740, range=0..10000 step 10)
family_types = FamilyTypes("Planting_RPC_Tree_Deciduous:American_Beech-6.0_Meters")
code_block = CodeBlock { 0..10000..#6; }
byCoordinates_2 = Point.ByCoordinates(x=code_block)
levels = Levels("Level 1")
byPointAndLevel = FamilyInstance.ByPointAndLevel(familyType=family_types, point=byCoordinates_2, level=levels)
count = List.Count(list=byPointAndLevel)
randomList = Math.RandomList(amount=count)
code_block_2 = CodeBlock { 0; 180; }
remapRange = Math.RemapRange(numbers=randomList, newMin=code_block_2.out0, newMax=code_block_2.out1)
setRotation = FamilyInstance.SetRotation(familyInstance=byPointAndLevel, degree=remapRange)
