# Dynamo graph Levels and Floors from external.dyn (Dynamo 2.3.0.5885)
# packages: archi-lab.net 2020.23.2, spring nodes 203.1.0

select_model_element = DSModelElementSelection()  # 1 picked in the model
geometry = Element.Geometry(element=select_model_element)
group_curves = Custom[Group Curves](curves=geometry)  # package archi-lab.net; This node will take any input of flat list of curves and group them into sublists containing "joinable" curves that is continous curves. They might form closed curves or open curves. Use PolyCurve.ByJoinedCurves to convert output groups of curves into single PolyCurves
byJoinedCurves = PolyCurve.ByJoinedCurves(curves=group_curves)
code_block = CodeBlock { 5; }

# group: Base Curve
getItemAtIndex = List.GetItemAtIndex(list=byJoinedCurves, index=code_block)

# group: Curves To Be moved
removeItemAtIndex = List.RemoveItemAtIndex(list=byJoinedCurves, indices=code_block)

ꟿ_polycurve_points = Custom[ꟿ PolyCurve.Points](polyCurve=removeItemAtIndex)  # package spring nodes; Gets all the unique start and end points of the underlying curves in a sorted list.
code_block_2 = CodeBlock { 2; }
getItemAtIndex_2 = List.GetItemAtIndex(list=ꟿ_polycurve_points@L2, index=code_block_2)
ꟿ_polycurve_points_2 = Custom[ꟿ PolyCurve.Points](polyCurve=getItemAtIndex)
code_block_3 = CodeBlock { 3; }
getItemAtIndex_3 = List.GetItemAtIndex(list=ꟿ_polycurve_points_2, index=code_block_3)
byTwoPoints = Vector.ByTwoPoints(start=getItemAtIndex_2, end=getItemAtIndex_3)
translate = Geometry.Translate(geometry=removeItemAtIndex, direction=byTwoPoints)
addItemToFront = List.AddItemToFront(item=getItemAtIndex, list=translate)
reverse = List.Reverse(list=addItemToFront)
code_block_4 = CodeBlock { 200; }
fillet_Polycurve_Custom = Custom[Fillet_Polycurve_Custom](polyCurve=reverse, radius=code_block_4)  # A node that checks the fillet direction
floor_types = FloorTypes("Standard")
file_path = Filename("..\Get extermal data\Floors\Floors.xlsx")
file_from_path = FileObject(path=file_path)
string = StringInput("Sheet1")
importExcel = Data.ImportExcel(file=file_from_path, sheetName=string)

# group: Alternative 2
code_block_5 = CodeBlock { 1; }
getItemAtIndex_4 = List.GetItemAtIndex(list=importExcel@L2, index=code_block_5)
code_block_6 = CodeBlock { 0; }
getItemAtIndex_5 = List.GetItemAtIndex(list=importExcel@L2, index=code_block_6)

byElevationAndName = Level.ByElevationAndName(elevation=getItemAtIndex_4, name=getItemAtIndex_5)
byOutlineTypeAndLevel = Floor.ByOutlineTypeAndLevel(outline=fillet_Polycurve_Custom, floorType=floor_types, level=byElevationAndName)
code_block_7 = CodeBlock { "Height Offset From Level"; }
code_block_8 = CodeBlock { 0; }
setParameterByName = Element.SetParameterByName(element=byOutlineTypeAndLevel, parameterName=code_block_7, value=code_block_8)
