# Dynamo graph Geometry01.dyn (Dynamo 2.3.0.5885)

code_block = CodeBlock { 7; }
code_block_2 = CodeBlock { 10; }
byCenterPointRadius = Circle.ByCenterPointRadius(radius=code_block_2)
byCoordinates = Point.ByCoordinates(z=code_block_2)
number_slider = DoubleSlider(2, range=1..10 step 0.1)
byCenterPointRadius_2 = Circle.ByCenterPointRadius(centerPoint=byCoordinates, radius=number_slider)
code_block_3 = CodeBlock { 15; }
byCoordinates_2 = Point.ByCoordinates(z=code_block_3)
code_block_4 = CodeBlock { 8; }
byCenterPointRadius_3 = Circle.ByCenterPointRadius(centerPoint=byCoordinates_2, radius=code_block_4)
list_create = List.Create(item0=byCenterPointRadius, item1=byCenterPointRadius_2, item2=byCenterPointRadius_3)
byLoft = Solid.ByLoft(crossSections=list_create)
edges = Topology.Edges(topology=byLoft)
number_slider_2 = DoubleSlider(2.6, range=1..10 step 0.1)
fillet = Solid.Fillet(solid=byLoft, edges=edges, radius=number_slider_2)
edges_2 = Face.Edges()  # unwired: face
faces = Topology.Faces()  # unwired: topology
code_block_5 = CodeBlock { 2; }
bySweep = Solid.BySweep()  # unwired: profile, path
byRevolve = Solid.ByRevolve()  # unwired: profile
