# Dynamo graph Geometry02.dyn (Dynamo 2.3.0.5885)

code_block = CodeBlock { 7; }
code_block_2 = CodeBlock { 10; }
byCoordinates = Point.ByCoordinates(z=code_block_2)
number_slider = DoubleSlider(2, range=1..10 step 0.1)
byCenterPointRadius = Circle.ByCenterPointRadius(centerPoint=byCoordinates, radius=number_slider)

# group: Sweep
pointAtParameter = Curve.PointAtParameter(curve=byCenterPointRadius)
tangentAtParameter = Curve.TangentAtParameter(curve=byCenterPointRadius)
byCenterPointRadiusNormal = Circle.ByCenterPointRadiusNormal(centerPoint=pointAtParameter, normal=tangentAtParameter)
bySweep = Solid.BySweep(profile=byCenterPointRadiusNormal, path=byCenterPointRadius)

byCenterPointRadius_2 = Circle.ByCenterPointRadius(radius=code_block_2)
code_block_3 = CodeBlock { 15; }
byCoordinates_2 = Point.ByCoordinates(z=code_block_3)
code_block_4 = CodeBlock { 8; }
byCenterPointRadius_3 = Circle.ByCenterPointRadius(centerPoint=byCoordinates_2, radius=code_block_4)
list_create = List.Create(item0=byCenterPointRadius_2, item1=byCenterPointRadius, item2=byCenterPointRadius_3)

# group: Loft And FIllet
byLoft = Solid.ByLoft(crossSections=list_create)
edges = Topology.Edges(topology=byLoft)
number_slider_2 = DoubleSlider(2.6, range=1..10 step 0.1)
fillet = Solid.Fillet(solid=byLoft, edges=edges, radius=number_slider_2)

difference = Solid.Difference(solid=bySweep, other=fillet)
intersect = Geometry.Intersect(geometry=fillet, other=bySweep)
split = Geometry.Split(geometry=fillet, other=bySweep)
XAxis = Vector.XAxis()
code_block_5 = CodeBlock { 10; }
translate = Geometry.Translate(geometry=fillet, direction=XAxis, distance=code_block_5)
XAxis_2 = Vector.XAxis()
YAxis = Vector.YAxis()
ZAxis = Vector.ZAxis()
list_create_2 = List.Create(item0=XAxis_2, item1=YAxis, item2=ZAxis)
code_block_6 = CodeBlock { [10,18,39]; }
translate_2 = Geometry.Translate(geometry=fillet, direction=list_create_2, distance=code_block_6)
code_block_7 = CodeBlock { [10,18,39]; }
translate_3 = Geometry.Translate(geometry=fillet, xTranslation=code_block_7, yTranslation=code_block_7, lacing=CrossProduct)
code_block_8 = CodeBlock { 10; }
code_block_9 = CodeBlock { 10; }
