# Dynamo graph Floors From Excel.dyn (Dynamo 2.3.0.5885)

file_path = Filename(".\Floors.xlsx")
file_from_path = FileObject(path=file_path)
string = StringInput("Sheet1")
importExcel = Data.ImportExcel(file=file_from_path, sheetName=string)

# group: Alternative 2
code_block = CodeBlock { 1; }
getItemAtIndex = List.GetItemAtIndex(list=importExcel@L2, index=code_block)
code_block_2 = CodeBlock { 0; }
getItemAtIndex_2 = List.GetItemAtIndex(list=importExcel@L2, index=code_block_2)

byElevationAndName = Level.ByElevationAndName(elevation=getItemAtIndex, name=getItemAtIndex_2)

# group: Alterantive 3
transpose = List.Transpose(lists=importExcel)
code_block_3 = CodeBlock { 0; }
getItemAtIndex_3 = List.GetItemAtIndex(list=transpose, index=code_block_3)
code_block_4 = CodeBlock { 1; }
getItemAtIndex_4 = List.GetItemAtIndex(list=transpose, index=code_block_4)

# group: Alternative 1
code_block_5 = CodeBlock(list1=transpose) { list1[0]; list1[1]; }
