# Dynamo graph Levels from text file.dyn (Dynamo 2.3.0.5885)

file_path = Filename(".\Floors.txt")
file_from_path = FileObject(path=file_path)
readText = FileSystem.ReadText(file=file_from_path)
code_block = CodeBlock { "Floor"; }
code_block_2 = CodeBlock { "Level"; }
replace = String.Replace(str=readText, searchFor=code_block, replaceWith=code_block_2)
new_line_symbol = StringInput("\n")
tab_symbol = StringInput("	")
split = String.Split(str=replace, separator0=new_line_symbol, separator1=tab_symbol)

# group: Approach 1
code_block_3 = CodeBlock { 2; }
takeEveryNthItem = List.TakeEveryNthItem(list=split, n=code_block_3)
code_block_4 = CodeBlock { -1; }
takeEveryNthItem_2 = List.TakeEveryNthItem(list=split, n=code_block_3, offset=code_block_4)

toNumber = String.ToNumber(str=takeEveryNthItem)
byElevationAndName = Level.ByElevationAndName(elevation=toNumber, name=takeEveryNthItem_2)

# group: Approach 2
split_2 = String.Split(str=replace, separator0=new_line_symbol)
split_3 = String.Split(str=split_2, separator0=tab_symbol)
transpose = List.Transpose(lists=split_3)
code_block_5 = CodeBlock(a=transpose) { a[0]; a[1]; }
