# Dynamo graph Load in revit.dyn (Dynamo 2.3.0.5885)

sub = _ - _  # unwired: x, y
categories = Categories()  # nothing selected
integer_slider = IntegerSlider(57, range=3..100 step 1)
code_block = CodeBlock(amount=integer_slider) { 0..100..#amount; }
byCoordinates = Point.ByCoordinates(x=code_block, y=code_block, lacing=CrossProduct)
code_block_2 = CodeBlock(amount=integer_slider) { 0..360..#amount; }
integer_slider_2 = IntegerSlider(2, range=1..10 step 1)
code_block_3 = CodeBlock(value=code_block_2, definition=integer_slider_2) { value*definition; }
sin = Math.Sin(angle=code_block_3)
integer_slider_3 = IntegerSlider(26, range=0..100 step 1)
code_block_4 = CodeBlock(value=sin, scale=integer_slider_3) { value*scale; }
code_block_5 = CodeBlock(sinvalues=code_block_4, amount=integer_slider) { 0..sinvalues..#amount; }
transpose = List.Transpose(lists=code_block_5)
add = code_block_5 + transpose
translate = Geometry.Translate(geometry=byCoordinates, zTranslation=add)
byPoints = NurbsSurface.ByPoints(points=translate)
byGeometry = ImportInstance.ByGeometry(geometry=byPoints)
