# Dynamo graph Load in revit_02.dyn (Dynamo 2.3.0.5885)
# packages: spring nodes 110.0.2

sub = _ - _  # unwired: x, y
byGeometry = DirectShape.ByGeometry()  # unwired: geometry, category
integer_slider = IntegerSlider(57, range=3..100 step 1)
code_block = CodeBlock(amount=integer_slider) { 0..100..#amount; }
byCoordinates = Point.ByCoordinates(x=code_block, y=code_block, lacing=CrossProduct)
code_block_2 = CodeBlock(amount=integer_slider) { 0..360..#amount; }
integer_slider_2 = IntegerSlider(2, range=1..10 step 1)
code_block_3 = CodeBlock(value=code_block_2, definition=integer_slider_2) { value*definition; }
sin = Math.Sin(angle=code_block_3)
integer_slider_3 = IntegerSlider(26, range=0..100 step 1)
code_block_4 = CodeBlock(value=sin, scale=integer_slider_3) { value*scale; }
code_block_5 = CodeBlock(sinvalues=code_block_4, amount=integer_slider) { 0..sinvalues..#amount; }
transpose = List.Transpose(lists=code_block_5)
add = code_block_5 + transpose
translate = Geometry.Translate(geometry=byCoordinates, zTranslation=add)
byPoints = NurbsSurface.ByPoints(points=translate)
categories = Categories("OST_Roofs")
string = StringInput("Roof1")
byGeometry_2 = Custom[Springs.DirectShape.ByGeometry](geometry=byPoints, category=categories, name=string)  # package spring nodes; Convert the input geometry to DirectShape element inside the Revit document. It supports solids or surfaces. It is based on an alternative process that uses a SAT import and can produce smooth surfaces. Each created DS will have a unique type. Make sure that each input geometry has a unique name. You can either feed a single category for all geometries or a unique category for each geometry - the node's lacing is set to longest by default. The default category is Generic Models.
