# Dynamo graph Load in revit_03.dyn (Dynamo 2.3.0.5885)
# packages: spring nodes 203.1.0

sub = _ - _  # unwired: x, y
integer_slider = IntegerSlider(57, range=3..100 step 1)
code_block = CodeBlock(amount=integer_slider) { 0..10000..#amount; }
byCoordinates = Point.ByCoordinates(x=code_block, y=code_block, lacing=CrossProduct)
code_block_2 = CodeBlock(amount=integer_slider) { 0..360..#amount; }
integer_slider_2 = IntegerSlider(2, range=1..10 step 1)
code_block_3 = CodeBlock(value=code_block_2, definition=integer_slider_2) { value*definition; }
sin = Math.Sin(angle=code_block_3)
integer_slider_3 = IntegerSlider(2600, range=0..2600 step 1)
code_block_4 = CodeBlock(value=sin, scale=integer_slider_3) { value*scale; }
code_block_5 = CodeBlock(sinvalues=code_block_4, amount=integer_slider) { 0..sinvalues..#amount; }
transpose = List.Transpose(lists=code_block_5)
add = code_block_5 + transpose
translate = Geometry.Translate(geometry=byCoordinates, zTranslation=add)
byPoints = NurbsSurface.ByPoints(points=translate)
ꟿ_form_bygeometry = Custom[ꟿ Form.ByGeometry](geometry=byPoints)  # package spring nodes; Convert the input geometry to a Revit Form object. Forms can exist only in the family environment. You can convert complicated solids or surfaces directly into forms. A form can act as a void. Provide either one true boolean value to convert a form into a void. The node's lacing is set to longest by default.
