# Dynamo graph Load in revit_04dyn.dyn (Dynamo 2.3.0.5885)
# packages: spring nodes 203.1.0, Orchid 230.0.0.7288

sub = _ - _  # unwired: x, y
integer_slider = IntegerSlider(57, range=3..100 step 1)
code_block = CodeBlock(amount=integer_slider) { 0..100..#amount; }
byCoordinates = Point.ByCoordinates(x=code_block, y=code_block, lacing=CrossProduct)
code_block_2 = CodeBlock(amount=integer_slider) { 0..360..#amount; }
integer_slider_2 = IntegerSlider(2, range=1..10 step 1)
code_block_3 = CodeBlock(value=code_block_2, definition=integer_slider_2) { value*definition; }
sin = Math.Sin(angle=code_block_3)
integer_slider_3 = IntegerSlider(26, range=0..100 step 1)
code_block_4 = CodeBlock(value=sin, scale=integer_slider_3) { value*scale; }
code_block_5 = CodeBlock(sinvalues=code_block_4, amount=integer_slider) { 0..sinvalues..#amount; }
transpose = List.Transpose(lists=code_block_5)
add = code_block_5 + transpose
translate = Geometry.Translate(geometry=byCoordinates, zTranslation=add)
byPoints = NurbsSurface.ByPoints(points=translate)
code_block_6 = CodeBlock { 1; }
thicken = Surface.Thicken(surface=byPoints, thickness=code_block_6)
code_block_7 = CodeBlock { "Roof3"; }
categories = Categories("OST_GenericModel")
file_path = Filename("C:\ProgramData\Autodesk\RVT 2020\Family Templates\English\Metric Generic Model.rft")
material = Material("Default")
code_block_8 = CodeBlock { 100; }

# group: OOTB
byPointAndLevel = FamilyInstance.ByPointAndLevel()  # unwired: familyType, point, level
byGeometry = FamilyType.ByGeometry(solidGeometry=thicken, name=code_block_7, category=categories, templatePath=file_path, material=material)
byCoordinates_2 = FamilyInstance.ByCoordinates(familyType=byGeometry, x=code_block_8)
byPoint = FamilyInstance.ByPoint()  # unwired: familyType, point

string = StringInput("Roof1")

# group: Springs ꟿ
ꟿ_familyinstance_bygeometry = Custom[ꟿ FamilyInstance.ByGeometry](geometry=byPoints, familyTemplatePath=file_path, familyName=string, category=categories)  # frozen; package spring nodes; You must provide a valid family template path that will be used for all input geometry objects. The project units(and not the templates) will be used to determine the size of the output geometry. The provided category will be used only if the family template supports it. If not, the default template category will be used instead. Likewise, the family material(provided as a string) will be set only if a material with that name exists in the template. If not, the default material will be used instead ("By Category"). For void cuts, the material settings will be ignored. The Subcategory name is an optional input. If you'd like to skip assigning a Subcategory to any new instance, simply use null. The node expects a unique family name for each geometry object. The rest of the input lists will be processed as if the node lacing is set to longest.

code_block_9 = CodeBlock { "Default"; }
byCoordinates_3 = Point.ByCoordinates()
