# Dynamo graph Link Multiple DWGs.dyn (Dynamo 2.0.2.6826)

code_block = CodeBlock { "Link multiple DWGs"; }
code_block_2 = CodeBlock { "Link Those Files"; }
code_block_3 = CodeBlock { "Colors"; }
python_script = Python()
# ---------- python_script.python (34 lines) ----------
import clr
clr.AddReference('ProtoGeometry')
from Autodesk.DesignScript.Geometry import *

# Import DocumentManager and TransactionManager
clr.AddReference("RevitServices")
import RevitServices
from RevitServices.Persistence import DocumentManager
from RevitServices.Transactions import TransactionManager

doc = DocumentManager.Instance.CurrentDBDocument
uiapp = DocumentManager.Instance.CurrentUIApplication
app = uiapp.Application

# Import RevitAPI
clr.AddReference("RevitAPI")
import Autodesk
from Autodesk.Revit.DB import *

#The inputs to this node will be stored as a list in the IN variables.
dataEnteringNode = IN

colormodelist = [ImportColorMode.Preserved, ImportColorMode.Inverted, ImportColorMode.BlackAndWhite]
colormodenames = ["Preserve", "Invert", "Black and White"]

placementlist = [ImportPlacement.Centered,ImportPlacement.Origin,ImportPlacement.Shared]
placementnames = ["Auto - Center to Center", "Auto - Origin to Origin", "Auto - by Shared Coordinates"]


unitlist = [ImportUnit.Default,ImportUnit.Foot,ImportUnit.Inch,ImportUnit.Meter,ImportUnit.Decimeter,ImportUnit.Centimeter,ImportUnit.Millimeter,ImportUnit.Custom]
unitnames = ["Auto-Detect", "feet", "inch", "meter","decimeter","centimeter","milimeter","Custom factor"]

#Assign your output to the OUT variable.
OUT = [colormodelist, colormodenames, placementlist, placementnames, unitlist, unitnames]
# ----------------------------------------
code_block_4 = CodeBlock(a=python_script) { a[0]; a[1]; "-----"; a[2]; a[3]; "------"; a[4]; a[5]; }
ui_dropdown_data = Custom[UI.DropDown Data](InputName=code_block_3, Keys_var=code_block_4.out1, Values_var=code_block_4.out0)  # Create data for DropDown input in UI.MultiInputForm ++ . Check out www.data-shapes.net for more infos.
code_block_5 = CodeBlock { "Positioning"; }
ui_dropdown_data_2 = Custom[UI.DropDown Data](InputName=code_block_5, Keys_var=code_block_4.out4, Values_var=code_block_4.out3)
code_block_6 = CodeBlock { "Import units"; }
ui_dropdown_data_3 = Custom[UI.DropDown Data](InputName=code_block_6, Keys_var=code_block_4.out7, Values_var=code_block_4.out6)
code_block_7 = CodeBlock { "Correct lines that are slightly off axis"; }
ui_boolean_input = Custom[UI.Boolean input](SideText=code_block_7)  # Creates a boolean input for UI.MultipleInputForm ++ . Check out www.data-shapes.net for more infos!
code_block_8 = CodeBlock { "Orient to View"; }
ui_boolean_input_2 = Custom[UI.Boolean input](SideText=code_block_8)
code_block_9 = CodeBlock { "Current view only"; }
ui_boolean_input_3 = Custom[UI.Boolean input](SideText=code_block_9)
code_block_10 = CodeBlock { "DWGs in Directory"; "Browse"; }
ui_textbox_data = Custom[UI.TextBox Data](InputName=code_block_10.out0)  # Create Data for TextBox input in UI.MultipleInputForm ++ . Check out www.data-shapes.net for more informations
list_create = List.Create(item0=ui_dropdown_data, item1=ui_dropdown_data_2, item2=ui_dropdown_data_3, item3=ui_boolean_input, item4=ui_boolean_input_2, item5=ui_boolean_input_3, item6=ui_textbox_data)
boolean = BoolSelector(true)
code_block_11 = CodeBlock { "Cancel Operation"; }
ui_multipleinputform = Custom[UI.MultipleInputForm ++](Description_optional=code_block, ButtonText_optional=code_block_2, Inputs=list_create, Toggle=boolean, CancelButtonText_optional=code_block_11)  # Create a form with multiple inputs. see www.data-shapes.net for tutorials and infos!
code_block_12 = CodeBlock(a=ui_multipleinputform.User_Inputs) { a[0]; a[1]; "-----"; a[2]; a[3]; "------"; a[4]; a[5]; a[6]; }
directory_from_path = DirectoryObject(path=code_block_12.out8)
getDirectoryContents = FileSystem.GetDirectoryContents(directory=directory_from_path)
python_script_2 = Python(IN[0]=getDirectoryContents.files, IN[1]=code_block_12.out0, IN[2]=code_block_12.out1, IN[3]=code_block_12.out3, IN[4]=code_block_12.out4, IN[5]=code_block_12.out6, IN[6]=code_block_12.out7)
# ---------- python_script_2.python (41 lines) ----------
import clr
clr.AddReference('ProtoGeometry')
from Autodesk.DesignScript.Geometry import *

# Import DocumentManager and TransactionManager
clr.AddReference("RevitServices")
import RevitServices
from RevitServices.Persistence import DocumentManager
from RevitServices.Transactions import TransactionManager

doc = DocumentManager.Instance.CurrentDBDocument
uiapp = DocumentManager.Instance.CurrentUIApplication
app = uiapp.Application

# Import RevitAPI
clr.AddReference("RevitAPI")
import Autodesk
from Autodesk.Revit.DB import *

#The inputs to this node will be stored as a list in the IN variables.
dataEnteringNode = IN
files = IN[0]
view = doc.ActiveView

options = DWGImportOptions()
options.AutoCorrectAlmostVHLines = IN[4]
options.ColorMode = IN[1]
options.OrientToView = IN[5]
options.ThisViewOnly = IN[6]
options.VisibleLayersOnly = True
options.Unit = IN[3]
options.Placement = IN[2]
linkedElem = clr.Reference[ElementId]()

TransactionManager.Instance.EnsureInTransaction(doc)
for filePath in files:
	doc.Link(filePath, options, view, linkedElem)
TransactionManager.Instance.TransactionTaskDone()

#Assign your output to the OUT variable.
OUT = 0
# ----------------------------------------
