# Dynamo graph Change Sheet Name.dyn (Dynamo 2.3.0.5885)
# packages: Clockwork for Dynamo 2.x 2.3.0

categories = Categories("OST_Sheets")
all_elements_of_category = ElementsOfCategory(Category=categories)
code_block = CodeBlock { "Sheet Number"; }
boolean = BoolSelector(true)
projectInfo = Custom[Document.ProjectInfo](toggle=boolean)  # package Clockwork for Dynamo 2.x; Gets the project information.
getParameterValueByName = Element.GetParameterValueByName(element=all_elements_of_category, parameterName=code_block)
code_block_2 = CodeBlock { 1; }
code_block_3 = CodeBlock { 3; }
substring = String.Substring(str=getParameterValueByName, startIndex=code_block_2, length=code_block_3)
code_block_4 = CodeBlock { "0"; }
insert = String.Insert(str=substring, index=code_block_2, toInsert=code_block_4)
code_block_5 = CodeBlock(projectnumber=projectInfo.Number, sheetnumber=insert) { projectnumber + " "+ sheetnumber; }
setParameterByName = Element.SetParameterByName(element=all_elements_of_category, parameterName=code_block, value=code_block_5)
code_block_6 = CodeBlock { "Sheet Name"; }
views = Sheet.Views(sheet=all_elements_of_category)
type = Custom[View.Type](view=views@L2)  # package Clockwork for Dynamo 2.x; Returns the type of a given view
count = List.Count(list=type@L2)
string_for_multiple = StringInput("")  # graph input
code_block_7 = CodeBlock(list1=count, Multiple=string_for_multiple, list2=type) { list1>1?Multiple:list2; }
firstItem = List.FirstItem(list=code_block_7@L2)
string_for_empty = StringInput("String For Empty")  # graph input
code_block_8 = CodeBlock(list1=firstItem, empty=string_for_empty) { list1==null?empty:list1; }
setParameterByName_2 = Element.SetParameterByName(element=all_elements_of_category, parameterName=code_block_6, value=code_block_8)  # graph output
