# Dynamo graph Sheets from views.dyn (Dynamo 2.3.0.5885)
# packages: archi-lab.net 2020.23.2

code_block = CodeBlock { "Something"; }
view_type = ViewTypesUi("Section")
getByType = archilab.Revit.Views.Views.GetByType(viewType=view_type)
name = Element.Name(element=getByType)
code_block_2 = CodeBlock { " "; }
code_block_3 = CodeBlock { " View "; }
replace = String.Replace(str=name, searchFor=code_block_2, replaceWith=code_block_3)
family_types = FamilyTypes("a3:a3")
byNameNumberTitleBlockAndView = Sheet.ByNameNumberTitleBlockAndView(sheetName=code_block, sheetNumber=replace, titleBlockFamilyType=family_types, view=getByType)
code_block_4 = CodeBlock { "SomethingUnique"; }
byNameNumberTitleBlockAndViews = Sheet.ByNameNumberTitleBlockAndViews(sheetName=code_block, sheetNumber=code_block_4, titleBlockFamilyType=family_types, views=getByType)  # frozen
