# Dynamo graph Sheets from views_forDplayer.dyn (Dynamo 2.3.0.5885)
# packages: archi-lab.net 2020.23.2

single_multiple = BoolSelector(true)  # graph input
sheetName = StringInput("")  # graph input
code_block = CodeBlock(Something=sheetName) { Something; }
sheetNumber = StringInput("")  # graph input
select_titleblock = FamilyTypes("A1 metric:A1 metric")  # graph input
byNameNumberTitleBlockAndViews = Sheet.ByNameNumberTitleBlockAndViews(sheetName=code_block, sheetNumber=sheetNumber, titleBlockFamilyType=select_titleblock)  # unwired: views
view_type = ViewTypesUi("Section")  # graph input
getByType = archilab.Revit.Views.Views.GetByType(viewType=view_type)
name = Element.Name(element=getByType)
code_block_2 = CodeBlock { " "; }
code_block_3 = CodeBlock { " View "; }
replace = String.Replace(str=name, searchFor=code_block_2, replaceWith=code_block_3)
byNameNumberTitleBlockAndView = Sheet.ByNameNumberTitleBlockAndView(sheetName=code_block, sheetNumber=replace, titleBlockFamilyType=select_titleblock)  # unwired: view
if_ = If(test=single_multiple, true=byNameNumberTitleBlockAndViews, false=byNameNumberTitleBlockAndView)
function_apply = ApplyFunction(func=if_, arg1=getByType)
