# Dynamo graph Sin Curve.dyn (Dynamo 2.3.0.5885)

integer_slider = IntegerSlider(10, range=3..100 step 1)
code_block = CodeBlock(amount=integer_slider) { 0..100..#amount; }
code_block_2 = CodeBlock(amount=integer_slider) { 0..360..#amount; }
integer_slider_2 = IntegerSlider(1, range=1..10 step 1)
code_block_3 = CodeBlock(value=code_block_2, definition=integer_slider_2) { value*definition; }
sin = Math.Sin(angle=code_block_3)
integer_slider_3 = IntegerSlider(20, range=0..100 step 1)
code_block_4 = CodeBlock(value=sin, scale=integer_slider_3) { value*scale; }
byCoordinates = Point.ByCoordinates(x=code_block, y=code_block, z=code_block_4)
byPoints = NurbsCurve.ByPoints(points=byCoordinates)
YAxis = Vector.YAxis()
code_block_5 = CodeBlock { 100; }
extrude = Curve.Extrude(curve=byPoints, direction=YAxis, distance=code_block_5)
