# Dynamo graph Sin Curve_Start.dyn (Dynamo 2.3.0.5885)

integer_slider = IntegerSlider(10, range=3..100 step 1)
code_block = CodeBlock(amount=integer_slider) { 0..360..#amount; }
integer_slider_2 = IntegerSlider(1, range=1..10 step 1)
code_block_2 = CodeBlock(value=code_block, definition=integer_slider_2) { value*definition; }
sin = Math.Sin(angle=code_block_2)
