# Dynamo graph unfold deomo.dyn (Dynamo 2.3.0.5885)
# packages: archi-lab.net 2020.23.2

code_block = CodeBlock { "Temp2"; }
byName = DraftingView.ByName(name=code_block)
byCoordinates = Point.ByCoordinates()
YAxis = Vector.YAxis()
select_model_element = DSModelElementSelection()  # 1 picked in the model
getLocation = Element.GetLocation(element=select_model_element)
length = Curve.Length(curve=getLocation)
byStartPointDirectionLength = Line.ByStartPointDirectionLength(startPoint=byCoordinates, direction=YAxis, length=length)
XAxis = Vector.XAxis()
code_block_2 = CodeBlock { 10000; }
extrude = Curve.Extrude(curve=byStartPointDirectionLength, direction=XAxis, distance=code_block_2)
extrude_2 = Curve.Extrude(curve=getLocation, distance=code_block_2)
geometry = Element.Geometry(element=select_model_element)

# group: Do if you don't get the right geometry
faces = Topology.Faces(topology=geometry)
surfaceGeometry = Face.SurfaceGeometry(face=faces)
byJoinedSurfaces = PolySurface.ByJoinedSurfaces(surfaces=surfaceGeometry)
extractSolids = PolySurface.ExtractSolids(polySurface=byJoinedSurfaces)
volume = Solid.Volume(solid=extractSolids)
sortByKey = List.SortByKey(list=extractSolids@L2, keys=volume@L2)
reverse = List.Reverse(list=sortByKey.sorted_list@L2)
deconstruct = List.Deconstruct(list=reverse@L2)

differenceAll = Solid.DifferenceAll(solid=deconstruct.first, others=deconstruct.rest)
intersect = Geometry.Intersect(geometry=extrude_2, other=differenceAll)
perimeterCurves = Surface.PerimeterCurves(surface=intersect)
group_curves = Custom[Group Curves](curves=perimeterCurves@L2)  # package archi-lab.net; This node will take any input of flat list of curves and group them into sublists containing "joinable" curves that is continous curves. They might form closed curves or open curves. Use PolyCurve.ByJoinedCurves to convert output groups of curves into single PolyCurves
byJoinedCurves = PolyCurve.ByJoinedCurves(curves=group_curves)
explode = Geometry.Explode(geometry=byJoinedCurves)
startPoint = Curve.StartPoint(curve=explode)
UVParameterAtPoint = Surface.UVParameterAtPoint(surface=extrude_2, point=startPoint)
U = UV.U(uV=UVParameterAtPoint)
V = UV.V(uV=UVParameterAtPoint)
pointAtParameter = Surface.PointAtParameter(surface=extrude, u=U, v=V)
boolean = BoolSelector(true)
byPoints = PolyCurve.ByPoints(points=pointAtParameter, connectLastToFirst=boolean)
explode_2 = Geometry.Explode(geometry=byPoints)
byCurve = DetailCurve.ByCurve(view=byName, curve=explode_2)
