# Dynamo graph Wall By Curve.dyn (Dynamo 2.3.0.5885)

code_block = CodeBlock { 10000; }
byCenterPointRadius = Circle.ByCenterPointRadius(radius=code_block)
code_block_2 = CodeBlock { 8; }
regularPolygon = Polygon.RegularPolygon(circle=byCenterPointRadius, numberSides=code_block_2)
explode = Geometry.Explode(geometry=regularPolygon)
code_block_3 = CodeBlock { 2; }
takeEveryNthItem = List.TakeEveryNthItem(list=explode, n=code_block_3)
code_block_4 = CodeBlock { 0.5; }
pointAtParameter = Curve.PointAtParameter(curve=takeEveryNthItem, param=code_block_4)
byControlPoints = NurbsCurve.ByControlPoints(points=pointAtParameter)
approximateWithArcAndLineSegments = Curve.ApproximateWithArcAndLineSegments(curve=byControlPoints)
code_block_5 = CodeBlock { 1000; }
levels = Levels("Level 0")
wall_types = WallTypes("Wall-Ext_102Bwk-50Air-45Ins-100DBlk-12P")
byCurveAndHeight = Wall.ByCurveAndHeight(curve=approximateWithArcAndLineSegments, height=code_block_5, level=levels, wallType=wall_types)
byCurveAndLevels = Wall.ByCurveAndLevels()  # unwired: c, startLevel, endLevel, wallType
code_block_6 = CodeBlock(count=code_block_2) { 2000..10000..#count; }
code_block_7 = CodeBlock { 0.5; }
splitByParameter = Curve.SplitByParameter(curve=byCenterPointRadius, parameters=code_block_7)
code_block_8 = CodeBlock { 3; }
simplify = Curve.Simplify(curve=byControlPoints, tolerance=code_block_8)
