# Dynamo graph Wall By Face.dyn (Dynamo 2.3.0.5885)
# packages: spring nodes 203.1.0

code_block = CodeBlock { 1; }
wall_location = WallLocation("CoreCenterline")
wall_types = WallTypes("Wall-Ext_102Bwk-75Ins-100Blk-12P_Banding")
integer_slider = IntegerSlider(57, range=3..100 step 1)
code_block_2 = CodeBlock(amount=integer_slider) { 0..10000..#amount; }
byCoordinates = Point.ByCoordinates(x=code_block_2, y=code_block_2, lacing=CrossProduct)
code_block_3 = CodeBlock(amount=integer_slider) { 0..360..#amount; }
integer_slider_2 = IntegerSlider(2, range=1..10 step 1)
code_block_4 = CodeBlock(value=code_block_3, definition=integer_slider_2) { value*definition; }
sin = Math.Sin(angle=code_block_4)
integer_slider_3 = IntegerSlider(1000, range=0..1000 step 1)
code_block_5 = CodeBlock(value=sin, scale=integer_slider_3) { value*scale; }
code_block_6 = CodeBlock(sinvalues=code_block_5, amount=integer_slider) { 0..sinvalues..#amount; }
transpose = List.Transpose(lists=code_block_6)
add = code_block_6 + transpose
translate = Geometry.Translate(geometry=byCoordinates, zTranslation=add)
byPoints = NurbsSurface.ByPoints(points=translate)
file_path = Filename("C:\ProgramData\Autodesk\RVT 2020\Family Templates\English\Metric Generic Model.rft")
string = StringInput("Roof for face")
categories = Categories("OST_GenericModel")

# group: Springs ꟿ
ꟿ_familyinstance_bygeometry = Custom[ꟿ FamilyInstance.ByGeometry](geometry=byPoints, familyTemplatePath=file_path, familyName=string, category=categories)  # package spring nodes; You must provide a valid family template path that will be used for all input geometry objects. The project units(and not the templates) will be used to determine the size of the output geometry. The provided category will be used only if the family template supports it. If not, the default template category will be used instead. Likewise, the family material(provided as a string) will be set only if a material with that name exists in the template. If not, the default material will be used instead ("By Category"). For void cuts, the material settings will be ignored. The Subcategory name is an optional input. If you'd like to skip assigning a Subcategory to any new instance, simply use null. The node expects a unique family name for each geometry object. The rest of the input lists will be processed as if the node lacing is set to longest.

faces = Element.Faces(element=ꟿ_familyinstance_bygeometry.instance)
byFace = Wall.ByFace(locationLine=wall_location, wallType=wall_types, surface=faces)
