# Dynamo graph Windows from Dynamo.dyn (Dynamo 2.3.0.5885)
# packages: spring nodes 203.1.0

select_model_element = DSModelElementSelection()  # 1 picked in the model
family_types = FamilyTypes("Windows_Sgl_Plain:Square Normal")
family_types_2 = FamilyTypes("Windows_Sgl_Plain:Square Red")
list_create = List.Create(item0=family_types, item1=family_types_2)
select_face = DSFaceSelection()  # 1 picked in the model
number_slider = DoubleSlider(5, range=0..30 step 1)
code_block = CodeBlock(b=number_slider) { 0.2..0.8..#b; }
number_slider_2 = DoubleSlider(5, range=0..30 step 1)
code_block_2 = CodeBlock(b=number_slider_2) { 0.2..0.8..#b; }
pointAtParameter = Surface.PointAtParameter(surface=select_face, u=code_block, v=code_block_2, lacing=CrossProduct)
code_block_3 = CodeBlock(a=pointAtParameter) { a[0]; }
code_block_4 = CodeBlock { 2; }
dropEveryNthItem = List.DropEveryNthItem(list=code_block_3, n=code_block_4)
dropEveryNthItem_2 = List.DropEveryNthItem(list=dropEveryNthItem@L2, n=code_block_4)
takeEveryNthItem = List.TakeEveryNthItem(list=code_block_3, n=code_block_4)
takeEveryNthItem_2 = List.TakeEveryNthItem(list=takeEveryNthItem@L2, n=code_block_4)
list_create_2 = List.Create(item0=dropEveryNthItem_2, item1=takeEveryNthItem_2)
takeEveryNthItem_3 = List.TakeEveryNthItem(list=dropEveryNthItem@L2, n=code_block_4)
dropEveryNthItem_3 = List.DropEveryNthItem(list=takeEveryNthItem@L2, n=code_block_4)
list_create_3 = List.Create(item0=takeEveryNthItem_3, item1=dropEveryNthItem_3)
list_create_4 = List.Create(item0=list_create_2, item1=list_create_3)
byPoints = Custom[Springs.HostedInstance.ByPoints](host=select_model_element, type=list_create, point=list_create_4, lacing=Longest)  # package spring nodes; Creates hosted family instances(doors/windows) at the specified points. You can feed either a single family type or a unique type for each instance.
file_path = Filename("No file selected.")
