# Dynamo graph Windows from Dynamo_start.dyn (Dynamo 2.3.0.5885)

select_face = DSFaceSelection()  # 1 picked in the model
number_slider = DoubleSlider(10, range=0..30 step 1)
code_block = CodeBlock(b=number_slider) { 0..1..#b; }
number_slider_2 = DoubleSlider(10, range=0..30 step 1)
code_block_2 = CodeBlock(b=number_slider_2) { 0..1..#b; }
pointAtParameter = Surface.PointAtParameter(surface=select_face, u=code_block, v=code_block_2, lacing=CrossProduct)
code_block_3 = CodeBlock(a=pointAtParameter) { a[0]; }

# group: ChessBoard
code_block_4 = CodeBlock { 2; }
dropEveryNthItem = List.DropEveryNthItem(list=code_block_3@L2, n=code_block_4)
takeEveryNthItem = List.TakeEveryNthItem(list=dropEveryNthItem@L2, n=code_block_4)
takeEveryNthItem_2 = List.TakeEveryNthItem(list=code_block_3@L2, n=code_block_4)
dropEveryNthItem_2 = List.DropEveryNthItem(list=takeEveryNthItem_2@L2, n=code_block_4)
list_create = List.Create(item0=takeEveryNthItem, item1=dropEveryNthItem_2)
dropEveryNthItem_3 = List.DropEveryNthItem(list=dropEveryNthItem@L2, n=code_block_4)
takeEveryNthItem_3 = List.TakeEveryNthItem(list=takeEveryNthItem_2@L2, n=code_block_4)
list_create_2 = List.Create(item0=dropEveryNthItem_3, item1=takeEveryNthItem_3)
