# Dynamo graph Windows from Dynamo_Chessboard.dyn (Dynamo 2.3.0.5885)
# packages: spring nodes 203.1.0

select_model_elements = DSModelElementsSelection()  # 1 picked in the model
family_types = FamilyTypes("Windows_Sgl_Plain:Square Normal")
family_types_2 = FamilyTypes("Windows_Sgl_Plain:Square Red")
list_create = List.Create(item0=family_types, item1=family_types_2)
select_face = DSFaceSelection()  # 1 picked in the model
number_slider = DoubleSlider(0.15, range=0..1 step 0.01)
number_slider_2 = DoubleSlider(0.85, range=0..1 step 0.01)
number_slider_3 = DoubleSlider(5, range=0..30 step 1)
code_block = CodeBlock(b1=number_slider, b2=number_slider_2, b=number_slider_3) { b1..b2..#b; }
number_slider_4 = DoubleSlider(5, range=0..30 step 1)
code_block_2 = CodeBlock(b1=number_slider, b2=number_slider_2, b=number_slider_4) { b1..b2..#b; }
pointAtParameter = Surface.PointAtParameter(surface=select_face, u=code_block, v=code_block_2, lacing=CrossProduct)
code_block_3 = CodeBlock(a=pointAtParameter) { a[0]; }

# group: ChessBoard
code_block_4 = CodeBlock { 2; }
dropEveryNthItem = List.DropEveryNthItem(list=code_block_3, n=code_block_4)
dropEveryNthItem_2 = List.DropEveryNthItem(list=dropEveryNthItem@L2, n=code_block_4)
takeEveryNthItem = List.TakeEveryNthItem(list=code_block_3, n=code_block_4)
takeEveryNthItem_2 = List.TakeEveryNthItem(list=takeEveryNthItem@L2, n=code_block_4)
list_create_2 = List.Create(item0=dropEveryNthItem_2, item1=takeEveryNthItem_2)
takeEveryNthItem_3 = List.TakeEveryNthItem(list=dropEveryNthItem@L2, n=code_block_4)
dropEveryNthItem_3 = List.DropEveryNthItem(list=takeEveryNthItem@L2, n=code_block_4)
list_create_3 = List.Create(item0=takeEveryNthItem_3, item1=dropEveryNthItem_3)

list_create_4 = List.Create(item0=list_create_2, item1=list_create_3)
ꟿ_familyinstance_byhostandpoint = Custom[ꟿ FamilyInstance.ByHostAndPoint](host=select_model_elements, type=list_create, point=list_create_4, lacing=Longest)  # package spring nodes; Creates hosted family instances(doors/windows) at the specified points. You can feed either a single family type or a unique type for each instance.
