# Dynamo graph Export_Windows to Excel_01.dyn (Dynamo 2.3.0.5885)

file_path = Filename(".\WIndows on a Wall.xlsx")
code_block = CodeBlock { "Sheet2"; }
code_block_2 = CodeBlock { 0; }
select_model_elements = DSModelElementsSelection()  # 48 picked in the model
code_block_3 = CodeBlock { "Type"; }
getParameterValueByName = Element.GetParameterValueByName(element=select_model_elements, parameterName=code_block_3)
name = Element.Name(element=getParameterValueByName)
select_face = DSFaceSelection()  # 1 picked in the model
getLocation = Element.GetLocation(element=select_model_elements)
UVParameterAtPoint = Surface.UVParameterAtPoint(surface=select_face, point=getLocation, lacing=Longest)
U = UV.U(uV=UVParameterAtPoint)
V = UV.V(uV=UVParameterAtPoint)
list_create = List.Create(item0=name, item1=U, item2=V)
transpose = List.Transpose(lists=list_create)
boolean = BoolSelector(true)
exportExcel = Data.ExportExcel(filePath=file_path, sheetName=code_block, startRow=code_block_2, startCol=code_block_2, data=transpose, overWrite=boolean)

# group: Optional Adding Titles
code_block_4 = CodeBlock { "Element Name"; }
addItemToFront = List.AddItemToFront(item=code_block_4, list=name)
code_block_5 = CodeBlock { "U"; }
addItemToFront_2 = List.AddItemToFront(item=code_block_5, list=U)
code_block_6 = CodeBlock { "V"; }
addItemToFront_3 = List.AddItemToFront(item=code_block_6, list=V)
