# Dynamo graph WIndows From Picture.dyn (Dynamo 2.3.0.5885)
# packages: spring nodes 203.1.0

file_path = Filename("C:\Users\Kuzev\Pictures\21122273_10212249809153223_5411313231782249236_o.jpg")
file_from_path = FileObject(path=file_path)
readFromFile = Image.ReadFromFile(file=file_from_path)
code_block = CodeBlock { 100; }
pixels = Image.Pixels(image=readFromFile, xSamples=code_block, ySamples=code_block)
brightness = Color.Brightness(c=pixels)
code_block_2 = CodeBlock(x=brightness) { x<0.15; }
filterByBoolMask = List.FilterByBoolMask(list=pixels@L2, mask=code_block_2@L2)
select_face = DSFaceSelection()  # 1 picked in the model
code_block_3 = CodeBlock(b=code_block) { 0.2..0.8..#b; }
pointAtParameter = Surface.PointAtParameter(surface=select_face, u=code_block_3, v=code_block_3, lacing=CrossProduct)
filterByBoolMask_2 = List.FilterByBoolMask(list=pointAtParameter@L2, mask=code_block_2@L2)
select_model_element = DSModelElementSelection()  # 1 picked in the model
code_block_4 = CodeBlock { 0..60; }
code_block_5 = CodeBlock { 60..180; }
code_block_6 = CodeBlock { 180..360; }
join = List.Join(list0=code_block_4, list1=code_block_5, list2=code_block_6)
family_types = FamilyTypes("Windows_Sgl_Plain:Square Red")
count = List.Count(list=code_block_4)
ofRepeatedItem = List.OfRepeatedItem(item=family_types, amount=count)
family_types_2 = FamilyTypes("Windows_Sgl_Plain:Square Green")
count_2 = List.Count(list=code_block_5)
ofRepeatedItem_2 = List.OfRepeatedItem(item=family_types_2, amount=count_2)
family_types_3 = FamilyTypes("Windows_Sgl_Plain:Square Normal")
count_3 = List.Count(list=code_block_6)
ofRepeatedItem_3 = List.OfRepeatedItem(item=family_types_3, amount=count_3)
join_2 = List.Join(list0=ofRepeatedItem, list1=ofRepeatedItem_2, list2=ofRepeatedItem_3)
hue = Color.Hue(c=pixels)
round = Math.Round(number=hue)
ꟿ_dictionary_bykeysvalues = Custom[ꟿ Dictionary.ByKeysValues](keys=join, values=join_2, searchKeys=round)  # package spring nodes; Dictionaries are an incredibly powerful tool for making associative sets between two equal length lists. The first list must be of unique strings (or numbers) and will be the key and the second list will be the matching values (it can be made up of geometry, elements, even other lists) The search keys list will provide the corresponding value to the input key.
ꟿ_familyinstance_byhostandpoint = Custom[ꟿ FamilyInstance.ByHostAndPoint](host=select_model_element@L1, type=ꟿ_dictionary_bykeysvalues@L3, point=pointAtParameter@L3)  # package spring nodes; Creates hosted family instances(doors/windows) at the specified points. You can feed either a single family type or a unique type for each instance.
