# Dynamo graph Windows from Dynamo_excell.dyn (Dynamo 2.3.0.5885)
# packages: spring nodes 203.1.0

number_slider = DoubleSlider(10, range=0..30 step 1)
number_slider_2 = DoubleSlider(5, range=0..30 step 1)
select_model_elements = DSModelElementsSelection()  # 1 picked in the model
code_block = CodeBlock { ["blue","red"]; }
family_types = FamilyTypes("Windows_Sgl_Plain:Square Normal")
family_types_2 = FamilyTypes("Windows_Sgl_Plain:Square Red")
list_create = List.Create(item0=family_types, item1=family_types_2)
file_path = Filename(".\WIndows on a Wall.xlsx")
file_from_path = FileObject(path=file_path)
code_block_2 = CodeBlock { "Sheet1"; }
importExcel = Data.ImportExcel(file=file_from_path, sheetName=code_block_2)
ꟿ_dictionary_bykeysvalues = Custom[ꟿ Dictionary.ByKeysValues](keys=code_block, values=list_create, searchKeys=importExcel)  # package spring nodes; Dictionaries are an incredibly powerful tool for making associative sets between two equal length lists. The first list must be of unique strings (or numbers) and will be the key and the second list will be the matching values (it can be made up of geometry, elements, even other lists) The search keys list will provide the corresponding value to the input key.
select_face = DSFaceSelection()  # 1 picked in the model
number_slider_3 = DoubleSlider(0.15, range=0..1 step 0.01)
number_slider_4 = DoubleSlider(0.85, range=0..1 step 0.01)
count = List.Count(list=importExcel)
code_block_3 = CodeBlock(b1=number_slider_3, b2=number_slider_4, b=count) { b1..b2..#b; }
count_2 = List.Count(list=importExcel@L2)
firstItem = List.FirstItem(list=count_2)
code_block_4 = CodeBlock(b1=number_slider_3, b2=number_slider_4, b=firstItem) { b1..b2..#b; }
pointAtParameter = Surface.PointAtParameter(surface=select_face, u=code_block_3, v=code_block_4, lacing=CrossProduct)
code_block_5 = CodeBlock(a=pointAtParameter) { a[0]; }
reverse = List.Reverse(list=code_block_5)
ꟿ_familyinstance_byhostandpoint = Custom[ꟿ FamilyInstance.ByHostAndPoint](host=select_model_elements, type=ꟿ_dictionary_bykeysvalues, point=reverse, lacing=Longest)  # package spring nodes; Creates hosted family instances(doors/windows) at the specified points. You can feed either a single family type or a unique type for each instance.
boolean = BoolSelector(false)
