# Dynamo graph groups apartments.dyn "groups apartments7" (Dynamo 2.3.0.5885)
# packages: Clockwork for Dynamo 2.x 2.3.0, archi-lab.net 2020.23.2, spring nodes 203.1.0

categories = Categories("OST_IOSModelGroups")
all_elements_of_category = ElementsOfCategory(Category=categories)
group_name_contains = CodeBlock { "LGH"; }

# group: Filter Groups
name = Element.Name(element=all_elements_of_category)
contains = String.Contains(str=name, searchFor=group_name_contains)
filterByBoolMask = List.FilterByBoolMask(list=all_elements_of_category, mask=contains)
turn_into_list = Python(IN[0]=filterByBoolMask.in)
# ---------- turn_into_list.python (14 lines) ----------
import clr
clr.AddReference('ProtoGeometry')
from Autodesk.DesignScript.Geometry import *
#The inputs to this node will be stored as a list in the IN variables.
dataEnteringNode = IN
a = IN[0]


if isinstance (a, list):
	b = a
else:
	b = [a]
#Assign your output to the OUT variable.
OUT = b
# ----------------------------------------
name_2 = Element.Name(element=turn_into_list)
boolean = BoolSelector(false)  # graph input
clean = List.Clean(list=name_2, preserveIndices=boolean)
uniqueItems = List.UniqueItems(list=clean)
indexOf = List.IndexOf(list=clean)  # unwired: element
map = List.Map(list=uniqueItems, f_x=indexOf)
uniqueItems_2 = List.UniqueItems(list=map)
getItemAtIndex = List.GetItemAtIndex(list=turn_into_list, index=uniqueItems_2)  # frozen
getItemAtIndex_2 = List.GetItemAtIndex(list=clean, index=uniqueItems_2)

offset_cropbox_in_ft = CodeBlock { 3; }
runIt = BoolSelector(true)  # graph input

# group: Creates Floor Plans From Groups
create_floorplans = Python(IN[0]=getItemAtIndex, IN[1]=getItemAtIndex_2, IN[2]=offset_cropbox_in_ft, IN[3]=runIt)
# ---------- create_floorplans.python (95 lines) ----------
#Copyright(c) 2015, Konrad K Sobon
# @arch_laboratory, http://archi-lab.net

import clr
clr.AddReference('ProtoGeometry')
from Autodesk.DesignScript.Geometry import *

# Import DocumentManager and TransactionManager
clr.AddReference("RevitServices")
import RevitServices
from RevitServices.Persistence import DocumentManager
from RevitServices.Transactions import TransactionManager

doc = DocumentManager.Instance.CurrentDBDocument
uiapp = DocumentManager.Instance.CurrentUIApplication
app = uiapp.Application

# Import ToDSType(bool) extension method
clr.AddReference("RevitNodes")
import Revit
clr.ImportExtensions(Revit.Elements)

# Import RevitAPI
clr.AddReference("RevitAPI")
import Autodesk
from Autodesk.Revit.DB import *

#The inputs to this node will be stored as a list in the IN variable.
dataEnteringNode = IN

rooms = UnwrapElement(IN[0])
namePrefix = IN[1]
bboxOffset = IN[2]
runMe = IN[3]

def OffsetBBox(bbox, offset):
	bboxMinX = bbox.Min.X - offset
	bboxMinY = bbox.Min.Y - offset
	bboxMinZ = bbox.Min.Z - offset
	bboxMaxX = bbox.Max.X + offset
	bboxMaxY = bbox.Max.Y + offset
	bboxMaxZ = bbox.Max.Z + offset
	newBbox = BoundingBoxXYZ()
	newBbox.Min = XYZ(bboxMinX, bboxMinY, bboxMinZ)
	newBbox.Max = XYZ(bboxMaxX, bboxMaxY, bboxMaxZ)
	return newBbox

if runMe:
	viewTypes = FilteredElementCollector(doc).OfClass(ViewFamilyType)
	for i in viewTypes:
		if i.ViewFamily == ViewFamily.FloorPlan:
			viewTypeId = i.Id
			break
		else:
			continue
	existingPlans = FilteredElementCollector(doc).OfClass(View).ToElements()
	existingPlanNames, existingPlanElements = [], []
	for i in existingPlans:
		if not i.IsTemplate:
			if i.ViewType == ViewType.FloorPlan:
				existingPlanNames.append(i.ToDSType(True).Name)
				existingPlanElements.append(i)
				
	# Start Transaction
	doc = DocumentManager.Instance.CurrentDBDocument
	TransactionManager.Instance.EnsureInTransaction(doc)
	
	floorPlans = []
	counter = 0
	for i in rooms:
		levelId = i.LevelId
		bbox = i.BoundingBox[doc.ActiveView]
		newBbox = OffsetBBox(bbox, bboxOffset)
		viewName =  UnwrapElement(namePrefix[counter])
		if viewName in existingPlanNames:
			view = existingPlanElements[existingPlanNames.index(viewName)]
			view.CropBox = newBbox
			view.CropBoxActive = True
			view.CropBoxVisible = False
			floorPlans.append(view)
		else:
			view = ViewPlan.Create(doc, viewTypeId, levelId)
			view.ViewName = viewName
			view.CropBox = newBbox
			view.CropBoxActive = True
			view.CropBoxVisible = False
			floorPlans.append(view)
		counter += 1
	# End Transaction
	TransactionManager.Instance.TransactionTaskDone()
else:
	floorPlans = "Run Me set to False"

#Assign your output to the OUT variable
OUT = floorPlans
# ----------------------------------------
code_block = CodeBlock(a0=create_floorplans) { a0; }

code_block_2 = CodeBlock(a=code_block) { a; }
members = Custom[Group.Members](group=getItemAtIndex)  # package Clockwork for Dynamo 2.x; Retrieves the members of a group
type = Object.Type(obj=members)
apartment_boundaries_in_groups = CodeBlock { "Revit.Elements.Room"; }
equals = List.Equals(objectA=type, objectB=apartment_boundaries_in_groups)
filterByBoolMask_2 = List.FilterByBoolMask(list=members, mask=equals)
centerBoundary = Room.CenterBoundary(room=filterByBoolMask_2.in)
byJoinedCurves = PolyCurve.ByJoinedCurves(curves=centerBoundary@@L2)
code_block_3 = CodeBlock { 0.4; }
offset = Curve.Offset(curve=byJoinedCurves, distance=code_block_3)
byPatch = Surface.ByPatch(closedCurve=offset)
thicken = Surface.Thicken(surface=byPatch, thickness=code_block_3)
flatten = List.Flatten(list=thicken, lacing=Longest)
byUnion = Solid.ByUnion(solids=flatten)
level = Custom[Element.Level](element=getItemAtIndex)  # package Clockwork for Dynamo 2.x; Gets an element's level
plane = Custom[Level.Plane](level=level)  # package Clockwork for Dynamo 2.x; Retrieves the plane of a given level
intersect = Geometry.Intersect(geometry=byUnion, other=plane)
perimeterCurves = Surface.PerimeterCurves(surface=intersect)
byJoinedCurves_2 = PolyCurve.ByJoinedCurves(curves=perimeterCurves)
code_block_4 = CodeBlock(x=code_block_3) { -x; }
offset_2 = Curve.Offset(curve=byJoinedCurves_2, distance=code_block_4)
code_block_5 = CodeBlock(a=offset_2) { a; }
explode = Geometry.Explode(geometry=code_block_5)
code_block_6 = CodeBlock { 1; }
flatten_2 = List.Flatten(list=explode, amt=code_block_6)
explode_2 = Geometry.Explode(geometry=offset_2)
code_block_7 = CodeBlock { 0.5; }
pointAtParameter = Curve.PointAtParameter(curve=explode_2, param=code_block_7)
code_block_8 = CodeBlock { 0.3; }
offset_3 = Curve.Offset(curve=offset_2, distance=code_block_8)
explode_3 = Geometry.Explode(geometry=offset_3)
closestPointTo = Geometry.ClosestPointTo(geometry=explode_3, other=pointAtParameter)
code_block_9 = CodeBlock(pt=closestPointTo) { pt; }
byTwoPoints = Vector.ByTwoPoints(start=pointAtParameter, end=code_block_9)
code_block_10 = CodeBlock { 1; }
flatten_3 = List.Flatten(list=byTwoPoints, amt=code_block_10)
code_block_11 = CodeBlock { x/2; }  # unwired: x
translate = Geometry.Translate(geometry=flatten_2, direction=flatten_3, distance=code_block_11)
startPoint = Curve.StartPoint(curve=translate)
endPoint = Curve.EndPoint(curve=translate)
byStartPointEndPoint = Line.ByStartPointEndPoint(startPoint=startPoint, endPoint=endPoint)
code_block_12 = CodeBlock { 1; }
merge = Custom[Springs.LineLoop.Merge](lines=byStartPointEndPoint, margin=code_block_12)  # package spring nodes; Attempts to join lines into a single chain of joined curves. The node returns the new lines as a chain and with the original order. The success outputs returns the success of the execution as a true/false boolean.
byJoinedCurves_3 = PolyCurve.ByJoinedCurves(curves=merge.lines)
byPatch_2 = Surface.ByPatch(closedCurve=byJoinedCurves_3)
code_block_13 = CodeBlock { 1; }
thicken_2 = Surface.Thicken(surface=byPatch_2, thickness=code_block_13)
join = List.Join()  # unwired: list0, list1
get_item_at_index___viktor = Custom[Get Item At Index _ Viktor]()  # unwired: list, indices
inserts = Custom[Element.Inserts](element=get_item_at_index___viktor@@L2)  # package Clockwork for Dynamo 2.x; Gets all the objects inserted into a given element.
location = Custom[Element.Location](element=inserts@@L2)  # package Clockwork for Dynamo 2.x; Returns the location of an element as point, curve or curve loop, along with some booleans to help filtering the results. Unlike the OOTB Element.GetLocation node, it also retunrs sketch lines of sketch-based elements like floor slabs as well as the element's rotation property.
code_block_14 = CodeBlock(a=location.points) { a; }
flatten_4 = List.Flatten(list=code_block_14, lacing=Longest)
doesIntersect = Geometry.DoesIntersect(geometry=code_block_5@L1, other=flatten_4@L2, lacing=Longest)
filterByBoolMask_3 = List.FilterByBoolMask(list=flatten_4, mask=doesIntersect)
code_block_15 = CodeBlock(a=filterByBoolMask_3.in) { a; }
boolean_2 = BoolSelector(false)  # graph input
clean_2 = List.Clean(list=code_block_15, preserveIndices=boolean_2)
YAxis = Vector.YAxis()
reverse = Vector.Reverse(vector=YAxis)
code_block_16 = CodeBlock { 1; }
byStartPointDirectionLength = Line.ByStartPointDirectionLength(startPoint=clean_2, direction=reverse, length=code_block_16)
code_block_17 = CodeBlock(t1=clean_2)
# ---------- code_block_17.designscript (3 lines) ----------
coordinate1 = CoordinateSystem.ByOriginVectors(t1, Vector.ByCoordinates(1, 0, 0), Vector.ByCoordinates(0, 1, 0));
vector1 = coordinate1.ZAxis;
vector2 = coordinate1.YAxis;
# ----------------------------------------
code_block_18 = CodeBlock(angle=location.angle) { angle; }
flatten_5 = List.Flatten(list=code_block_18, lacing=Longest)
filterByBoolMask_4 = List.FilterByBoolMask(list=flatten_5, mask=doesIntersect)
rotate = Geometry.Rotate(geometry=byStartPointDirectionLength, origin=filterByBoolMask_3.in, axis=code_block_17.vector1, degrees=filterByBoolMask_4.in)
code_block_19 = CodeBlock(crv=offset_3) { crv; }
doesIntersect_2 = Geometry.DoesIntersect(geometry=rotate, other=code_block_19@L1, lacing=Longest)
filterByBoolMask_5 = List.FilterByBoolMask(list=rotate, mask=doesIntersect_2)
byStartPointDirectionLength_2 = Line.ByStartPointDirectionLength(startPoint=clean_2, direction=YAxis, length=code_block_16)
rotate_2 = Geometry.Rotate(geometry=byStartPointDirectionLength_2, origin=filterByBoolMask_3.in, axis=code_block_17.vector1, degrees=filterByBoolMask_4.in)
doesIntersect_3 = Geometry.DoesIntersect(geometry=rotate_2, other=code_block_19@L1, lacing=Longest)
filterByBoolMask_6 = List.FilterByBoolMask(list=rotate_2, mask=doesIntersect_3)
combine = List.Combine(comb=join, list1=filterByBoolMask_5.in, list2=filterByBoolMask_6.in)
code_block_20 = CodeBlock { 1; }
ZAxis = Vector.ZAxis()
byThickeningCurve = PolyCurve.ByThickeningCurve(curve=combine, thickness=code_block_20, nor=ZAxis)
byPatch_3 = Surface.ByPatch(closedCurve=byThickeningCurve)
thicken_3 = Surface.Thicken(surface=byPatch_3, thickness=code_block_13)
addItemToEnd = List.AddItemToEnd(item=thicken_2@L1, list=thicken_3@L2)
byUnion_2 = Solid.ByUnion(solids=addItemToEnd)
code_block_21 = CodeBlock(pl=plane) { pl; }
intersect_2 = Geometry.Intersect(geometry=byUnion_2, other=code_block_21)
perimeterCurves_2 = Surface.PerimeterCurves(surface=intersect_2)
flatten_6 = List.Flatten(list=perimeterCurves_2, lacing=Longest)

# group: Template and Filled regions PARAMETERS
get_legend_template_view = Views()  # nothing selected; graph input
select_filled_region_type = FilledRegionTypes()  # nothing selected; graph input
view_template_name = CodeBlock { "VKV_template"; }

location_2 = Custom[Element.Location](element=getItemAtIndex)
byOriginVectors = CoordinateSystem.ByOriginVectors(origin=location_2.points)
groupByKey = List.GroupByKey(list=turn_into_list, keys=clean)
location_3 = Custom[Element.Location](element=groupByKey.groups@L2)
byOriginVectors_2 = CoordinateSystem.ByOriginVectors(origin=location_3.points)
transform = Geometry.Transform(geometry=byJoinedCurves_3, fromCoordinateSystem=byOriginVectors, contextCoordinateSystem=byOriginVectors_2, lacing=Longest)
explode_4 = Geometry.Explode(geometry=transform)

# group: Apply template and place Filled regions
code_block_22 = CodeBlock(a=flatten_6) { a; }
create_crop_sketch = Python(IN[0]=code_block_2, IN[1]=code_block_22)
# ---------- create_crop_sketch.python (54 lines) ----------
import clr

clr.AddReference('RevitNodes')
import Revit
clr.ImportExtensions(Revit.GeometryConversion)
clr.ImportExtensions(Revit.Elements)

clr.AddReference('RevitAPI')
import Autodesk
from Autodesk.Revit.DB import *

clr.AddReference('RevitServices')
import RevitServices
from RevitServices.Persistence import DocumentManager
from RevitServices.Transactions import TransactionManager

doc = DocumentManager.Instance.CurrentDBDocument

#prepare input
view = IN[0]
curvess = IN[1]

#Create curveloop

for curves, vu in zip(curvess, view):
	try:
		loop = []#CurveLoop()
		crvList = []
		counter = 0
		for c in curves:
			loop.append(UnwrapElement(c).ToRevitType())

		for bs in loop:
			if bs is clr.GetClrType(Line):
				crvList.append(bs.Curve)
			else:
				pts = bs.Tessellate()
				j = -1
				for pt in pts:
					j+=1
					if j < len(pts)-1:
						crvList.append(Line.CreateBound(pts[j], pts[j+1]))
		myLoop = CurveLoop.Create(crvList)
		View = UnwrapElement(vu)	
#Set cropregion in Transaction
		TransactionManager.Instance.EnsureInTransaction(doc)
	
		View.CropBoxActive = True
		View.GetCropRegionShapeManager().SetCropShape(myLoop)
		TransactionManager.Instance.TransactionTaskDone()
		counter +=1
	except:
		pass
OUT = view
# ----------------------------------------
count = List.Count(list=create_crop_sketch)
recursion_duplicate = Custom[RECURSION DUPLICATE](Iterations=count, View=get_legend_template_view)
code_block_23 = CodeBlock { "View Name"; }
code_block_24 = CodeBlock(a=getItemAtIndex_2) { a + " Legend"; }
setParameterByName = Element.SetParameterByName(element=recursion_duplicate, parameterName=code_block_23, value=code_block_24)
byCurves = FilledRegion.ByCurves(view=setParameterByName, boundary=explode_4, regionType=select_filled_region_type)

# group: Create Sheets Parameters
sheet_name = CodeBlock { "Apartment types"; }
prefix = CodeBlock { "AP "; }
number_of_plans_per_sheet = CodeBlock { 1; }

setViewTemplate = archilab.Revit.Views.Views.SetViewTemplate(view=create_crop_sketch, viewTemplate=view_template_name)

# group: Create Sheets
join_2 = List.Join()  # unwired: list0, list1
chop = List.Chop(list=setParameterByName, lengths=number_of_plans_per_sheet)
chop_2 = List.Chop(list=setViewTemplate, lengths=number_of_plans_per_sheet)
combine_2 = List.Combine(comb=join_2, list1=chop, list2=chop_2)
count_2 = List.Count(list=combine_2)
code_block_25 = CodeBlock(count=count_2) { 1..count; }
string_from_object = FromObject(obj=code_block_25)
code_block_26 = CodeBlock(a=prefix, b=string_from_object) { a+b; }
family_types = FamilyTypes()  # nothing selected; graph input
byNameNumberTitleBlockAndViews = Sheet.ByNameNumberTitleBlockAndViews(sheetName=sheet_name, sheetNumber=code_block_26, titleBlockFamilyType=family_types, views=combine_2)

# group: Text Note Parameters
name_of_text_type = CodeBlock { "3.5 mm Arial"; }

getTextNoteTypeByName = archilab.Revit.Selection.Select.GetTextNoteTypeByName(name=name_of_text_type)

# group: Create TExt Notes
categories_2 = Categories("OST_Lines")  # graph input
YAxis_2 = Vector.YAxis()
XAxis = Vector.XAxis()
countOccurences = Custom[List.CountOccurences](seq=clean)  # package Clockwork for Dynamo 2.x; Counts the number of occurences of each unique element in a given list
string_from_object_2 = FromObject(obj=countOccurences.uniqueElements)
string_from_object_3 = FromObject(obj=countOccurences.count)
code_block_27 = CodeBlock(a=string_from_object_2, b=string_from_object_3) { a +" - " + b + " Instance(s)"; }
count_3 = List.Count(list=code_block_27)
boolean_3 = BoolSelector(true)  # graph input

byCategoryAndView = archilab.Revit.Selection.Select.ByCategoryAndView(category=categories_2, view=get_legend_template_view)

# group (continued): Create TExt Notes
curve = CurveElement.Curve(curveElement=byCategoryAndView)
pointAtParameter_2 = Curve.PointAtParameter(curve=curve)
byBestFitThroughPoints = Circle.ByBestFitThroughPoints(points=pointAtParameter_2)
centerPoint = Circle.CenterPoint(circle=byBestFitThroughPoints)
radius = Circle.Radius(circle=byBestFitThroughPoints)
code_block_28 = CodeBlock(x=radius) { -0.5*x; }
translate_2 = Geometry.Translate(geometry=centerPoint, direction=YAxis_2, distance=code_block_28)
code_block_29 = CodeBlock(x=radius) { -x; }
translate_3 = Geometry.Translate(geometry=translate_2, direction=XAxis, distance=code_block_29)
ofRepeatedItem = List.OfRepeatedItem(item=translate_3, amount=count_3)
byViewPointAndType = Custom[TextNote.ByViewPointAndType](view=setParameterByName, point=ofRepeatedItem, text=code_block_27, textNoteType=getTextNoteTypeByName, runIt=boolean_3)  # package archi-lab.net; This node creates a unwrapped (single line) text note in a given view, at a given location with a given text note type style assigned.

flatten_7 = List.Flatten(list=explode, lacing=Longest)
count_4 = List.Count(list=flatten_7@L2)
code_block_30 = CodeBlock { 2; }
code_block_31 = CodeBlock { 0; }
getItemAtIndex_3 = List.GetItemAtIndex(index=code_block_31)  # unwired: list
code_block_32 = CodeBlock { colors; }  # unwired: colors
code_block_33 = CodeBlock { 3; }
extrudeAsSolid = Curve.ExtrudeAsSolid(curve=transform, distance=code_block_33)
name_3 = Element.Name(element=setParameterByName)
count_5 = List.Count(list=extrudeAsSolid@L2)
ofRepeatedItem_2 = List.OfRepeatedItem(item=name_3@L1, amount=count_5@L1)
getKeys = GetKeys(list=extrudeAsSolid@L2)
string_from_object_4 = FromObject(obj=getKeys)
add = ofRepeatedItem_2@L2 + string_from_object_4@L2
byGeometry = Custom[Springs.DirectShape.ByGeometry](geometry=extrudeAsSolid, name=add)  # package spring nodes; Convert the input geometry to DirectShape element inside the Revit document. It supports solids or surfaces. It is based on an alternative process that uses a SAT import and can produce smooth surfaces. Each created DS will have a unique type. Make sure that each input geometry has a unique name. You can either feed a single category for all geometries or a unique category for each geometry - the node's lacing is set to longest by default. The default category is Generic Models.
code_block_34 = CodeBlock(elements=byGeometry) { elements; }
code_block_35 = CodeBlock { 155; }
code_block_36 = CodeBlock { 145; }
byARGB = Color.ByARGB(r=code_block_35, b=code_block_36)
code_block_37 = CodeBlock { "Solid fill"; }
boolean_4 = BoolSelector(false)  # graph input
python_script = Python(IN[0]=code_block_34, IN[1]=byARGB, IN[2]=code_block_37, IN[3]=boolean_4, IN[4]=setParameterByName)
# ---------- python_script.python (94 lines) ----------
import clr
clr.AddReference('ProtoGeometry')
from Autodesk.DesignScript.Geometry import *

clr.AddReference("RevitNodes")
import Revit
clr.ImportExtensions(Revit.Elements)

clr.AddReference("RevitServices")
import RevitServices
from RevitServices.Persistence import DocumentManager
from RevitServices.Transactions import TransactionManager

from System.Collections.Generic import *

clr.AddReference("RevitAPI")
import Autodesk
from Autodesk.Revit.DB import *

doc = DocumentManager.Instance.CurrentDBDocument
uiapp = DocumentManager.Instance.CurrentUIApplication
app = uiapp.Application

input = IN[0]
colors = IN[1]
name = IN[2]
bool = IN[3]
view = IN[4]
views = []
elements = []

if isinstance(input, list):
	
	for i in input:
		items=[]
		if isinstance(i,list):
			for j in i:
				items.append(UnwrapElement(j))
		else:
			items.append(UnwrapElement(i))
		elements.append(items)
		
else:
	elements = [][UnwrapElement(input)]

if isinstance(colors,list) == False:
	dynColor = [colors]
else:
	dynColor = colors
	
if isinstance(view,list):
	for i in view:
		views.append(UnwrapElement(i))
else:
	views.append(UnwrapElement(view))
		



if bool:
	
	override = OverrideGraphicSettings()
	
	TransactionManager.Instance.EnsureInTransaction(doc)
	for e, v in zip(elements, views):
		for i in e:
			v.SetElementOverrides(i.Id, override)
	TransactionManager.Instance.TransactionTaskDone()
	OUT = views

else:
	graphSettings = Autodesk.Revit.DB.OverrideGraphicSettings()
	color = []
	for d in dynColor:
		color.append(Autodesk.Revit.DB.Color(d.Red, d.Green, d.Blue))

	fillPatDraft = FillPatternElement.GetFillPatternElementByName(doc, FillPatternTarget.Drafting, name)
	
	TransactionManager.Instance.EnsureInTransaction(doc)
	
	
	for e, v in zip(elements, views):
		for i in e:
			graphSettings.SetCutLineColor(color[0])
			graphSettings.SetCutFillColor(color[0])
			graphSettings.SetProjectionFillColor(color[0])
			if fillPatDraft:
				graphSettings.SetCutFillPatternId(fillPatDraft.Id)
				graphSettings.SetProjectionFillPatternId(fillPatDraft.Id)
			v.SetElementOverrides(i.Id, graphSettings)
		
		
	TransactionManager.Instance.TransactionTaskDone()
	OUT = elements
# ----------------------------------------
code_block_38 = CodeBlock { "Phase Created"; }
select_phase = RevitPhases()  # nothing selected; graph input
setParameterByName_2 = Element.SetParameterByName(element=python_script, parameterName=code_block_38, value=select_phase)
code_block_39 = CodeBlock { "Width"; }
bv_get_parameter_value_from_type = Custom[bv Get Parameter value from Type or Instance](element=get_item_at_index___viktor@@L1, parameterName=code_block_39)
boundaries = Custom[Room.Boundaries](room=filterByBoolMask_2.in@L2)  # package Clockwork for Dynamo 2.x; Gets a list of all boundaries of a given room or area and a corresponding list of the elements that are generating those boundaries.
code_block_40 = CodeBlock(elements=boundaries.elements) { elements; }
type_2 = Object.Type(obj=code_block_40)
code_block_41 = CodeBlock { "Revit.Elements.Floor"; }
equals_2 = List.Equals(objectA=type_2, objectB=code_block_41)
filterByBoolMask_7 = List.FilterByBoolMask(list=code_block_40, mask=equals_2)
location_4 = Custom[Element.Location](element=filterByBoolMask_7.out@@L2)
code_block_42 = CodeBlock(a=location_4.curves) { a; }
flatten_8 = List.Flatten(list=code_block_42, lacing=Longest)
python_script_2 = Python(IN[0]=flatten_7, IN[1]=flatten_8)
# ---------- python_script_2.python (42 lines) ----------
import clr
clr.AddReference('ProtoGeometry')
from Autodesk.DesignScript.Geometry import *
#The inputs to this node will be stored as a list in the IN variables.
dataEnteringNode = IN

geometry = IN[0]
other = IN[1]

lines1 = []
lines2 = []
results = []


for i in geometry:
	line1 = []
	for j in i:
		line1.append(j)
	lines1.append(line1)
	
for i in other:
	line2 = []
	for j in i:
		line2.append(j)
	lines2.append(line2)

for l1, l2 in zip(lines1,lines2):
	inters = []
	for i in l1:
		ints = []
		for j in l2:
			try:
				intersection = i.Intersect(j)
				ints.append(intersection)
			except:
				pass
		inters.append(ints)
	results.append(inters)


#Assign your output to the OUT variable.
OUT = results
# ----------------------------------------
type_3 = Object.Type(obj=python_script_2)
code_block_43 = CodeBlock { "Autodesk.DesignScript.Geometry.NurbsCurve"; }
eq = type_3 == code_block_43
code_block_44 = CodeBlock { true; }
index_of___viktor = Custom[Index OF _ Viktor](list=eq, elements=code_block_44)
code_block_45 = CodeBlock { 0; }
index_of___viktor_2 = Custom[Index OF _ Viktor](list=index_of___viktor@@L2, elements=code_block_45)
code_block_46 = CodeBlock { 0; }
getItemAtIndex_4 = List.GetItemAtIndex(list=index_of___viktor_2@@L2, index=code_block_46)
code_block_47 = CodeBlock { 0.2; }
code_block_48 = CodeBlock(a=filterByBoolMask_7.out) { a; }
flatten_9 = List.Flatten(list=code_block_48, lacing=Longest)
geometry = Element.Geometry(element=flatten_9)
code_block_49 = CodeBlock(a=filterByBoolMask.in) { a; }
allIndicesOf = List.AllIndicesOf(list=flatten_9)  # unwired: item
viewTemplate = archilab.Revit.Views.Views.ViewTemplate()  # unwired: view
setViewTemplate_2 = archilab.Revit.Views.Views.SetViewTemplate()  # unwired: view, viewTemplate
